# Grasshopper definition 01_mensola_offset_bake.ghx (Grasshopper 1.0.8)
# plug-ins: Rhino2Straus
# Esempio autonomo Rhino2Straus. Geometrie interne; metri e kN. Leggere le note sul canvas e examples/README.md.

# ---- group: 03 | Incastro e carico nodale Q
incastro = Point(Point(0, 0, 0))
estremo_libero = Point(Point(4, 0, 0))
# 01 | Mensola / m / kN: 1. Sezione rettangolare e acciaio S355.
# 2. Trave di 4 m, incastro e forza Q=-10 kN.
# 3. Offset locale di 0.05 m e asse 1 allineato a Z.
# 4. Un solo Model; preview disattivabile e Brep chiuso per il bake.
# Modifica gli slider e osserva sezioni e carichi. Nessuna API Straus richiesta.
node_element = NodeElement(NodePoint=incastro, NodeID=-1)
support = Support(Node=node_element, Dx=True, Dy=True, Dz=True, Mx=True, My=True, Mz=True)
node_element_2 = NodeElement(NodePoint=estremo_libero, NodeID=-1)
load_case = LoadCase(Name="Q", GravityNSM=False)
fz_kn = Slider(-10, range=-30..0)
load_nodal = LoadNodal(Node=node_element_2, LoadCase=load_case, Fx=0, Fy=0, Fz=fz_kn, Mx=0, My=0, Mz=0)

# ---- group: 01 | Materiale e sezione parametrica
database_steel = DatabaseSteel(Type=2)
altezza_m = Slider(0.3, range=0.1..0.7)
larghezza_m = Slider(0.2, range=0.05..0.5)
frame_section_solid_rectangular = FrameSectionSolidRectangular(Name="R parametrica", Height=altezza_m, Width=larghezza_m)
frame_property = FrameProperty(Name="Mensola S355", Section=frame_section_solid_rectangular, Material=database_steel)

# ---- group: 02 | Elemento / offset / assi locali
# Offset prima dell'allineamento: Offset: X e Y sono lungo gli assi principali 1 e 2; Z=0.
# Beam Offset imposta anche l'angolo: applicare Align Beam Axis dopo.
# Non cambiare solo la preview: questi attributi sono nel Model.
asse_di_4_m = Curve(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)
asse_1_verso_z = Vector(Vector(0, 0, 1))
frame_element = FrameElement(FrameLine=asse_di_4_m, FrameProperty=frame_property, AngleDeg=0, Offset=Vector(0, 0, 0), FrameID=-1)
beam_offset_and_orientation = BeamOffsetAndOrientation(Beam=frame_element, Offset=Vector(0.05, 0, 0), Angle=0)
align_beam_local_axis = AlignBeamLocalAxis(Beam=beam_offset_and_orientation, Direction=asse_1_verso_z, Axis=1, Principal=True)  # -> Beam, Axes, Angle

# ---- group: 04 | Un solo Model
model_units = ModelUnits(Length=2, Force=1, Temperature=0, Heat=0, Tolerance=0.001)
build_model = BuildModel(
    Unit=model_units,
    Node=flatten([support, load_nodal]),
    FrameElement=flatten(align_beam_local_axis.Beam),
    RenumberModels=True,
    PreserveNodes=False)

# ---- group: Controlla e decomponi il Model
validate_straus_model = ValidateStrausModel(Model=build_model)  # -> Valid, Errors, Warnings
model_summary = ModelSummary(Model=build_model)  # -> Nodes, Beams, Plates, Links, LoadCases, Combinations, Groups, Solids
decompose_model = DecomposeModel(Model=build_model)  # -> NodeElements, FrameElements, AreaElements, LinkElements, Solids, Materials, BeamSections, BeamProperties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
preflight_valido = Panel(validate_straus_model.Valid)
errori = Panel(validate_straus_model.Errors)
numero_nodi = Panel(model_summary.Nodes)
travi = Panel(model_summary.Beams)
piastre = Panel(model_summary.Plates)

# ---- group: Preview / sezioni / carichi / attributi / Brep
# Preview e bake: Preview ON/OFF spegne la visualizzazione gestita.
# Display Settings controlla sezioni, carichi, vincoli, offset e assi.
# Brep pronti: tasto destro > Bake. Il bake e' manuale.
# Le geometrie FEM e il Model restano disponibili anche con preview OFF.
# Geometrie alternative: Model Physical Geometry espone anche linee d'asse e mesh.
# Per il bake solido usare l'uscita Breps o il menu del componente.
preview_on_off = BooleanToggle(True)
display_settings = Rhino2StrausDisplaySettings(
    Enabled=preview_on_off,
    Nodes=True,
    Beams=True,
    Plates=True,
    Solids=True,
    Links=True,
    Sections=True,
    Loads=True,
    Supports=True,
    Releases=True,
    Springs=True,
    Masses=True,
    Prescribed=True,
    Offsets=True,
    Axes=True,
    Labels=False,
    Properties=False,
    Values=False,
    Results=False,
    Shaded=True,
    SymbolScale=0.3,
    LoadScale=0.06,
    Transparency=0.3)
rhino2straus = Rhino2StrausDisplayManager(
    Model=build_model,
    Solid=True,
    Labels=False,
    Axes=False,
    Supports=True,
    AxisScale=1,
    Color=RGB(50, 150, 190),
    Enabled=preview_on_off,
    Settings=display_settings,
    LoadScale=1,
    ManagePreviews=True,
    DisplayEnabled=True,
    DisplayLayers=73727)  # -> Status, AvailableCases, Settings, Legend, Breps, BrepIssues
brep_pronti_per_bake = Brep(rhino2straus.Breps)
model_physical_geometry = ModelPhysicalGeometry(Model=build_model)  # -> BeamSolids, PlateSolids, Centerlines, Solids, Breps, BrepIssues
problemi_brep = Panel(rhino2straus.BrepIssues)
