# Grasshopper definition 02_portale_casi_combo_risultati.ghx (Grasshopper 1.0.8)
# plug-ins: Rhino2Straus
# Esempio autonomo Rhino2Straus. Geometrie interne; metri e kN. Leggere le note sul canvas e examples/README.md.

# ---- group: 01 | Materiale e sezione I
# 02 | Portale / m / kN: Due parti indipendenti confluiscono in Merge Straus Models con Renumber=true.
# Portale 6 x 3 m, S355, profilo I parametrico, incastri alla base.
# G=-5 e Q=-3 kN/m sulla trave. Due combinazioni dimostrative.
# Run=false: puoi esplorare il Model e la preview senza Straus7.
# La zona Analisi mostra il percorso per ottenere lo stesso Model con risultati.
database_steel = DatabaseSteel(Type=2)
altezza_i_m = Slider(0.3, range=0.15..0.6)
frame_section_i = FrameSectionI(
    Name="I dimostrativa",
    Height=altezza_i_m,
    WidthTopFlange=0.2,
    ThicknessTopFlange=0.01,
    WidthBottomFlange=0.2,
    ThicknessBottomFlange=0.01,
    ThicknessWeb=0.01,
    RadiusInner=0)
frame_property = FrameProperty(Name="Portale S355", Section=frame_section_i, Material=database_steel)

# ---- group: 03 | Trave / due casi / carichi concatenati
# Carichi in sequenza: G -> Q -> Build Model. L'uscita Q contiene entrambi i carichi.
# Non collegare a Build anche la copia intermedia G: duplicheresti il contributo.
# Entrambi sono forze in direzione Z globale, non proiettate.
trave_di_6_m = Curve(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)
frame_element = FrameElement(FrameLine=trave_di_6_m, FrameProperty=frame_property, AngleDeg=0, Offset=Vector(0, 0, 0), FrameID=-1)
align_beam_local_axis = AlignBeamLocalAxis(Beam=frame_element, Direction=Vector(0, 0, 1), Axis=1, Principal=True)  # -> Beam, Axes, Angle
load_case = LoadCase(Name="G", GravityNSM=False)
load_case_2 = LoadCase(Name="Q", GravityNSM=False)
gz_kn_m = Slider(-5, range=-10..0)
qz_kn_m = Slider(-3, range=-10..0)
load_frame_uniform = LoadFrameUniform(
    Frame=align_beam_local_axis.Beam,
    LoadCase=load_case,
    TypeForceOrMoment=0,
    Direction=2,
    Projected=False,
    CoordinateSystem=1,
    Load=gz_kn_m)
load_frame_uniform_2 = LoadFrameUniform(
    Frame=load_frame_uniform,
    LoadCase=load_case_2,
    TypeForceOrMoment=0,
    Direction=2,
    Projected=False,
    CoordinateSystem=1,
    Load=qz_kn_m)

# ---- group: 04 | Fattori e combinazioni
# Combinazioni dimostrative: ULS_demo = 1.35 G + 1.50 Q
# SLS_demo = 1.00 G + 1.00 Q
# Coefficienti per mostrare il flusso; adattare al proprio progetto.
# G e' un carico distribuito assegnato: non include peso proprio automatico.
load_factor = LoadFactor(LoadCase=load_case, Factor=1.35)
load_factor_2 = LoadFactor(LoadCase=load_case_2, Factor=1.5)
load_combination = LoadCombination(Name="ULS_demo", LoadFactor=[load_factor, load_factor_2], Type=0)
load_factor_3 = LoadFactor(LoadCase=load_case, Factor=1)
load_factor_4 = LoadFactor(LoadCase=load_case_2, Factor=1)
load_combination_2 = LoadCombination(Name="SLS_demo", LoadFactor=[load_factor_3, load_factor_4], Type=0)

# ---- group: 02 | Model A / pilastri e incastri
due_pilastri = Curve([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])
basi = Point([Point(0, 0, 0), Point(6, 0, 0)])
frame_element_2 = FrameElement(FrameLine=due_pilastri, FrameProperty=frame_property, AngleDeg=0, Offset=Vector(0, 0, 0), FrameID=-1)
align_beam_local_axis_2 = AlignBeamLocalAxis(Beam=frame_element_2, Direction=Vector(1, 0, 0), Axis=1, Principal=True)  # -> Beam, Axes, Angle
node_element = NodeElement(NodePoint=basi, NodeID=-1)
support = Support(Node=node_element, Dx=True, Dy=True, Dz=True, Mx=True, My=True, Mz=True)

# ---- group: 05 | Model B + Model A = un Model
model_units = ModelUnits(Length=2, Force=1, Temperature=0, Heat=0, Tolerance=0.001)
build_model = BuildModel(
    Unit=model_units,
    FrameElement=flatten(load_frame_uniform_2),
    LoadCombination=flatten([load_combination, load_combination_2]),
    RenumberModels=True,
    PreserveNodes=False)

# ---- group: 02 | Model A / pilastri e incastri (continued)
build_model_2 = BuildModel(
    Unit=model_units,
    Node=flatten(support),
    FrameElement=flatten(align_beam_local_axis_2.Beam),
    RenumberModels=True,
    PreserveNodes=False)

# ---- group: 05 | Model B + Model A = un Model (continued)
merge_straus_models = MergeStrausModels(Models=[build_model_2, build_model], Renumber=True)

# ---- group: Controlla e decomponi il Model
validate_straus_model = ValidateStrausModel(Model=merge_straus_models)  # -> Valid, Errors, Warnings
model_summary = ModelSummary(Model=merge_straus_models)  # -> Nodes, Beams, Plates, Links, LoadCases, Combinations, Groups, Solids
decompose_model = DecomposeModel(Model=merge_straus_models)  # -> NodeElements, FrameElements, AreaElements, LinkElements, Solids, Materials, BeamSections, BeamProperties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
preflight_valido = Panel(validate_straus_model.Valid)
errori = Panel(validate_straus_model.Errors)
numero_nodi = Panel(model_summary.Nodes)
travi = Panel(model_summary.Beams)
piastre = Panel(model_summary.Plates)

# ---- group: 06 | Analisi opzionale / Run inizialmente FALSE
# Prima di avviare il solver: Modifica il percorso .st7 con una destinazione locale scrivibile.
# Run false -> true esporta e calcola casi e combinazioni (licenza API/solver richiesta).
# Overwrite=false protegge un file esistente: cambiare percorso o abilitarlo consapevolmente.
# I filtri Case names / Combination names vuoti includono tutti.
# Lo Stream Gate apre i lettori solo con Run=true. Tenere Run=true per leggere i risultati;
# dopo modifiche riportare Run=false, poi true. I risultati restano incorporati nel Model.
run_analisi = BooleanToggle(False)
overwrite_file = BooleanToggle(False)
percorso_st7_modificabile = Panel("C:\Temp\Rhino2StrausExamples\02_portale.st7")
run_model_cases_and_combinations = RunModelCasesAndCombinations(
    Model=merge_straus_models,
    ModelPath=percorso_st7_modificabile,
    Run=run_analisi,
    Overwrite=overwrite_file,
    RunCases=True,
    RunCombinations=True,
    Stations=11,
    Sample=1)  # -> Model, ResultPath, Status, Unavailable
gate = StreamGate(Stream=run_model_cases_and_combinations.Model, Gate=run_analisi)  # -> Target0, Target1
stato_analisi = Panel(run_model_cases_and_combinations.Status)
quantita_non_disponibili = Panel(run_model_cases_and_combinations.Unavailable)

# ---- group: 07 | Sollecitazioni / inviluppi / deformata / dati per verificatore
# Lettura dal Model: Actions: Case=0 legge tutti i casi. Deformata e diagramma: Case=1.
# Controlla Numbers / Names del lettore casi prima di cambiare Case.
# Con l'asse 1 verso Z, il carico verticale produce soprattutto M2: seleziona
# M2 negli input Column e Action per vedere il momento nel piano del portale.
# Gli avvisi di input vuoto sui lettori sono attesi finche' Run=false.
model_result_cases = ModelResultCases(Model=gate.Target1)  # -> Numbers, Names, Secondary, Complete, ProvenanceVerified, Unavailable, Results
model_beam_actions_n_v_t_m = ModelBeamActionsNVTM(Model=gate.Target1, Case=0)  # -> N, V1, V2, T, M1, M2, Positions
model_result_extrema = ModelResultExtrema(Model=gate.Target1, Entity="Beam", Quantity="Force", Column="M2")  # -> MinMax, GoverningCases, GoverningPositions
model_deformed_geometry = ModelDeformedGeometry(Model=gate.Target1, Case=1, Scale=50)  # -> Nodes, Beams, PlatesAndSolids
model_beam_force_diagram = ModelBeamForceDiagram(Model=gate.Target1, Case=1, Action="M2", Scale=0.01, DisplayAxis=1)  # -> Diagrams, Values
model_verification_data = ModelVerificationData(Model=gate.Target1, RequireProvenance=True)  # -> Elements, Properties, Materials, Results, Units, Unavailable, NativeSections
casi_risolti = Panel(model_result_cases.Names)
momenti_m2_kn_m = Panel(model_beam_actions_n_v_t_m.M2)

# ---- group: Preview / sezioni / carichi / attributi / Brep
# Preview e bake: Preview ON/OFF spegne la visualizzazione gestita.
# Display Settings controlla sezioni, carichi, vincoli, offset e assi.
# Brep pronti: tasto destro > Bake. Il bake e' manuale.
# Le geometrie FEM e il Model restano disponibili anche con preview OFF.
preview_on_off = BooleanToggle(True)
display_settings = Rhino2StrausDisplaySettings(
    Enabled=preview_on_off,
    Nodes=True,
    Beams=True,
    Plates=True,
    Solids=True,
    Links=True,
    Sections=True,
    Loads=True,
    Supports=True,
    Releases=True,
    Springs=True,
    Masses=True,
    Prescribed=True,
    Offsets=True,
    Axes=True,
    Labels=False,
    Properties=False,
    Values=False,
    Results=True,
    Shaded=True,
    SymbolScale=0.3,
    LoadScale=0.06,
    Transparency=0.3)
rhino2straus = Rhino2StrausDisplayManager(
    Model=run_model_cases_and_combinations.Model,
    Solid=True,
    Labels=False,
    Axes=False,
    Supports=True,
    AxisScale=1,
    Color=RGB(50, 150, 190),
    Enabled=preview_on_off,
    Settings=display_settings,
    LoadScale=1,
    ManagePreviews=True,
    DisplayEnabled=True,
    DisplayLayers=73727)  # -> Status, AvailableCases, Settings, Legend, Breps, BrepIssues
brep_pronti_per_bake = Brep(rhino2straus.Breps)
problemi_brep = Panel(rhino2straus.BrepIssues)
