# Grasshopper definition 03_piastra_mesh_pressione.ghx (Grasshopper 1.0.8)
# plug-ins: Rhino2Straus
# Esempio autonomo Rhino2Straus. Geometrie interne; metri e kN. Leggere le note sul canvas e examples/README.md.

# ---- group: 01 | Materiale e spessore
# 03 | Piastra / m / kN: Piastra 4 x 3 m suddivisa in 4 Quad4, 9 nodi.
# Calcestruzzo C30/37, spessore 0.20 m, offset +0.10 m.
# Assi locali allineati a (1,1,0); pressione globale (0,0,-5) kN/m2.
# Gli 8 nodi al contorno sono incastrati.
# Mesh volutamente grossolana per illustrare i collegamenti; infittire per un'analisi.
database_concrete = DatabaseConcrete(Type=4)
spessore_m = Slider(0.2, range=0.1..0.5)
area_thickness = AreaThickness(Name="Soletta", Thickness=spessore_m)
area_property = AreaProperty(Name="Soletta C30/37", Section=area_thickness, Material=database_concrete, Type=0)

# ---- group: 02 | Mesh / piastre / offset / assi
# Normale e quota fisica: I Quad4 hanno normale +Z. L'offset positivo sposta il volume verso +Z.
# Con t=0.20 e offset=0.10: volume da Z=0 a Z=0.20.
# Cambiare gli assi locali non cambia la direzione della pressione globale.
mesh_4_quad4 = Mesh(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)
direzione_asse_1 = Vector(Vector(1, 1, 0))
mesh_to_plates = MeshToPlates(Mesh=mesh_4_quad4, Property=area_property, FirstID=-1)
offset_m = Slider(0.1, range=-0.3..0.3)
plate_offset_and_orientation = PlateOffsetAndOrientation(Plate=mesh_to_plates, Offset=offset_m, Angle=0)
align_plate_local_axis = AlignPlateLocalAxis(Plate=plate_offset_and_orientation, Direction=direzione_asse_1, Axis=1)  # -> Plate, Axes, Angle

# ---- group: 03 | Vincoli di bordo e pressione
_8_nodi_al_contorno = Point([Point(0, 0, 0), Point(2, 0, 0), Point(4, 0, 0), Point(0, 1.5, 0), Point(4, 1.5, 0), Point(0, 3, 0), Point(2, 3, 0), Point(4, 3, 0)])
pressione_xyz_kn_m2 = Vector(Vector(0, 0, -5))
node_element = NodeElement(NodePoint=_8_nodi_al_contorno, NodeID=-1)
support = Support(Node=node_element, Dx=True, Dy=True, Dz=True, Mx=True, My=True, Mz=True)
load_case = LoadCase(Name="Q_piastra", GravityNSM=False)
plate_global_pressure = PlateGlobalPressure(Plate=align_plate_local_axis.Plate, LoadCase=load_case, Pressure=pressione_xyz_kn_m2, TopFace=True, Projected=False)

# ---- group: 04 | Un solo Model
model_units = ModelUnits(Length=2, Force=1, Temperature=0, Heat=0, Tolerance=0.001)
build_model = BuildModel(
    Unit=model_units,
    Node=flatten(support),
    AreaElement=flatten(plate_global_pressure),
    RenumberModels=True,
    PreserveNodes=False)

# ---- group: Controlla e decomponi il Model
validate_straus_model = ValidateStrausModel(Model=build_model)  # -> Valid, Errors, Warnings
model_summary = ModelSummary(Model=build_model)  # -> Nodes, Beams, Plates, Links, LoadCases, Combinations, Groups, Solids
decompose_model = DecomposeModel(Model=build_model)  # -> NodeElements, FrameElements, AreaElements, LinkElements, Solids, Materials, BeamSections, BeamProperties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
preflight_valido = Panel(validate_straus_model.Valid)
errori = Panel(validate_straus_model.Errors)
numero_nodi = Panel(model_summary.Nodes)
travi = Panel(model_summary.Beams)
piastre = Panel(model_summary.Plates)

# ---- group: Preview / sezioni / carichi / attributi / Brep
# Preview e bake: Preview ON/OFF spegne la visualizzazione gestita.
# Display Settings controlla sezioni, carichi, vincoli, offset e assi.
# Brep pronti: tasto destro > Bake. Il bake e' manuale.
# Le geometrie FEM e il Model restano disponibili anche con preview OFF.
preview_on_off = BooleanToggle(True)
display_settings = Rhino2StrausDisplaySettings(
    Enabled=preview_on_off,
    Nodes=True,
    Beams=True,
    Plates=True,
    Solids=True,
    Links=True,
    Sections=True,
    Loads=True,
    Supports=True,
    Releases=True,
    Springs=True,
    Masses=True,
    Prescribed=True,
    Offsets=True,
    Axes=True,
    Labels=False,
    Properties=False,
    Values=False,
    Results=False,
    Shaded=True,
    SymbolScale=0.3,
    LoadScale=0.06,
    Transparency=0.3)
rhino2straus = Rhino2StrausDisplayManager(
    Model=build_model,
    Solid=True,
    Labels=False,
    Axes=False,
    Supports=True,
    AxisScale=1,
    Color=RGB(50, 150, 190),
    Enabled=preview_on_off,
    Settings=display_settings,
    LoadScale=1,
    ManagePreviews=True,
    DisplayEnabled=True,
    DisplayLayers=73727)  # -> Status, AvailableCases, Settings, Legend, Breps, BrepIssues
brep_pronti_per_bake = Brep(rhino2straus.Breps)
problemi_brep = Panel(rhino2straus.BrepIssues)
