# Grasshopper definition 04_frame_polilinea_assi_svincoli.ghx (Grasshopper 1.0.8)
# plug-ins: Rhino2Straus
# Esempio autonomo Rhino2Straus. Geometrie interne; metri e kN. Leggere le note sul canvas e examples/README.md.

polilinea_3_segmenti = Curve(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)
base = Point(Point(0, 0, 0))
# 04 frame polilinea assi svincoli: Una polilinea genera tre travi. Sezione con punto d'inserimento, asse locale verso un punto, svincolo torsionale finale e cambio proprieta'.
# Beam Behaviour permette Beam / Truss / Cable. Qui rimane Beam: Truss e Cable non sostengono flessione.
# Unita': m, kN, kPa, tonne, C. Leggere gli input e i pannelli; valori dimostrativi modificabili.
database_steel = DatabaseSteel(Type=2)
frame_section_solid_rectangular = FrameSectionSolidRectangular(Height=0.3, Width=0.2)
beam_section_insertion = BeamSectionInsertion(Section=frame_section_solid_rectangular, Insertion=1)
frame_property = FrameProperty(Name="Beam", Section=beam_section_insertion, Material=database_steel)
beam_behaviour = BeamBehaviour(Property=frame_property, Behaviour=0)
polyline_to_beams = PolylineToBeams(Polyline=polilinea_3_segmenti, Property=beam_behaviour, FirstID=10)
assign_beam_property = AssignBeamProperty(Beam=polyline_to_beams, Property=beam_behaviour)
align_beam_axis_to_point = AlignBeamAxisToPoint(Beam=assign_beam_property, Target=Point(1, 5, 4), Axis=1)  # -> Beam, Axes
beam_end_releases = BeamEndReleases(
    Beam=align_beam_axis_to_point.Beam,
    Start=[False, False, False, False, False, False],
    End=[False, False, False, False, False, True])
beam_local_axes = BeamLocalAxes(Element=beam_end_releases)  # -> Axis1, Axis2, Axis3
deconstruct_beam = DeconstructBeam(Beam=beam_end_releases)  # -> ID, Line, Property, Length, Angle, Offset, Groups
node_element = NodeElement(NodePoint=base, NodeID=-1)
support = Support(Node=node_element, Dx=True, Dy=True, Dz=True, Mx=True, My=True, Mz=True)
build_model = BuildModel(Node=flatten(support), FrameElement=flatten(beam_end_releases), RenumberModels=True, PreserveNodes=False)

# ---- group: Controlla e decomponi il Model
validate_straus_model = ValidateStrausModel(Model=build_model)  # -> Valid, Errors, Warnings
model_summary = ModelSummary(Model=build_model)  # -> Nodes, Beams, Plates, Links, LoadCases, Combinations, Groups, Solids
decompose_model = DecomposeModel(Model=build_model)  # -> NodeElements, FrameElements, AreaElements, LinkElements, Solids, Materials, BeamSections, BeamProperties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
preflight_valido = Panel(validate_straus_model.Valid)
errori = Panel(validate_straus_model.Errors)
numero_nodi = Panel(model_summary.Nodes)
travi = Panel(model_summary.Beams)
piastre = Panel(model_summary.Plates)

# ---- group: Preview / sezioni / carichi / attributi / Brep
# Preview e bake: Preview ON/OFF spegne la visualizzazione gestita.
# Display Settings controlla sezioni, carichi, vincoli, offset e assi.
# Brep pronti: tasto destro > Bake. Il bake e' manuale.
# Le geometrie FEM e il Model restano disponibili anche con preview OFF.
preview_on_off = BooleanToggle(True)
display_settings = Rhino2StrausDisplaySettings(
    Enabled=preview_on_off,
    Nodes=True,
    Beams=True,
    Plates=True,
    Solids=True,
    Links=True,
    Sections=True,
    Loads=True,
    Supports=True,
    Releases=True,
    Springs=True,
    Masses=True,
    Prescribed=True,
    Offsets=True,
    Axes=True,
    Labels=False,
    Properties=False,
    Values=False,
    Results=False,
    Shaded=True,
    SymbolScale=0.3,
    LoadScale=0.06,
    Transparency=0.3)
rhino2straus = Rhino2StrausDisplayManager(
    Model=build_model,
    Solid=True,
    Labels=False,
    Axes=False,
    Supports=True,
    AxisScale=1,
    Color=RGB(50, 150, 190),
    Enabled=preview_on_off,
    Settings=display_settings,
    LoadScale=1,
    ManagePreviews=True,
    DisplayEnabled=True,
    DisplayLayers=73727)  # -> Status, AvailableCases, Settings, Legend, Breps, BrepIssues
brep_pronti_per_bake = Brep(rhino2straus.Breps)
problemi_brep = Panel(rhino2straus.BrepIssues)

# ----
direzione_asse_1 = Panel(beam_local_axes.Axis1)
id_travi_10_11_12 = Panel(deconstruct_beam.ID)
