# Grasshopper definition 05_nodi_vincoli_molle_masse_temperatura.ghx (Grasshopper 1.0.8)
# plug-ins: Rhino2Straus
# Esempio autonomo Rhino2Straus. Geometrie interne; metri e kN. Leggere le note sul canvas e examples/README.md.

asse_trave_m = Curve(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)
nodo_base = Point(Point(0, 0, 0))
# 05 nodi vincoli molle masse temperatura: Attributi in sequenza sullo stesso nodo: cedimento imposto, molle, masse, temperatura e forza.
# Build riceve solo l'ultima copia: collegare copie intermedie sommerebbe nuovamente i contributi. Le rotazioni sono in radianti.
# Unita': m, kN, kPa, tonne, C. Leggere gli input e i pannelli; valori dimostrativi modificabili.
database_steel = DatabaseSteel(Type=2)
frame_section_solid_rectangular = FrameSectionSolidRectangular(Height=0.3, Width=0.2)
frame_property = FrameProperty(Name="Beam", Section=frame_section_solid_rectangular, Material=database_steel)
frame_element = FrameElement(FrameLine=asse_trave_m, FrameProperty=frame_property, AngleDeg=0, Offset=Vector(0, 0, 0), FrameID=-1)
node_element = NodeElement(NodePoint=nodo_base, NodeID=-1)
node_prescribed_displacement = NodePrescribedDisplacement(Node=node_element, Restrained=[True, True, True, True, True, True], Values=[0, 0, -0.005, 0, 0, 0])
node_springs = NodeSprings(Node=node_prescribed_displacement, Translation=Vector(1000, 1000, 1000), Rotation=Vector(0, 0, 0))
node_mass = NodeMass(Node=node_springs, Translation=Vector(0.1, 0.1, 0.1), Rotation=Vector(0.01, 0.01, 0.01))
load_case = LoadCase(Name="T", GravityNSM=False, ReferenceTemperature=15)
node_temperature = NodeTemperature(Node=node_mass, LoadCase=load_case, Temperature=20, Type=1)
deconstruct_node = DeconstructNode(Node=node_temperature)  # -> ID, Point, Restraints, Loads
build_model = BuildModel(Node=flatten(node_temperature), FrameElement=flatten(frame_element), RenumberModels=True, PreserveNodes=False)

# ---- group: Controlla e decomponi il Model
validate_straus_model = ValidateStrausModel(Model=build_model)  # -> Valid, Errors, Warnings
model_summary = ModelSummary(Model=build_model)  # -> Nodes, Beams, Plates, Links, LoadCases, Combinations, Groups, Solids
decompose_model = DecomposeModel(Model=build_model)  # -> NodeElements, FrameElements, AreaElements, LinkElements, Solids, Materials, BeamSections, BeamProperties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
preflight_valido = Panel(validate_straus_model.Valid)
errori = Panel(validate_straus_model.Errors)
numero_nodi = Panel(model_summary.Nodes)
travi = Panel(model_summary.Beams)
piastre = Panel(model_summary.Plates)

# ---- group: Preview / sezioni / carichi / attributi / Brep
# Preview e bake: Preview ON/OFF spegne la visualizzazione gestita.
# Display Settings controlla sezioni, carichi, vincoli, offset e assi.
# Brep pronti: tasto destro > Bake. Il bake e' manuale.
# Le geometrie FEM e il Model restano disponibili anche con preview OFF.
preview_on_off = BooleanToggle(True)
display_settings = Rhino2StrausDisplaySettings(
    Enabled=preview_on_off,
    Nodes=True,
    Beams=True,
    Plates=True,
    Solids=True,
    Links=True,
    Sections=True,
    Loads=True,
    Supports=True,
    Releases=True,
    Springs=True,
    Masses=True,
    Prescribed=True,
    Offsets=True,
    Axes=True,
    Labels=False,
    Properties=False,
    Values=False,
    Results=False,
    Shaded=True,
    SymbolScale=0.3,
    LoadScale=0.06,
    Transparency=0.3)
rhino2straus = Rhino2StrausDisplayManager(
    Model=build_model,
    Solid=True,
    Labels=False,
    Axes=False,
    Supports=True,
    AxisScale=1,
    Color=RGB(50, 150, 190),
    Enabled=preview_on_off,
    Settings=display_settings,
    LoadScale=1,
    ManagePreviews=True,
    DisplayEnabled=True,
    DisplayLayers=73727)  # -> Status, AvailableCases, Settings, Legend, Breps, BrepIssues
brep_pronti_per_bake = Brep(rhino2straus.Breps)
problemi_brep = Panel(rhino2straus.BrepIssues)

# ----
sei_gradi_di_liberta = Panel(deconstruct_node.Restraints)
