# Grasshopper definition 06_link_rigidi_elastici_master_slave.ghx (Grasshopper 1.0.8)
# plug-ins: Rhino2Straus
# Esempio autonomo Rhino2Straus. Geometrie interne; metri e kN. Leggere le note sul canvas e examples/README.md.

basi_link = Point([Point(0, 0, 0), Point(0, 2, 0), Point(0, 4, 0), Point(0, 6, 0), Point(0, 8, 0), Point(0, 10, 0)])
# 06 link rigidi elastici master slave: Confronto dei cinque tipi: rigid, pinned, master-slave, sector symmetry e connessione elastica.
# Le opzioni controllano piano rigido, asse di simmetria e sei relazioni DoF (libero / uguale / opposto).
# Le rigidezze elastiche sono negli assi globali. Ogni coppia ha il primo nodo bloccato. Esempio di assegnazione: non ogni configurazione e' stabile per ogni solver.
# Unita': m, kN, kPa, tonne, C. Leggere gli input e i pannelli; valori dimostrativi modificabili.
link_constraint_options = LinkConstraintOptions(RigidPlane=0, SymmetryAxis=3, UX=1, UY=1, UZ=1, RX=1, RY=1, RZ=1)
rigid_link_property = RigidLinkProperty(Options=link_constraint_options)
link_element = LinkElement(StartPoint=Point(0, 0, 0), EndPoint=Point(1, 0, 0), LinkProperty=rigid_link_property, ID=1)
pinned_link_property = PinnedLinkProperty(Options=link_constraint_options)
link_element_2 = LinkElement(StartPoint=Point(0, 2, 0), EndPoint=Point(1, 2, 0), LinkProperty=pinned_link_property, ID=2)
masterslave_link_property = MasterSlaveLinkProperty(Options=link_constraint_options)
link_element_3 = LinkElement(StartPoint=Point(0, 4, 0), EndPoint=Point(1, 4, 0), LinkProperty=masterslave_link_property, ID=3)
sectorsymmetry_link_property = SectorSymmetryLinkProperty(Options=link_constraint_options)
link_element_4 = LinkElement(StartPoint=Point(0, 6, 0), EndPoint=Point(1, 6, 0), LinkProperty=sectorsymmetry_link_property, ID=4)
elastic_link_property = ElasticLinkProperty(Kx=1000, Ky=1000, Kz=1000, Rx=1000, Ry=1000, Rz=1000)
link_element_5 = LinkElement(StartPoint=Point(0, 8, 0), EndPoint=Point(1, 8, 0), LinkProperty=elastic_link_property, ID=5)
link_type = LinkType(Type=1, Kx=1000, Ky=1000, Kz=1000, Rx=1000, Ry=1000, Rz=1000, Options=link_constraint_options)
link_element_6 = LinkElement(StartPoint=Point(0, 10, 0), EndPoint=Point(1, 10, 0), LinkProperty=link_type, ID=6)
node_element = NodeElement(NodePoint=basi_link, NodeID=-1)
support = Support(Node=node_element, Dx=True, Dy=True, Dz=True, Mx=True, My=True, Mz=True)
build_model = BuildModel(
    Node=flatten(support),
    LinkElement=flatten([link_element, link_element_2, link_element_3, link_element_4, link_element_5, link_element_6]),
    RenumberModels=True,
    PreserveNodes=False)

# ---- group: Controlla e decomponi il Model
validate_straus_model = ValidateStrausModel(Model=build_model)  # -> Valid, Errors, Warnings
model_summary = ModelSummary(Model=build_model)  # -> Nodes, Beams, Plates, Links, LoadCases, Combinations, Groups, Solids
decompose_model = DecomposeModel(Model=build_model)  # -> NodeElements, FrameElements, AreaElements, LinkElements, Solids, Materials, BeamSections, BeamProperties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
preflight_valido = Panel(validate_straus_model.Valid)
errori = Panel(validate_straus_model.Errors)
numero_nodi = Panel(model_summary.Nodes)
travi = Panel(model_summary.Beams)
piastre = Panel(model_summary.Plates)

# ---- group: Preview / sezioni / carichi / attributi / Brep
# Preview e bake: Preview ON/OFF spegne la visualizzazione gestita.
# Display Settings controlla sezioni, carichi, vincoli, offset e assi.
# Brep pronti: tasto destro > Bake. Il bake e' manuale.
# Le geometrie FEM e il Model restano disponibili anche con preview OFF.
preview_on_off = BooleanToggle(True)
display_settings = Rhino2StrausDisplaySettings(
    Enabled=preview_on_off,
    Nodes=True,
    Beams=True,
    Plates=True,
    Solids=True,
    Links=True,
    Sections=True,
    Loads=True,
    Supports=True,
    Releases=True,
    Springs=True,
    Masses=True,
    Prescribed=True,
    Offsets=True,
    Axes=True,
    Labels=False,
    Properties=False,
    Values=False,
    Results=False,
    Shaded=True,
    SymbolScale=0.3,
    LoadScale=0.06,
    Transparency=0.3)
rhino2straus = Rhino2StrausDisplayManager(
    Model=build_model,
    Solid=True,
    Labels=False,
    Axes=False,
    Supports=True,
    AxisScale=1,
    Color=RGB(50, 150, 190),
    Enabled=preview_on_off,
    Settings=display_settings,
    LoadScale=1,
    ManagePreviews=True,
    DisplayEnabled=True,
    DisplayLayers=73727)  # -> Status, AvailableCases, Settings, Legend, Breps, BrepIssues
brep_pronti_per_bake = Brep(rhino2straus.Breps)
problemi_brep = Panel(rhino2straus.BrepIssues)
