# Grasshopper definition 07_mesh_tri_quad_proprieta_assi.ghx (Grasshopper 1.0.8)
# plug-ins: Rhino2Straus
# Esempio autonomo Rhino2Straus. Geometrie interne; metri e kN. Leggere le note sul canvas e examples/README.md.

mesh_mista = Mesh(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)
faccia_singola = Mesh(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)
# 07 mesh tri quad proprieta assi: Una mesh mista produce due Tri3 e un Quad4; un'altra faccia usa Area Element.
# Riassegnazione della proprieta', allineamento a un piano e lettura degli assi. Invertire l'ordine dei vertici cambia normale e lato dei carichi.
# Unita': m, kN, kPa, tonne, C. Leggere gli input e i pannelli; valori dimostrativi modificabili.
database_concrete = DatabaseConcrete(Type=4)
area_thickness = AreaThickness(Thickness=0.2)
area_property = AreaProperty(Name="Plate", Section=area_thickness, Material=database_concrete, Type=0)
mesh_to_plates = MeshToPlates(Mesh=mesh_mista, Property=area_property, FirstID=-1)
assign_plate_property = AssignPlateProperty(Plate=mesh_to_plates, Property=area_property)
align_plate_axis_to_plane = AlignPlateAxisToPlane(
    Plate=assign_plate_property,
    Reference=Plane(origin=(0, 0, 0), x=(0.7071067812, 0.7071067812, 0), y=(-0.7071067812, 0.7071067812, 0)),
    Axis=1)  # -> Plate, Axes
plate_local_axes = PlateLocalAxes(Element=align_plate_axis_to_plane.Plate)  # -> Axis1, Axis2, Axis3
deconstruct_plate = DeconstructPlate(Plate=align_plate_axis_to_plane.Plate)  # -> ID, Mesh, Property, Angle, Offset, Groups
area_element = AreaElement(Area=faccia_singola, AreaProperty=area_property, AngleDeg=0, Offset=0, AreaID=-1)
build_model = BuildModel(AreaElement=flatten([align_plate_axis_to_plane.Plate, area_element]), RenumberModels=True, PreserveNodes=False)

# ---- group: Controlla e decomponi il Model
validate_straus_model = ValidateStrausModel(Model=build_model)  # -> Valid, Errors, Warnings
model_summary = ModelSummary(Model=build_model)  # -> Nodes, Beams, Plates, Links, LoadCases, Combinations, Groups, Solids
decompose_model = DecomposeModel(Model=build_model)  # -> NodeElements, FrameElements, AreaElements, LinkElements, Solids, Materials, BeamSections, BeamProperties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
preflight_valido = Panel(validate_straus_model.Valid)
errori = Panel(validate_straus_model.Errors)
numero_nodi = Panel(model_summary.Nodes)
travi = Panel(model_summary.Beams)
piastre = Panel(model_summary.Plates)

# ---- group: Preview / sezioni / carichi / attributi / Brep
# Preview e bake: Preview ON/OFF spegne la visualizzazione gestita.
# Display Settings controlla sezioni, carichi, vincoli, offset e assi.
# Brep pronti: tasto destro > Bake. Il bake e' manuale.
# Le geometrie FEM e il Model restano disponibili anche con preview OFF.
preview_on_off = BooleanToggle(True)
display_settings = Rhino2StrausDisplaySettings(
    Enabled=preview_on_off,
    Nodes=True,
    Beams=True,
    Plates=True,
    Solids=True,
    Links=True,
    Sections=True,
    Loads=True,
    Supports=True,
    Releases=True,
    Springs=True,
    Masses=True,
    Prescribed=True,
    Offsets=True,
    Axes=True,
    Labels=False,
    Properties=False,
    Values=False,
    Results=False,
    Shaded=True,
    SymbolScale=0.3,
    LoadScale=0.06,
    Transparency=0.3)
rhino2straus = Rhino2StrausDisplayManager(
    Model=build_model,
    Solid=True,
    Labels=False,
    Axes=False,
    Supports=True,
    AxisScale=1,
    Color=RGB(50, 150, 190),
    Enabled=preview_on_off,
    Settings=display_settings,
    LoadScale=1,
    ManagePreviews=True,
    DisplayEnabled=True,
    DisplayLayers=73727)  # -> Status, AvailableCases, Settings, Legend, Breps, BrepIssues
brep_pronti_per_bake = Brep(rhino2straus.Breps)
problemi_brep = Panel(rhino2straus.BrepIssues)

# ----
assi_locali_1 = Panel(plate_local_axes.Axis1)
id_delle_piastre = Panel(deconstruct_plate.ID)
