# Grasshopper definition 08_solidi_tet_wedge_hexa_pressione.ghx (Grasshopper 1.0.8)
# plug-ins: Rhino2Straus
# Esempio autonomo Rhino2Straus. Geometrie interne; metri e kN. Leggere le note sul canvas e examples/README.md.

nodi_ordinati_4 = Point([Point(0, 0, 0), Point(1, 0, 0), Point(0, 1, 0), Point(0, 0, 1)])
nodi_ordinati_6 = Point([Point(2, 0, 0), Point(3, 0, 0), Point(2, 1, 0), Point(2, 0, 1), Point(3, 0, 1), Point(2, 1, 1)])
nodi_ordinati_8 = Point([Point(4, 0, 0), Point(5, 0, 0), Point(5, 1, 0), Point(4, 1, 0), Point(4, 0, 1), Point(5, 0, 1), Point(5, 1, 1), Point(4, 1, 1)])
nodi_inferiori = Point([Point(0, 0, 0), Point(1, 0, 0), Point(0, 1, 0), Point(2, 0, 0), Point(3, 0, 0), Point(2, 1, 0), Point(4, 0, 0), Point(5, 0, 0), Point(5, 1, 0), Point(4, 1, 0)])
# 08 solidi tet wedge hexa pressione: Tet4, Wedge6 e Hexa8 costruiti con nodi ordinati secondo Straus.
# Pressione su una faccia, incastro dei nodi a Z=0, controllo dei volumi e Brep chiusi per bake.
# Volumi attesi: 1/6, 1/2 e 1 m3. Numerazione delle facce nativa: controllare la preview prima del calcolo.
# Unita': m, kN, kPa, tonne, C. Leggere gli input e i pannelli; valori dimostrativi modificabili.
database_concrete = DatabaseConcrete(Type=4)
load_case = LoadCase(Name="P_solidi", GravityNSM=False)
node_element = NodeElement(NodePoint=nodi_ordinati_4, NodeID=-1)
solid_element = SolidElement(Nodes=node_element, Material=database_concrete, ID=1)
solid_face_pressure = SolidFacePressure(Solid=solid_element, LoadCase=load_case, Face=1, Pressure=5)
solid_info = SolidInfo(Solid=solid_face_pressure)  # -> ID, Geometry, Material, Volume
node_element_2 = NodeElement(NodePoint=nodi_ordinati_6, NodeID=-1)
solid_element_2 = SolidElement(Nodes=node_element_2, Material=database_concrete, ID=2)
solid_face_pressure_2 = SolidFacePressure(Solid=solid_element_2, LoadCase=load_case, Face=1, Pressure=5)
solid_info_2 = SolidInfo(Solid=solid_face_pressure_2)  # -> ID, Geometry, Material, Volume
node_element_3 = NodeElement(NodePoint=nodi_ordinati_8, NodeID=-1)
solid_element_3 = SolidElement(Nodes=node_element_3, Material=database_concrete, ID=3)
solid_face_pressure_3 = SolidFacePressure(Solid=solid_element_3, LoadCase=load_case, Face=1, Pressure=5)
solid_info_3 = SolidInfo(Solid=solid_face_pressure_3)  # -> ID, Geometry, Material, Volume
node_element_4 = NodeElement(NodePoint=nodi_inferiori, NodeID=-1)
support = Support(Node=node_element_4, Dx=True, Dy=True, Dz=True, Mx=True, My=True, Mz=True)
build_model = BuildModel(
    Node=flatten(support),
    Solids=flatten([solid_face_pressure, solid_face_pressure_2, solid_face_pressure_3]),
    RenumberModels=True,
    PreserveNodes=False)

# ---- group: Controlla e decomponi il Model
validate_straus_model = ValidateStrausModel(Model=build_model)  # -> Valid, Errors, Warnings
model_summary = ModelSummary(Model=build_model)  # -> Nodes, Beams, Plates, Links, LoadCases, Combinations, Groups, Solids
decompose_model = DecomposeModel(Model=build_model)  # -> NodeElements, FrameElements, AreaElements, LinkElements, Solids, Materials, BeamSections, BeamProperties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
preflight_valido = Panel(validate_straus_model.Valid)
errori = Panel(validate_straus_model.Errors)
numero_nodi = Panel(model_summary.Nodes)
travi = Panel(model_summary.Beams)
piastre = Panel(model_summary.Plates)

# ---- group: Preview / sezioni / carichi / attributi / Brep
# Preview e bake: Preview ON/OFF spegne la visualizzazione gestita.
# Display Settings controlla sezioni, carichi, vincoli, offset e assi.
# Brep pronti: tasto destro > Bake. Il bake e' manuale.
# Le geometrie FEM e il Model restano disponibili anche con preview OFF.
preview_on_off = BooleanToggle(True)
display_settings = Rhino2StrausDisplaySettings(
    Enabled=preview_on_off,
    Nodes=True,
    Beams=True,
    Plates=True,
    Solids=True,
    Links=True,
    Sections=True,
    Loads=True,
    Supports=True,
    Releases=True,
    Springs=True,
    Masses=True,
    Prescribed=True,
    Offsets=True,
    Axes=True,
    Labels=False,
    Properties=False,
    Values=False,
    Results=False,
    Shaded=True,
    SymbolScale=0.3,
    LoadScale=0.06,
    Transparency=0.3)
rhino2straus = Rhino2StrausDisplayManager(
    Model=build_model,
    Solid=True,
    Labels=False,
    Axes=False,
    Supports=True,
    AxisScale=1,
    Color=RGB(50, 150, 190),
    Enabled=preview_on_off,
    Settings=display_settings,
    LoadScale=1,
    ManagePreviews=True,
    DisplayEnabled=True,
    DisplayLayers=73727)  # -> Status, AvailableCases, Settings, Legend, Breps, BrepIssues
brep_pronti_per_bake = Brep(rhino2straus.Breps)
problemi_brep = Panel(rhino2straus.BrepIssues)

# ----
volume_m3 = Panel(solid_info.Volume)
volume_m3_2 = Panel(solid_info_2.Volume)
volume_m3_3 = Panel(solid_info_3.Volume)
