# Grasshopper definition 09_materiali_sezioni_base_generica.ghx (Grasshopper 1.0.8)
# plug-ins: Rhino2Straus
# Esempio autonomo Rhino2Straus. Geometrie interne; metri e kN. Leggere le note sul canvas e examples/README.md.

asse_trave_m = Curve(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)
asse_trave_m_2 = Curve(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)
asse_trave_m_3 = Curve(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)
asse_trave_m_4 = Curve(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)
asse_trave_m_5 = Curve(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)
asse_trave_m_6 = Curve(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)
asse_trave_m_7 = Curve(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)
asse_trave_m_8 = Curve(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)
asse_trave_m_9 = Curve(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)
# 09 materiali sezioni base generica: Otto tipologie geometriche e una sezione generica con contorno esplicito per la preview.
# Material custom con resistenze nominali assegnate separatamente (MPa). Le resistenze non modificano il modulo elastico.
# La sezione generica e' un quadrato 0.1 x 0.1 m: i valori numerici e il contorno devono essere coerenti; il profilo non ricalcola la rigidezza.
# Unita': m, kN, kPa, tonne, C. Leggere gli input e i pannelli; valori dimostrativi modificabili.
material = Material(
    Name="Acciaio custom",
    Type=0,
    ModulusElasticity=210000000,
    PoissonRatio=0.3,
    ThermalCoefficent=1.17e-05,
    Density=7.849,
    DampingRatio=0.02)
material_design_strengths = MaterialDesignStrengths(Material=material, Fy=355, Fu=510, Fck=0)
deconstruct_material = DeconstructMaterial(Material=material_design_strengths)  # -> Name, E, G, Poisson, Density, Expansion, Fy, Fu, Fck
frame_section_solid_rectangular = FrameSectionSolidRectangular(Name="Rectangular", Height=0.3, Width=0.2)
frame_property = FrameProperty(Name="Rectangular", Section=frame_section_solid_rectangular, Material=material_design_strengths)
frame_element = FrameElement(FrameLine=asse_trave_m, FrameProperty=frame_property, AngleDeg=0, Offset=Vector(0, 0, 0), FrameID=-1)
deconstruct_beam_section = DeconstructBeamSection(Section=frame_section_solid_rectangular)  # -> Name, Area, I11, I22, J, ShearA1, ShearA2, Profile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
frame_section_solid_circle = FrameSectionSolidCircle(Name="Circle", Diameter=0.1)
frame_property_2 = FrameProperty(Name="Circle", Section=frame_section_solid_circle, Material=material_design_strengths)
frame_element_2 = FrameElement(FrameLine=asse_trave_m_2, FrameProperty=frame_property_2, AngleDeg=0, Offset=Vector(0, 0, 0), FrameID=-1)
deconstruct_beam_section_2 = DeconstructBeamSection(Section=frame_section_solid_circle)  # -> Name, Area, I11, I22, J, ShearA1, ShearA2, Profile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
frame_section_pipe = FrameSectionPipe(Name="Pipe", Diameter=0.1, Thickness=0.01)
frame_property_3 = FrameProperty(Name="Pipe", Section=frame_section_pipe, Material=material_design_strengths)
frame_element_3 = FrameElement(FrameLine=asse_trave_m_3, FrameProperty=frame_property_3, AngleDeg=0, Offset=Vector(0, 0, 0), FrameID=-1)
deconstruct_beam_section_3 = DeconstructBeamSection(Section=frame_section_pipe)  # -> Name, Area, I11, I22, J, ShearA1, ShearA2, Profile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
frame_section_i = FrameSectionI(
    Name="I",
    Height=0.3,
    WidthTopFlange=0.2,
    ThicknessTopFlange=0.01,
    WidthBottomFlange=0.2,
    ThicknessBottomFlange=0.01,
    ThicknessWeb=0.01,
    RadiusInner=0)
frame_property_4 = FrameProperty(Name="I", Section=frame_section_i, Material=material_design_strengths)
frame_element_4 = FrameElement(FrameLine=asse_trave_m_4, FrameProperty=frame_property_4, AngleDeg=0, Offset=Vector(0, 0, 0), FrameID=-1)
deconstruct_beam_section_4 = DeconstructBeamSection(Section=frame_section_i)  # -> Name, Area, I11, I22, J, ShearA1, ShearA2, Profile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
frame_section_tee = FrameSectionTee(Name="Tee", Height=0.3, Width=0.2, ThicknessWeb=0.01, ThicknessFlange=0.01)
frame_property_5 = FrameProperty(Name="Tee", Section=frame_section_tee, Material=material_design_strengths)
frame_element_5 = FrameElement(FrameLine=asse_trave_m_5, FrameProperty=frame_property_5, AngleDeg=0, Offset=Vector(0, 0, 0), FrameID=-1)
deconstruct_beam_section_5 = DeconstructBeamSection(Section=frame_section_tee)  # -> Name, Area, I11, I22, J, ShearA1, ShearA2, Profile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
frame_section_angle = FrameSectionAngle(Name="Angle", Height=0.3, Width=0.2, ThicknessWeb=0.01, ThicknessFlange=0.01)
frame_property_6 = FrameProperty(Name="Angle", Section=frame_section_angle, Material=material_design_strengths)
frame_element_6 = FrameElement(FrameLine=asse_trave_m_6, FrameProperty=frame_property_6, AngleDeg=0, Offset=Vector(0, 0, 0), FrameID=-1)
deconstruct_beam_section_6 = DeconstructBeamSection(Section=frame_section_angle)  # -> Name, Area, I11, I22, J, ShearA1, ShearA2, Profile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
frame_section_channel = FrameSectionChannel(
    Name="Channel",
    Height=0.3,
    WidthTopFlange=0.2,
    ThicknessWeb=0.01,
    ThicknessTopFlange=0.01,
    WidthBottomFlange=0.2,
    ThicknessBottomFlange=0.01)
frame_property_7 = FrameProperty(Name="Channel", Section=frame_section_channel, Material=material_design_strengths)
frame_element_7 = FrameElement(FrameLine=asse_trave_m_7, FrameProperty=frame_property_7, AngleDeg=0, Offset=Vector(0, 0, 0), FrameID=-1)
deconstruct_beam_section_7 = DeconstructBeamSection(Section=frame_section_channel)  # -> Name, Area, I11, I22, J, ShearA1, ShearA2, Profile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
frame_section_box = FrameSectionBox(Name="Box", Height=0.3, Width=0.2, ThicknessWeb=0.01, ThicknessFlangeTop=0.01, ThicknessFlangeBottom=0.01)
frame_property_8 = FrameProperty(Name="Box", Section=frame_section_box, Material=material_design_strengths)
frame_element_8 = FrameElement(FrameLine=asse_trave_m_8, FrameProperty=frame_property_8, AngleDeg=0, Offset=Vector(0, 0, 0), FrameID=-1)
deconstruct_beam_section_8 = DeconstructBeamSection(Section=frame_section_box)  # -> Name, Area, I11, I22, J, ShearA1, ShearA2, Profile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
frame_section_generic = FrameSectionGeneric(
    Name="Generic",
    Area=0.01,
    I11=8.333333333e-06,
    I22=8.333333333e-06,
    J=1.406e-05,
    ShearL1=0,
    ShearL2=0,
    ShearA1=0.008333333333,
    ShearA2=0.008333333333,
    CentroidX=0,
    CentroidY=0,
    Angle=0,
    Profile=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)
frame_property_9 = FrameProperty(Name="Generic", Section=frame_section_generic, Material=material_design_strengths)
frame_element_9 = FrameElement(FrameLine=asse_trave_m_9, FrameProperty=frame_property_9, AngleDeg=0, Offset=Vector(0, 0, 0), FrameID=-1)
build_model = BuildModel(
    FrameElement=flatten([frame_element, frame_element_2, frame_element_3, frame_element_4, frame_element_5, frame_element_6, frame_element_7, frame_element_8, frame_element_9]),
    RenumberModels=True,
    PreserveNodes=False)
deconstruct_beam_section_9 = DeconstructBeamSection(Section=frame_section_generic)  # -> Name, Area, I11, I22, J, ShearA1, ShearA2, Profile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

# ---- group: Controlla e decomponi il Model
validate_straus_model = ValidateStrausModel(Model=build_model)  # -> Valid, Errors, Warnings
model_summary = ModelSummary(Model=build_model)  # -> Nodes, Beams, Plates, Links, LoadCases, Combinations, Groups, Solids
decompose_model = DecomposeModel(Model=build_model)  # -> NodeElements, FrameElements, AreaElements, LinkElements, Solids, Materials, BeamSections, BeamProperties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
preflight_valido = Panel(validate_straus_model.Valid)
errori = Panel(validate_straus_model.Errors)
numero_nodi = Panel(model_summary.Nodes)
travi = Panel(model_summary.Beams)
piastre = Panel(model_summary.Plates)

# ---- group: Preview / sezioni / carichi / attributi / Brep
# Preview e bake: Preview ON/OFF spegne la visualizzazione gestita.
# Display Settings controlla sezioni, carichi, vincoli, offset e assi.
# Brep pronti: tasto destro > Bake. Il bake e' manuale.
# Le geometrie FEM e il Model restano disponibili anche con preview OFF.
preview_on_off = BooleanToggle(True)
display_settings = Rhino2StrausDisplaySettings(
    Enabled=preview_on_off,
    Nodes=True,
    Beams=True,
    Plates=True,
    Solids=True,
    Links=True,
    Sections=True,
    Loads=True,
    Supports=True,
    Releases=True,
    Springs=True,
    Masses=True,
    Prescribed=True,
    Offsets=True,
    Axes=True,
    Labels=False,
    Properties=False,
    Values=False,
    Results=False,
    Shaded=True,
    SymbolScale=0.3,
    LoadScale=0.06,
    Transparency=0.3)
rhino2straus = Rhino2StrausDisplayManager(
    Model=build_model,
    Solid=True,
    Labels=False,
    Axes=False,
    Supports=True,
    AxisScale=1,
    Color=RGB(50, 150, 190),
    Enabled=preview_on_off,
    Settings=display_settings,
    LoadScale=1,
    ManagePreviews=True,
    DisplayEnabled=True,
    DisplayLayers=73727)  # -> Status, AvailableCases, Settings, Legend, Breps, BrepIssues
brep_pronti_per_bake = Brep(rhino2straus.Breps)
problemi_brep = Panel(rhino2straus.BrepIssues)

# ----
fy_mpa = Panel(deconstruct_material.Fy)
area_m2 = Panel(deconstruct_beam_section.Area)
area_m2_2 = Panel(deconstruct_beam_section_2.Area)
area_m2_3 = Panel(deconstruct_beam_section_3.Area)
area_m2_4 = Panel(deconstruct_beam_section_4.Area)
area_m2_5 = Panel(deconstruct_beam_section_5.Area)
area_m2_6 = Panel(deconstruct_beam_section_6.Area)
area_m2_7 = Panel(deconstruct_beam_section_7.Area)
area_m2_8 = Panel(deconstruct_beam_section_8.Area)
area_m2_9 = Panel(deconstruct_beam_section_9.Area)
