# Grasshopper definition 10_sezioni_native_standard.ghx (Grasshopper 1.0.8)
# plug-ins: Rhino2Straus
# Esempio autonomo Rhino2Straus. Geometrie interne; metri e kN. Leggere le note sul canvas e examples/README.md.

# 10 sezioni native standard: Sezioni native Straus: cruciforme, canale labbrato, T labbrato, top-hat, trapezio e triangolo pieni/cavi, Z.
# Native Section Options controlla discretizzazione e taglio. API necessaria: Genera profili e' False all'apertura.
# Unita': m, kN, kPa, tonne, C. Leggere gli input e i pannelli; valori dimostrativi modificabili.
genera_profili_api = BooleanToggle(False)
section_options = NativeSectionOptions(Divisions=24, Circular=0, Shear=True)
database_steel = DatabaseSteel(Type=2)

# ---- group: NativeSectionCruciform
asse_trave_m = Curve(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)
nome_sezione = Panel("Cruciform")
gate = StreamGate(Stream=nome_sezione, Gate=genera_profili_api)  # -> Target0, Target1
cruciform = BeamSectionCruciform(Name=gate.Target1, B=0.2, D=0.3, T1=0.01, T2=0.01, Options=section_options)  # -> Section, Profile
deconstruct_beam_section = DeconstructBeamSection(Section=cruciform.Section)  # -> Name, Area, I11, I22, J, ShearA1, ShearA2, Profile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
frame_property = FrameProperty(Name="NativeSectionCruciformComponent", Section=cruciform.Section, Material=database_steel)
frame_element = FrameElement(FrameLine=asse_trave_m, FrameProperty=frame_property, AngleDeg=0, Offset=Vector(0, 0, 0), FrameID=-1)
area_calcolata_m2 = Panel(deconstruct_beam_section.Area)

# ---- group: NativeSectionLipChannel
asse_trave_m_2 = Curve(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)
nome_sezione_2 = Panel("LipChannel")
gate_2 = StreamGate(Stream=nome_sezione_2, Gate=genera_profili_api)  # -> Target0, Target1
lipped_channel = BeamSectionLippedChannel(Name=gate_2.Target1, B=0.15, D=0.3, L=0.025, T1=0.008, T2=0.006, T3=0.006, Options=section_options)  # -> Section, Profile
deconstruct_beam_section_2 = DeconstructBeamSection(Section=lipped_channel.Section)  # -> Name, Area, I11, I22, J, ShearA1, ShearA2, Profile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
frame_property_2 = FrameProperty(Name="NativeSectionLipChannelComponent", Section=lipped_channel.Section, Material=database_steel)
frame_element_2 = FrameElement(FrameLine=asse_trave_m_2, FrameProperty=frame_property_2, AngleDeg=0, Offset=Vector(0, 0, 0), FrameID=-1)
area_calcolata_m2_2 = Panel(deconstruct_beam_section_2.Area)

# ---- group: NativeSectionTeeLipped
asse_trave_m_3 = Curve(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)
nome_sezione_3 = Panel("TeeLipped")
gate_3 = StreamGate(Stream=nome_sezione_3, Gate=genera_profili_api)  # -> Target0, Target1
lipped_tee = BeamSectionLippedTee(Name=gate_3.Target1, B=0.2, D=0.3, L=0.03, T1=0.01, T2=0.008, T3=0.006, Options=section_options)  # -> Section, Profile
deconstruct_beam_section_3 = DeconstructBeamSection(Section=lipped_tee.Section)  # -> Name, Area, I11, I22, J, ShearA1, ShearA2, Profile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
frame_property_3 = FrameProperty(Name="NativeSectionTeeLippedComponent", Section=lipped_tee.Section, Material=database_steel)
frame_element_3 = FrameElement(FrameLine=asse_trave_m_3, FrameProperty=frame_property_3, AngleDeg=0, Offset=Vector(0, 0, 0), FrameID=-1)
area_calcolata_m2_3 = Panel(deconstruct_beam_section_3.Area)

# ---- group: NativeSectionTopHat
asse_trave_m_4 = Curve(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)
nome_sezione_4 = Panel("TopHat")
gate_4 = StreamGate(Stream=nome_sezione_4, Gate=genera_profili_api)  # -> Target0, Target1
top_hat_channel = BeamSectionTopHatChannel(Name=gate_4.Target1, B=0.15, D=0.3, L=0.025, T1=0.008, T2=0.006, T3=0.006, Options=section_options)  # -> Section, Profile
deconstruct_beam_section_4 = DeconstructBeamSection(Section=top_hat_channel.Section)  # -> Name, Area, I11, I22, J, ShearA1, ShearA2, Profile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
frame_property_4 = FrameProperty(Name="NativeSectionTopHatComponent", Section=top_hat_channel.Section, Material=database_steel)
frame_element_4 = FrameElement(FrameLine=asse_trave_m_4, FrameProperty=frame_property_4, AngleDeg=0, Offset=Vector(0, 0, 0), FrameID=-1)
area_calcolata_m2_4 = Panel(deconstruct_beam_section_4.Area)

# ---- group: NativeSectionTrapezoidHollow
asse_trave_m_5 = Curve(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)
nome_sezione_5 = Panel("TrapezoidHollow")
gate_5 = StreamGate(Stream=nome_sezione_5, Gate=genera_profili_api)  # -> Target0, Target1
hollow_trapezoid = BeamSectionHollowTrapezoid(Name=gate_5.Target1, B1=0.2, B2=0.3, D=0.3, T1=0.01, T2=0.01, Options=section_options)  # -> Section, Profile
deconstruct_beam_section_5 = DeconstructBeamSection(Section=hollow_trapezoid.Section)  # -> Name, Area, I11, I22, J, ShearA1, ShearA2, Profile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
frame_property_5 = FrameProperty(Name="NativeSectionTrapezoidHollowComponent", Section=hollow_trapezoid.Section, Material=database_steel)
frame_element_5 = FrameElement(FrameLine=asse_trave_m_5, FrameProperty=frame_property_5, AngleDeg=0, Offset=Vector(0, 0, 0), FrameID=-1)
area_calcolata_m2_5 = Panel(deconstruct_beam_section_5.Area)

# ---- group: NativeSectionTrapezoidSolid
asse_trave_m_6 = Curve(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)
nome_sezione_6 = Panel("TrapezoidSolid")
gate_6 = StreamGate(Stream=nome_sezione_6, Gate=genera_profili_api)  # -> Target0, Target1
solid_trapezoid = BeamSectionSolidTrapezoid(Name=gate_6.Target1, B1=0.2, B2=0.3, D=0.3, Options=section_options)  # -> Section, Profile
deconstruct_beam_section_6 = DeconstructBeamSection(Section=solid_trapezoid.Section)  # -> Name, Area, I11, I22, J, ShearA1, ShearA2, Profile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
frame_property_6 = FrameProperty(Name="NativeSectionTrapezoidSolidComponent", Section=solid_trapezoid.Section, Material=database_steel)
frame_element_6 = FrameElement(FrameLine=asse_trave_m_6, FrameProperty=frame_property_6, AngleDeg=0, Offset=Vector(0, 0, 0), FrameID=-1)
area_calcolata_m2_6 = Panel(deconstruct_beam_section_6.Area)

# ---- group: NativeSectionTriangleHollow
asse_trave_m_7 = Curve(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)
nome_sezione_7 = Panel("TriangleHollow")
gate_7 = StreamGate(Stream=nome_sezione_7, Gate=genera_profili_api)  # -> Target0, Target1
hollow_triangle = BeamSectionHollowTriangle(Name=gate_7.Target1, B=0.2, D=0.3, T1=0.01, T2=0.01, Options=section_options)  # -> Section, Profile
deconstruct_beam_section_7 = DeconstructBeamSection(Section=hollow_triangle.Section)  # -> Name, Area, I11, I22, J, ShearA1, ShearA2, Profile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
frame_property_7 = FrameProperty(Name="NativeSectionTriangleHollowComponent", Section=hollow_triangle.Section, Material=database_steel)
frame_element_7 = FrameElement(FrameLine=asse_trave_m_7, FrameProperty=frame_property_7, AngleDeg=0, Offset=Vector(0, 0, 0), FrameID=-1)
area_calcolata_m2_7 = Panel(deconstruct_beam_section_7.Area)

# ---- group: NativeSectionTriangleSolid
asse_trave_m_8 = Curve(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)
nome_sezione_8 = Panel("TriangleSolid")
gate_8 = StreamGate(Stream=nome_sezione_8, Gate=genera_profili_api)  # -> Target0, Target1
solid_triangle = BeamSectionSolidTriangle(Name=gate_8.Target1, B=0.2, D=0.3, Options=section_options)  # -> Section, Profile
deconstruct_beam_section_8 = DeconstructBeamSection(Section=solid_triangle.Section)  # -> Name, Area, I11, I22, J, ShearA1, ShearA2, Profile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
frame_property_8 = FrameProperty(Name="NativeSectionTriangleSolidComponent", Section=solid_triangle.Section, Material=database_steel)
frame_element_8 = FrameElement(FrameLine=asse_trave_m_8, FrameProperty=frame_property_8, AngleDeg=0, Offset=Vector(0, 0, 0), FrameID=-1)
area_calcolata_m2_8 = Panel(deconstruct_beam_section_8.Area)

# ---- group: NativeSectionZ
asse_trave_m_9 = Curve(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)
nome_sezione_9 = Panel("Z")
gate_9 = StreamGate(Stream=nome_sezione_9, Gate=genera_profili_api)  # -> Target0, Target1
Z = BeamSectionZ(Name=gate_9.Target1, B1=0.15, B2=0.15, D=0.3, T1=0.01, T2=0.01, T3=0.008, Options=section_options)  # -> Section, Profile
deconstruct_beam_section_9 = DeconstructBeamSection(Section=Z.Section)  # -> Name, Area, I11, I22, J, ShearA1, ShearA2, Profile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
frame_property_9 = FrameProperty(Name="NativeSectionZComponent", Section=Z.Section, Material=database_steel)
frame_element_9 = FrameElement(FrameLine=asse_trave_m_9, FrameProperty=frame_property_9, AngleDeg=0, Offset=Vector(0, 0, 0), FrameID=-1)
area_calcolata_m2_9 = Panel(deconstruct_beam_section_9.Area)

# ----
build_model = BuildModel(
    FrameElement=flatten([frame_element, frame_element_2, frame_element_3, frame_element_4, frame_element_5, frame_element_6, frame_element_7, frame_element_8, frame_element_9]),
    RenumberModels=True,
    PreserveNodes=False)
gate_10 = StreamGate(Stream=build_model, Gate=genera_profili_api)  # -> Target0, Target1
clear_model_results = ClearModelResults(Model=gate_10.Target1)

# ---- group: Controlla e decomponi il Model
validate_straus_model = ValidateStrausModel(Model=clear_model_results)  # -> Valid, Errors, Warnings
model_summary = ModelSummary(Model=clear_model_results)  # -> Nodes, Beams, Plates, Links, LoadCases, Combinations, Groups, Solids
decompose_model = DecomposeModel(Model=clear_model_results)  # -> NodeElements, FrameElements, AreaElements, LinkElements, Solids, Materials, BeamSections, BeamProperties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
preflight_valido = Panel(validate_straus_model.Valid)
errori = Panel(validate_straus_model.Errors)
numero_nodi = Panel(model_summary.Nodes)
travi = Panel(model_summary.Beams)
piastre = Panel(model_summary.Plates)

# ---- group: Preview / sezioni / carichi / attributi / Brep
# Preview e bake: Preview ON/OFF spegne la visualizzazione gestita.
# Display Settings controlla sezioni, carichi, vincoli, offset e assi.
# Brep pronti: tasto destro > Bake. Il bake e' manuale.
# Le geometrie FEM e il Model restano disponibili anche con preview OFF.
preview_on_off = BooleanToggle(True)
display_settings = Rhino2StrausDisplaySettings(
    Enabled=preview_on_off,
    Nodes=True,
    Beams=True,
    Plates=True,
    Solids=True,
    Links=True,
    Sections=True,
    Loads=True,
    Supports=True,
    Releases=True,
    Springs=True,
    Masses=True,
    Prescribed=True,
    Offsets=True,
    Axes=True,
    Labels=False,
    Properties=False,
    Values=False,
    Results=False,
    Shaded=True,
    SymbolScale=0.3,
    LoadScale=0.06,
    Transparency=0.3)
rhino2straus = Rhino2StrausDisplayManager(
    Model=clear_model_results,
    Solid=True,
    Labels=False,
    Axes=False,
    Supports=True,
    AxisScale=1,
    Color=RGB(50, 150, 190),
    Enabled=preview_on_off,
    Settings=display_settings,
    LoadScale=1,
    ManagePreviews=True,
    DisplayEnabled=True,
    DisplayLayers=73727)  # -> Status, AvailableCases, Settings, Legend, Breps, BrepIssues
brep_pronti_per_bake = Brep(rhino2straus.Breps)
problemi_brep = Panel(rhino2straus.BrepIssues)
