# Grasshopper definition 11_sezioni_native_bgl.ghx (Grasshopper 1.0.8)
# plug-ins: Rhino2Straus
# Esempio autonomo Rhino2Straus. Geometrie interne; metri e kN. Leggere le note sul canvas e examples/README.md.

# 11 sezioni native bgl: Sezioni BGL: angolare, bulb, canale, I, RHS e T. Le dimensioni sono negli input del componente.
# Richiede API Straus: abilita Genera profili per calcolare rigidezze e contorni. Ogni sezione alimenta una trave e un solo Model.
# Unita': m, kN, kPa, tonne, C. Leggere gli input e i pannelli; valori dimostrativi modificabili.
genera_profili_api = BooleanToggle(False)
section_options = NativeSectionOptions(Divisions=24, Circular=0, Shear=True)
database_steel = DatabaseSteel(Type=2)

# ---- group: NativeSectionBglAngle
asse_trave_m = Curve(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)
nome_sezione = Panel("BglAngle")
gate = StreamGate(Stream=nome_sezione, Gate=genera_profili_api)  # -> Target0, Target1
bgl_angle = BeamSectionBGLAngle(
    Name=gate.Target1,
    D=0.3,
    B=0.15,
    Tw=0.008,
    Tf=0.012,
    Rr=0.008,
    Rh=0,
    Rt1=0,
    Rt2=0,
    Rt3=0,
    Rt4=0,
    Alpha1=0,
    Alpha2=0,
    Options=section_options)  # -> Section, Profile
deconstruct_beam_section = DeconstructBeamSection(Section=bgl_angle.Section)  # -> Name, Area, I11, I22, J, ShearA1, ShearA2, Profile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
frame_property = FrameProperty(Name="NativeSectionBglAngleComponent", Section=bgl_angle.Section, Material=database_steel)
frame_element = FrameElement(FrameLine=asse_trave_m, FrameProperty=frame_property, AngleDeg=0, Offset=Vector(0, 0, 0), FrameID=-1)
area_calcolata_m2 = Panel(deconstruct_beam_section.Area)

# ---- group: NativeSectionBglBulb
asse_trave_m_2 = Curve(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)
nome_sezione_2 = Panel("BglBulb")
gate_2 = StreamGate(Stream=nome_sezione_2, Gate=genera_profili_api)  # -> Target0, Target1
bgl_bulb_flat = BeamSectionBGLBulbFlat(Name=gate_2.Target1, D=0.3, B=0.04, T=0.01, Rr=0.008, Rh=0, Rt1=0, Rt2=0, Rt3=0, Alpha=30, Options=section_options)  # -> Section, Profile
deconstruct_beam_section_2 = DeconstructBeamSection(Section=bgl_bulb_flat.Section)  # -> Name, Area, I11, I22, J, ShearA1, ShearA2, Profile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
frame_property_2 = FrameProperty(Name="NativeSectionBglBulbComponent", Section=bgl_bulb_flat.Section, Material=database_steel)
frame_element_2 = FrameElement(FrameLine=asse_trave_m_2, FrameProperty=frame_property_2, AngleDeg=0, Offset=Vector(0, 0, 0), FrameID=-1)
area_calcolata_m2_2 = Panel(deconstruct_beam_section_2.Area)

# ---- group: NativeSectionBglChannel
asse_trave_m_3 = Curve(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)
nome_sezione_3 = Panel("BglChannel")
gate_3 = StreamGate(Stream=nome_sezione_3, Gate=genera_profili_api)  # -> Target0, Target1
bgl_channel = BeamSectionBGLChannel(
    Name=gate_3.Target1,
    D=0.3,
    B1=0.15,
    B2=0.15,
    Tw=0.008,
    Tf1=0.012,
    Tf2=0.012,
    Rr1=0.008,
    Rr2=0.008,
    Rh1=0,
    Rh2=0,
    Rt1=0,
    Rt2=0,
    Rt3=0,
    Rt4=0,
    Alpha1=0,
    Alpha2=0,
    Options=section_options)  # -> Section, Profile
deconstruct_beam_section_3 = DeconstructBeamSection(Section=bgl_channel.Section)  # -> Name, Area, I11, I22, J, ShearA1, ShearA2, Profile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
frame_property_3 = FrameProperty(Name="NativeSectionBglChannelComponent", Section=bgl_channel.Section, Material=database_steel)
frame_element_3 = FrameElement(FrameLine=asse_trave_m_3, FrameProperty=frame_property_3, AngleDeg=0, Offset=Vector(0, 0, 0), FrameID=-1)
area_calcolata_m2_3 = Panel(deconstruct_beam_section_3.Area)

# ---- group: NativeSectionBglI
asse_trave_m_4 = Curve(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)
nome_sezione_4 = Panel("BglI")
gate_4 = StreamGate(Stream=nome_sezione_4, Gate=genera_profili_api)  # -> Target0, Target1
bgl_i = BeamSectionBGLI(
    Name=gate_4.Target1,
    D=0.3,
    B1=0.15,
    B2=0.15,
    Tw=0.008,
    Tf1=0.012,
    Tf2=0.012,
    Rr1=0.008,
    Rr2=0.008,
    Rt1=0,
    Rt2=0,
    Rt3=0,
    Rt4=0,
    Alpha1=0,
    Alpha2=0,
    Options=section_options)  # -> Section, Profile
deconstruct_beam_section_4 = DeconstructBeamSection(Section=bgl_i.Section)  # -> Name, Area, I11, I22, J, ShearA1, ShearA2, Profile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
frame_property_4 = FrameProperty(Name="NativeSectionBglIComponent", Section=bgl_i.Section, Material=database_steel)
frame_element_4 = FrameElement(FrameLine=asse_trave_m_4, FrameProperty=frame_property_4, AngleDeg=0, Offset=Vector(0, 0, 0), FrameID=-1)
area_calcolata_m2_4 = Panel(deconstruct_beam_section_4.Area)

# ---- group: NativeSectionBglRhs
asse_trave_m_5 = Curve(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)
nome_sezione_5 = Panel("BglRhs")
gate_5 = StreamGate(Stream=nome_sezione_5, Gate=genera_profili_api)  # -> Target0, Target1
bgl_rectangular_hollow = BeamSectionBGLRectangularHollow(Name=gate_5.Target1, D=0.3, B=0.15, Tw=0.008, Tf=0.012, Ri=0.008, Ro=0.016, Options=section_options)  # -> Section, Profile
deconstruct_beam_section_5 = DeconstructBeamSection(Section=bgl_rectangular_hollow.Section)  # -> Name, Area, I11, I22, J, ShearA1, ShearA2, Profile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
frame_property_5 = FrameProperty(Name="NativeSectionBglRhsComponent", Section=bgl_rectangular_hollow.Section, Material=database_steel)
frame_element_5 = FrameElement(FrameLine=asse_trave_m_5, FrameProperty=frame_property_5, AngleDeg=0, Offset=Vector(0, 0, 0), FrameID=-1)
area_calcolata_m2_5 = Panel(deconstruct_beam_section_5.Area)

# ---- group: NativeSectionBglTee
asse_trave_m_6 = Curve(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)
nome_sezione_6 = Panel("BglTee")
gate_6 = StreamGate(Stream=nome_sezione_6, Gate=genera_profili_api)  # -> Target0, Target1
bgl_tee = BeamSectionBGLTee(
    Name=gate_6.Target1,
    D=0.3,
    B=0.15,
    Tw=0.008,
    Tf=0.012,
    Rr=0.008,
    Rt1=0,
    Rt2=0,
    Rt3=0,
    Alpha1=0,
    Alpha2=0,
    Options=section_options)  # -> Section, Profile
deconstruct_beam_section_6 = DeconstructBeamSection(Section=bgl_tee.Section)  # -> Name, Area, I11, I22, J, ShearA1, ShearA2, Profile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
frame_property_6 = FrameProperty(Name="NativeSectionBglTeeComponent", Section=bgl_tee.Section, Material=database_steel)
frame_element_6 = FrameElement(FrameLine=asse_trave_m_6, FrameProperty=frame_property_6, AngleDeg=0, Offset=Vector(0, 0, 0), FrameID=-1)
area_calcolata_m2_6 = Panel(deconstruct_beam_section_6.Area)

# ----
build_model = BuildModel(
    FrameElement=flatten([frame_element, frame_element_2, frame_element_3, frame_element_4, frame_element_5, frame_element_6]),
    RenumberModels=True,
    PreserveNodes=False)
gate_7 = StreamGate(Stream=build_model, Gate=genera_profili_api)  # -> Target0, Target1
clear_model_results = ClearModelResults(Model=gate_7.Target1)

# ---- group: Controlla e decomponi il Model
validate_straus_model = ValidateStrausModel(Model=clear_model_results)  # -> Valid, Errors, Warnings
model_summary = ModelSummary(Model=clear_model_results)  # -> Nodes, Beams, Plates, Links, LoadCases, Combinations, Groups, Solids
decompose_model = DecomposeModel(Model=clear_model_results)  # -> NodeElements, FrameElements, AreaElements, LinkElements, Solids, Materials, BeamSections, BeamProperties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
preflight_valido = Panel(validate_straus_model.Valid)
errori = Panel(validate_straus_model.Errors)
numero_nodi = Panel(model_summary.Nodes)
travi = Panel(model_summary.Beams)
piastre = Panel(model_summary.Plates)

# ---- group: Preview / sezioni / carichi / attributi / Brep
# Preview e bake: Preview ON/OFF spegne la visualizzazione gestita.
# Display Settings controlla sezioni, carichi, vincoli, offset e assi.
# Brep pronti: tasto destro > Bake. Il bake e' manuale.
# Le geometrie FEM e il Model restano disponibili anche con preview OFF.
preview_on_off = BooleanToggle(True)
display_settings = Rhino2StrausDisplaySettings(
    Enabled=preview_on_off,
    Nodes=True,
    Beams=True,
    Plates=True,
    Solids=True,
    Links=True,
    Sections=True,
    Loads=True,
    Supports=True,
    Releases=True,
    Springs=True,
    Masses=True,
    Prescribed=True,
    Offsets=True,
    Axes=True,
    Labels=False,
    Properties=False,
    Values=False,
    Results=False,
    Shaded=True,
    SymbolScale=0.3,
    LoadScale=0.06,
    Transparency=0.3)
rhino2straus = Rhino2StrausDisplayManager(
    Model=clear_model_results,
    Solid=True,
    Labels=False,
    Axes=False,
    Supports=True,
    AxisScale=1,
    Color=RGB(50, 150, 190),
    Enabled=preview_on_off,
    Settings=display_settings,
    LoadScale=1,
    ManagePreviews=True,
    DisplayEnabled=True,
    DisplayLayers=73727)  # -> Status, AvailableCases, Settings, Legend, Breps, BrepIssues
brep_pronti_per_bake = Brep(rhino2straus.Breps)
problemi_brep = Panel(rhino2straus.BrepIssues)
