# Grasshopper definition 12_sezione_bxs_profilo_bake.ghx (Grasshopper 1.0.8)
# plug-ins: Rhino2Straus
# Esempio autonomo Rhino2Straus. Geometrie interne; metri e kN. Leggere le note sul canvas e examples/README.md.

asse_trave_m = Curve(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)
# 12 sezione bxs profilo bake: Importazione di una sezione .bxs esistente. Imposta il percorso, poi Leggi BXS=True.
# Il componente conserva i dati BXS nel Model per l'export. Section Info espone contorno e proprieta'.
# Il profilo viene estruso lungo una trave; Display Manager espone Breps per bake manuale.
# Unita': m, kN, kPa, tonne, C. Leggere gli input e i pannelli; valori dimostrativi modificabili.
leggi_bxs_api = BooleanToggle(False)
database_steel = DatabaseSteel(Type=2)
file_bxs_da_scegliere = Panel("C:\Temp\sezione.bxs")
gate = StreamGate(Stream=file_bxs_da_scegliere, Gate=leggi_bxs_api)  # -> Target0, Target1
beam_section_bxs = BeamSectionBXS(BXSFile=gate.Target1, Name="BXS")
frame_property = FrameProperty(Name="Beam", Section=beam_section_bxs, Material=database_steel)
deconstruct_beam_section = DeconstructBeamSection(Section=beam_section_bxs)  # -> Name, Area, I11, I22, J, ShearA1, ShearA2, Profile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
frame_element = FrameElement(FrameLine=asse_trave_m, FrameProperty=frame_property, AngleDeg=0, Offset=Vector(0, 0, 0), FrameID=-1)
build_model = BuildModel(FrameElement=flatten(frame_element), RenumberModels=True, PreserveNodes=False)
gate_2 = StreamGate(Stream=build_model, Gate=leggi_bxs_api)  # -> Target0, Target1
clear_model_results = ClearModelResults(Model=gate_2.Target1)

# ---- group: Controlla e decomponi il Model
validate_straus_model = ValidateStrausModel(Model=clear_model_results)  # -> Valid, Errors, Warnings
model_summary = ModelSummary(Model=clear_model_results)  # -> Nodes, Beams, Plates, Links, LoadCases, Combinations, Groups, Solids
decompose_model = DecomposeModel(Model=clear_model_results)  # -> NodeElements, FrameElements, AreaElements, LinkElements, Solids, Materials, BeamSections, BeamProperties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
preflight_valido = Panel(validate_straus_model.Valid)
errori = Panel(validate_straus_model.Errors)
numero_nodi = Panel(model_summary.Nodes)
travi = Panel(model_summary.Beams)
piastre = Panel(model_summary.Plates)

# ---- group: Preview / sezioni / carichi / attributi / Brep
# Preview e bake: Preview ON/OFF spegne la visualizzazione gestita.
# Display Settings controlla sezioni, carichi, vincoli, offset e assi.
# Brep pronti: tasto destro > Bake. Il bake e' manuale.
# Le geometrie FEM e il Model restano disponibili anche con preview OFF.
preview_on_off = BooleanToggle(True)
display_settings = Rhino2StrausDisplaySettings(
    Enabled=preview_on_off,
    Nodes=True,
    Beams=True,
    Plates=True,
    Solids=True,
    Links=True,
    Sections=True,
    Loads=True,
    Supports=True,
    Releases=True,
    Springs=True,
    Masses=True,
    Prescribed=True,
    Offsets=True,
    Axes=True,
    Labels=False,
    Properties=False,
    Values=False,
    Results=False,
    Shaded=True,
    SymbolScale=0.3,
    LoadScale=0.06,
    Transparency=0.3)
rhino2straus = Rhino2StrausDisplayManager(
    Model=clear_model_results,
    Solid=True,
    Labels=False,
    Axes=False,
    Supports=True,
    AxisScale=1,
    Color=RGB(50, 150, 190),
    Enabled=preview_on_off,
    Settings=display_settings,
    LoadScale=1,
    ManagePreviews=True,
    DisplayEnabled=True,
    DisplayLayers=73727)  # -> Status, AvailableCases, Settings, Legend, Breps, BrepIssues
brep_pronti_per_bake = Brep(rhino2straus.Breps)
problemi_brep = Panel(rhino2straus.BrepIssues)

# ----
tipo_sezione = Panel(deconstruct_beam_section.Definition)
