# Grasshopper definition 13_modello_gruppi_filtri_ricostruzione.ghx (Grasshopper 1.0.8)
# plug-ins: Rhino2Straus
# Esempio autonomo Rhino2Straus. Geometrie interne; metri e kN. Leggere le note sul canvas e examples/README.md.

asse_trave_m = Curve(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)
incastro = Point(Point(0, 0, 0))
nodo_libero = Point(Point(4, 0, 0))
# 13 modello gruppi filtri ricostruzione: Gruppi gerarchici, filtri per posizione/proprieta'/gruppo, decomposizione e ricostruzione.
# I filtri combinano i criteri con OR. Un solo Model finale. Per un import collegare anche Preserve nodes e Self weight.
# Merge salda le parti create; se una parte viene da import, conserva i nodi distinti.
# Unita': m, kN, kPa, tonne, C. Leggere gli input e i pannelli; valori dimostrativi modificabili.
database_steel = DatabaseSteel(Type=2)
frame_section_solid_rectangular = FrameSectionSolidRectangular(Height=0.3, Width=0.2)
frame_property = FrameProperty(Name="Beam", Section=frame_section_solid_rectangular, Material=database_steel)
node_element = NodeElement(NodePoint=incastro, NodeID=-1)
support = Support(Node=node_element, Dx=True, Dy=True, Dz=True, Mx=True, My=True, Mz=True)
node_element_2 = NodeElement(NodePoint=nodo_libero, NodeID=-1)
load_case = LoadCase(Name="Q", GravityNSM=False)
load_nodal = LoadNodal(Node=node_element_2, LoadCase=load_case, Fx=0, Fy=0, Fz=-10, Mx=0, My=0, Mz=0)
element_group = ElementGroup(GroupName="Edificio")
element_group_2 = ElementGroup(GroupName="Travi", GroupParent=element_group)
frame_element = FrameElement(
    FrameLine=asse_trave_m,
    FrameProperty=frame_property,
    AngleDeg=0,
    Groups=element_group_2,
    Offset=Vector(0, 0, 0),
    FrameID=-1)
build_model = BuildModel(Node=flatten([support, load_nodal]), FrameElement=flatten(frame_element), RenumberModels=True, PreserveNodes=False)
decompose_model = DecomposeModel(Model=build_model)  # -> NodeElements, FrameElements, AreaElements, LinkElements, Solids, Materials, BeamSections, BeamProperties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
frame_filter = FrameFilter(FrameElements=decompose_model.FrameElements, Groups=element_group_2, Tolerance=0.001)  # -> FilteredFrames, OtherFrames
node_filter = NodeFilter(NodeElements=decompose_model.NodeElements, Position=Point(0, 0, 0), Tolerance=0.001)  # -> FilteredNodes, OtherNodes
build_model_2 = BuildModel(
    Unit=decompose_model.Units,
    Node=flatten([node_filter.FilteredNodes, node_filter.OtherNodes]),
    FrameElement=flatten([frame_filter.FilteredFrames, frame_filter.OtherFrames]),
    LoadCombination=flatten(decompose_model.Combinations),
    SelfWeight=decompose_model.SelfWeight,
    RenumberModels=True,
    PreserveNodes=decompose_model.PreserveNodes,
    LoadCases=flatten(decompose_model.LoadCases))
align_model_local_axes = AlignModelLocalAxes(Model=build_model_2, Direction=Vector(0, 0, 1), Beams=True, Plates=False, Axis=1)
clear_model_results = ClearModelResults(Model=align_model_local_axes)

# ---- group: Controlla e decomponi il Model
validate_straus_model = ValidateStrausModel(Model=clear_model_results)  # -> Valid, Errors, Warnings
model_summary = ModelSummary(Model=clear_model_results)  # -> Nodes, Beams, Plates, Links, LoadCases, Combinations, Groups, Solids
decompose_model_2 = DecomposeModel(Model=clear_model_results)  # -> NodeElements, FrameElements, AreaElements, LinkElements, Solids, Materials, BeamSections, BeamProperties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
preflight_valido = Panel(validate_straus_model.Valid)
errori = Panel(validate_straus_model.Errors)
numero_nodi = Panel(model_summary.Nodes)
travi = Panel(model_summary.Beams)
piastre = Panel(model_summary.Plates)

# ---- group: Preview / sezioni / carichi / attributi / Brep
# Preview e bake: Preview ON/OFF spegne la visualizzazione gestita.
# Display Settings controlla sezioni, carichi, vincoli, offset e assi.
# Brep pronti: tasto destro > Bake. Il bake e' manuale.
# Le geometrie FEM e il Model restano disponibili anche con preview OFF.
preview_on_off = BooleanToggle(True)
display_settings = Rhino2StrausDisplaySettings(
    Enabled=preview_on_off,
    Nodes=True,
    Beams=True,
    Plates=True,
    Solids=True,
    Links=True,
    Sections=True,
    Loads=True,
    Supports=True,
    Releases=True,
    Springs=True,
    Masses=True,
    Prescribed=True,
    Offsets=True,
    Axes=True,
    Labels=False,
    Properties=False,
    Values=False,
    Results=False,
    Shaded=True,
    SymbolScale=0.3,
    LoadScale=0.06,
    Transparency=0.3)
rhino2straus = Rhino2StrausDisplayManager(
    Model=clear_model_results,
    Solid=True,
    Labels=False,
    Axes=False,
    Supports=True,
    AxisScale=1,
    Color=RGB(50, 150, 190),
    Enabled=preview_on_off,
    Settings=display_settings,
    LoadScale=1,
    ManagePreviews=True,
    DisplayEnabled=True,
    DisplayLayers=73727)  # -> Status, AvailableCases, Settings, Legend, Breps, BrepIssues
brep_pronti_per_bake = Brep(rhino2straus.Breps)
problemi_brep = Panel(rhino2straus.BrepIssues)
