# Grasshopper definition 14_carichi_travi_peso_proprio.ghx (Grasshopper 1.0.8)
# plug-ins: Rhino2Straus
# Esempio autonomo Rhino2Straus. Geometrie interne; metri e kN. Leggere le note sul canvas e examples/README.md.

asse_trave_m = Curve(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)
incastro = Point(Point(0, 0, 0))
nodo_libero = Point(Point(4, 0, 0))
# 14 carichi travi peso proprio: Carichi concatenati: forza e momento concentrati, distribuzione lineare parziale, gradiente termico e pretensione.
# Posizioni relative da nodo 1: 0..1. Carichi locali lungo assi principali; carichi globali indipendenti dalla rotazione della sezione.
# Peso proprio G separato dai carichi Q. Tutti gli attributi rimangono nel Model unico.
# Unita': m, kN, kPa, tonne, C. Leggere gli input e i pannelli; valori dimostrativi modificabili.
database_steel = DatabaseSteel(Type=2)
frame_section_solid_rectangular = FrameSectionSolidRectangular(Height=0.3, Width=0.2)
frame_property = FrameProperty(Name="Beam", Section=frame_section_solid_rectangular, Material=database_steel)
frame_element = FrameElement(FrameLine=asse_trave_m, FrameProperty=frame_property, AngleDeg=0, Offset=Vector(0, 0, 0), FrameID=-1)
node_element = NodeElement(NodePoint=incastro, NodeID=-1)
support = Support(Node=node_element, Dx=True, Dy=True, Dz=True, Mx=True, My=True, Mz=True)
node_element_2 = NodeElement(NodePoint=nodo_libero, NodeID=-1)
load_case = LoadCase(Name="Q", GravityNSM=False)
load_nodal = LoadNodal(Node=node_element_2, LoadCase=load_case, Fx=0, Fy=0, Fz=-10, Mx=0, My=0, Mz=0)
beam_point_force = BeamPointForce(Beam=frame_element, LoadCase=load_case, Value=Vector(0, 0, -5), Position=0.5, Global=True)
beam_point_moment = BeamPointMoment(Beam=beam_point_force, LoadCase=load_case, Value=Vector(0, 2, 0), Position=0.5, Global=True)
load_frame_non_uniform = LoadFrameNonUniform(
    Frame=beam_point_moment,
    LoadCase=load_case,
    TypeForceOrMoment=0,
    Direction=5,
    Projected=False,
    CoordinateSystem=1,
    LoadAtStart=-1,
    LoadAtEnd=-4,
    LocationRelativeStart=0.2,
    LocationRelativeEnd=0.8)
beam_temperature_gradient = BeamTemperatureGradient(Beam=load_frame_non_uniform, LoadCase=load_case, Gradient1=10, Gradient2=5)
beam_preload = BeamPreload(Beam=beam_temperature_gradient, LoadCase=load_case, Value=10, Strain=False)
load_case_2 = LoadCase(Name="G", GravityNSM=False)
self_weight = SelfWeight(LoadCase=load_case_2, Axis=2, Factor=-1, StructuralMass=True, NonstructuralMass=True)
build_model = BuildModel(
    Node=flatten([support, load_nodal]),
    FrameElement=flatten(beam_preload),
    SelfWeight=self_weight,
    RenumberModels=True,
    PreserveNodes=False)

# ---- group: Controlla e decomponi il Model
validate_straus_model = ValidateStrausModel(Model=build_model)  # -> Valid, Errors, Warnings
model_summary = ModelSummary(Model=build_model)  # -> Nodes, Beams, Plates, Links, LoadCases, Combinations, Groups, Solids
decompose_model = DecomposeModel(Model=build_model)  # -> NodeElements, FrameElements, AreaElements, LinkElements, Solids, Materials, BeamSections, BeamProperties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
preflight_valido = Panel(validate_straus_model.Valid)
errori = Panel(validate_straus_model.Errors)
numero_nodi = Panel(model_summary.Nodes)
travi = Panel(model_summary.Beams)
piastre = Panel(model_summary.Plates)

# ---- group: Preview / sezioni / carichi / attributi / Brep
# Preview e bake: Preview ON/OFF spegne la visualizzazione gestita.
# Display Settings controlla sezioni, carichi, vincoli, offset e assi.
# Brep pronti: tasto destro > Bake. Il bake e' manuale.
# Le geometrie FEM e il Model restano disponibili anche con preview OFF.
preview_on_off = BooleanToggle(True)
display_settings = Rhino2StrausDisplaySettings(
    Enabled=preview_on_off,
    Nodes=True,
    Beams=True,
    Plates=True,
    Solids=True,
    Links=True,
    Sections=True,
    Loads=True,
    Supports=True,
    Releases=True,
    Springs=True,
    Masses=True,
    Prescribed=True,
    Offsets=True,
    Axes=True,
    Labels=False,
    Properties=False,
    Values=False,
    Results=False,
    Shaded=True,
    SymbolScale=0.3,
    LoadScale=0.06,
    Transparency=0.3)
rhino2straus = Rhino2StrausDisplayManager(
    Model=build_model,
    Solid=True,
    Labels=False,
    Axes=False,
    Supports=True,
    AxisScale=1,
    Color=RGB(50, 150, 190),
    Enabled=preview_on_off,
    Settings=display_settings,
    LoadScale=1,
    ManagePreviews=True,
    DisplayEnabled=True,
    DisplayLayers=73727)  # -> Status, AvailableCases, Settings, Legend, Breps, BrepIssues
brep_pronti_per_bake = Brep(rhino2straus.Breps)
problemi_brep = Panel(rhino2straus.BrepIssues)
