# Grasshopper definition 15_carichi_piastre_termici_precarico.ghx (Grasshopper 1.0.8)
# plug-ins: Rhino2Straus
# Esempio autonomo Rhino2Straus. Geometrie interne; metri e kN. Leggere le note sul canvas e examples/README.md.

quad4 = Mesh(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)
quattro_appoggi = Point([Point(0, 0, 0), Point(2, 0, 0), Point(2, 2, 0), Point(0, 2, 0)])
# 15 carichi piastre termici precarico: Carico normale alla piastra, pressione globale, pressione su bordo, gradiente termico e predeformazione nel piano.
# I carichi vengono applicati in sequenza sulla stessa piastra. Il filtro finale mostra la selezione per proprieta'.
# Normal pressure e Global pressure sono attributi diversi: qui vengono sommati intenzionalmente per illustrare il flusso.
# Unita': m, kN, kPa, tonne, C. Leggere gli input e i pannelli; valori dimostrativi modificabili.
database_concrete = DatabaseConcrete(Type=4)
area_thickness = AreaThickness(Thickness=0.2)
area_property = AreaProperty(Name="Plate", Section=area_thickness, Material=database_concrete, Type=0)
area_element = AreaElement(Area=quad4, AreaProperty=area_property, AngleDeg=0, Offset=0, AreaID=-1)
load_case = LoadCase(Name="Q", GravityNSM=False)
area_load_uniform = AreaLoadUniform(Area=area_element, LoadCase=load_case, Direction=2, Projected=False, Load=2)
plate_global_pressure = PlateGlobalPressure(Plate=area_load_uniform, LoadCase=load_case, Pressure=Vector(0, 0, -3), TopFace=True, Projected=False)
plate_edge_pressure = PlateEdgePressure(Plate=plate_global_pressure, LoadCase=load_case, Edge=1, Pressure=1)
plate_temperature_gradient = PlateTemperatureGradient(Plate=plate_edge_pressure, LoadCase=load_case, Gradient=10)
plate_preload = PlatePreload(Plate=plate_temperature_gradient, LoadCase=load_case, Values=Vector(0.0001, 0.0001, 0), Strain=True)
area_filter = AreaFilter(AreaElements=plate_preload, AreaProperties=area_property, Tolerance=0.001)  # -> FilteredAreas, OtherAreas
node_element = NodeElement(NodePoint=quattro_appoggi, NodeID=-1)
support = Support(Node=node_element, Dx=True, Dy=True, Dz=True, Mx=True, My=True, Mz=True)
build_model = BuildModel(Node=flatten(support), AreaElement=flatten(area_filter.FilteredAreas), RenumberModels=True, PreserveNodes=False)

# ---- group: Controlla e decomponi il Model
validate_straus_model = ValidateStrausModel(Model=build_model)  # -> Valid, Errors, Warnings
model_summary = ModelSummary(Model=build_model)  # -> Nodes, Beams, Plates, Links, LoadCases, Combinations, Groups, Solids
decompose_model = DecomposeModel(Model=build_model)  # -> NodeElements, FrameElements, AreaElements, LinkElements, Solids, Materials, BeamSections, BeamProperties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
preflight_valido = Panel(validate_straus_model.Valid)
errori = Panel(validate_straus_model.Errors)
numero_nodi = Panel(model_summary.Nodes)
travi = Panel(model_summary.Beams)
piastre = Panel(model_summary.Plates)

# ---- group: Preview / sezioni / carichi / attributi / Brep
# Preview e bake: Preview ON/OFF spegne la visualizzazione gestita.
# Display Settings controlla sezioni, carichi, vincoli, offset e assi.
# Brep pronti: tasto destro > Bake. Il bake e' manuale.
# Le geometrie FEM e il Model restano disponibili anche con preview OFF.
preview_on_off = BooleanToggle(True)
display_settings = Rhino2StrausDisplaySettings(
    Enabled=preview_on_off,
    Nodes=True,
    Beams=True,
    Plates=True,
    Solids=True,
    Links=True,
    Sections=True,
    Loads=True,
    Supports=True,
    Releases=True,
    Springs=True,
    Masses=True,
    Prescribed=True,
    Offsets=True,
    Axes=True,
    Labels=False,
    Properties=False,
    Values=False,
    Results=False,
    Shaded=True,
    SymbolScale=0.3,
    LoadScale=0.06,
    Transparency=0.3)
rhino2straus = Rhino2StrausDisplayManager(
    Model=build_model,
    Solid=True,
    Labels=False,
    Axes=False,
    Supports=True,
    AxisScale=1,
    Color=RGB(50, 150, 190),
    Enabled=preview_on_off,
    Settings=display_settings,
    LoadScale=1,
    ManagePreviews=True,
    DisplayEnabled=True,
    DisplayLayers=73727)  # -> Status, AvailableCases, Settings, Legend, Breps, BrepIssues
brep_pronti_per_bake = Brep(rhino2straus.Breps)
problemi_brep = Panel(rhino2straus.BrepIssues)
