# Grasshopper definition 16_export_import_model_esistente.ghx (Grasshopper 1.0.8)
# plug-ins: Rhino2Straus
# Esempio autonomo Rhino2Straus. Geometrie interne; metri e kN. Leggere le note sul canvas e examples/README.md.

asse_trave_m = Curve(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)
incastro = Point(Point(0, 0, 0))
nodo_libero = Point(Point(4, 0, 0))
# 16 export import model esistente: 1. Il modello dimostrativo puo' essere esportato con Run. 2. Read Straus Model legge quel file o un altro .st7.
# 3. Controlla Complete, Report e Identity map: il Model contiene geometrie, proprieta', carichi e attributi supportati.
# Il file sorgente non viene salvato. L'import normalizza in metri e kN; Allow partial=False blocca il Model in presenza di omissioni.
# La lettura geometrica e il bake diretto dal file sono alternative. Ogni azione ha un interruttore indipendente.
# Unita': m, kN, kPa, tonne, C. Leggere gli input e i pannelli; valori dimostrativi modificabili.
database_steel = DatabaseSteel(Type=2)
frame_section_solid_rectangular = FrameSectionSolidRectangular(Height=0.3, Width=0.2)
frame_property = FrameProperty(Name="Beam", Section=frame_section_solid_rectangular, Material=database_steel)
frame_element = FrameElement(FrameLine=asse_trave_m, FrameProperty=frame_property, AngleDeg=0, Offset=Vector(0, 0, 0), FrameID=-1)
node_element = NodeElement(NodePoint=incastro, NodeID=-1)
support = Support(Node=node_element, Dx=True, Dy=True, Dz=True, Mx=True, My=True, Mz=True)
node_element_2 = NodeElement(NodePoint=nodo_libero, NodeID=-1)
load_case = LoadCase(Name="Q", GravityNSM=False)
load_nodal = LoadNodal(Node=node_element_2, LoadCase=load_case, Fx=0, Fy=0, Fz=-10, Mx=0, My=0, Mz=0)
build_model = BuildModel(Node=flatten([support, load_nodal]), FrameElement=flatten(frame_element), RenumberModels=True, PreserveNodes=False)
run_st7_r3 = BooleanToggle(False)
overwrite_st7_r3 = BooleanToggle(False)
read_read_st7_model = BooleanToggle(False)
run_st7_r3_2 = BooleanToggle(False)
overwrite_st7_r3_2 = BooleanToggle(False)
leggi_solo_geometria_api = BooleanToggle(False)
bake_bake_straus_geometry = BooleanToggle(False)
percorso_di_lavoro_cambia_per_importare = Panel("C:\Temp\Rhino2StrausExamples\16_model.st7")  # "Percorso di lavoro / cambia per importare un file esistente"
st7_r3 = Straus7R3Export(Model=build_model, OutputPath=percorso_di_lavoro_cambia_per_importare, Run=run_st7_r3, Overwrite=overwrite_st7_r3)  # -> Status, Success, Warnings, Errors, ModelPath
read_st7_model = ReadStrausModel(
    ModelPath=percorso_di_lavoro_cambia_per_importare,
    Read=read_read_st7_model,
    FreedomCase=1,
    AllowPartial=False,
    Tolerance=0.001)  # -> Model, Complete, Report, IdentityMap, Status
decompose_model = DecomposeModel(Model=read_st7_model.Model)  # -> NodeElements, FrameElements, AreaElements, LinkElements, Solids, Materials, BeamSections, BeamProperties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
build_model_2 = BuildModel(
    Unit=decompose_model.Units,
    Node=flatten(decompose_model.NodeElements),
    FrameElement=flatten(decompose_model.FrameElements),
    AreaElement=flatten(decompose_model.AreaElements),
    LinkElement=flatten(decompose_model.LinkElements),
    LoadCombination=flatten(decompose_model.Combinations),
    SelfWeight=decompose_model.SelfWeight,
    Solids=flatten(decompose_model.Solids),
    RenumberModels=True,
    PreserveNodes=decompose_model.PreserveNodes,
    LoadCases=flatten(decompose_model.LoadCases))
st7_r3_2 = Straus7R3Export(
    Model=build_model_2,
    OutputPath="C:\Temp\Rhino2StrausExamples\16_modificato.st7",
    Run=run_st7_r3_2,
    Overwrite=overwrite_st7_r3_2)  # -> Status, Success, Warnings, Errors, ModelPath

# ---- group: Preview / sezioni / carichi / attributi / Brep
# Preview e bake: Preview ON/OFF spegne la visualizzazione gestita.
# Display Settings controlla sezioni, carichi, vincoli, offset e assi.
# Brep pronti: tasto destro > Bake. Il bake e' manuale.
# Le geometrie FEM e il Model restano disponibili anche con preview OFF.
preview_on_off = BooleanToggle(True)
display_settings = Rhino2StrausDisplaySettings(
    Enabled=preview_on_off,
    Nodes=True,
    Beams=True,
    Plates=True,
    Solids=True,
    Links=True,
    Sections=True,
    Loads=True,
    Supports=True,
    Releases=True,
    Springs=True,
    Masses=True,
    Prescribed=True,
    Offsets=True,
    Axes=True,
    Labels=False,
    Properties=False,
    Values=False,
    Results=False,
    Shaded=True,
    SymbolScale=0.3,
    LoadScale=0.06,
    Transparency=0.3)
rhino2straus = Rhino2StrausDisplayManager(
    Model=read_st7_model.Model,
    Solid=True,
    Labels=False,
    Axes=False,
    Supports=True,
    AxisScale=1,
    Color=RGB(50, 150, 190),
    Enabled=preview_on_off,
    Settings=display_settings,
    LoadScale=1,
    ManagePreviews=True,
    DisplayEnabled=True,
    DisplayLayers=73727)  # -> Status, AvailableCases, Settings, Legend, Breps, BrepIssues
brep_pronti_per_bake = Brep(rhino2straus.Breps)
problemi_brep = Panel(rhino2straus.BrepIssues)

# ---- group: Controlla e decomponi il Model
validate_straus_model = ValidateStrausModel(Model=read_st7_model.Model)  # -> Valid, Errors, Warnings
model_summary = ModelSummary(Model=read_st7_model.Model)  # -> Nodes, Beams, Plates, Links, LoadCases, Combinations, Groups, Solids
decompose_model_2 = DecomposeModel(Model=read_st7_model.Model)  # -> NodeElements, FrameElements, AreaElements, LinkElements, Solids, Materials, BeamSections, BeamProperties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
# Modifica e ricostruisci: Inserisci qui i componenti di modifica su travi, piastre o nodi.
# Sostituisci il collegamento diretto: collegare insieme originale e copia modificata puo' duplicare attributi.
# Preserve nodes=True conserva nodi coincidenti con ID diversi; le unita' arrivano dal file importato.
preflight_valido = Panel(validate_straus_model.Valid)
errori = Panel(validate_straus_model.Errors)
numero_nodi = Panel(model_summary.Nodes)
travi = Panel(model_summary.Beams)
piastre = Panel(model_summary.Plates)

# ----
gate = StreamGate(Stream=percorso_di_lavoro_cambia_per_importare, Gate=leggi_solo_geometria_api)  # -> Target0, Target1
read_straus_geometry = ReadStrausGeometry(ModelPath=gate.Target1)  # -> Nodes, NodeNumbers, NodeIDs, Beams, BeamIDs, Plates, PlateIDs, Units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
bake_straus_geometry = BakeStrausGeometry(ModelPath=percorso_di_lavoro_cambia_per_importare, Bake=bake_bake_straus_geometry)
stato_export = Panel(st7_r3.Status)
label_file_originale = Panel(read_straus_geometry.NodeIDs)
id_oggetti_rhino_creati = Panel(bake_straus_geometry)
rapporto_import_controllare_omissioni = Panel(read_st7_model.Report)
numeri_e_label_originali = Panel(read_st7_model.IdentityMap)
