# Grasshopper definition 18_analisi_buckling.ghx (Grasshopper 1.0.8)
# plug-ins: Rhino2Straus
# Esempio autonomo Rhino2Straus. Geometrie interne; metri e kN. Leggere le note sul canvas e examples/README.md.

asse_trave_m = Curve(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)
incastro = Point(Point(0, 0, 0))
nodo_libero = Point(Point(4, 0, 0))
# 18 analisi buckling: Mensola compressa. Prima esegui statica; poi abilita il solver buckling che riceve Initial LSA dalla statica.
# Variable result case=1, Fixed result case=0. Il fattore critico moltiplica il carico di riferimento.
# Usa lo stesso modello di input nei due solver. Il cambio dei dati richiede una nuova statica. Le forme sono autovettori normalizzati.
# Unita': m, kN, kPa, tonne, C. Leggere gli input e i pannelli; valori dimostrativi modificabili.
database_steel = DatabaseSteel(Type=2)
frame_section_solid_rectangular = FrameSectionSolidRectangular(Height=0.3, Width=0.2)
frame_property = FrameProperty(Name="Beam", Section=frame_section_solid_rectangular, Material=database_steel)
frame_element = FrameElement(FrameLine=asse_trave_m, FrameProperty=frame_property, AngleDeg=0, Offset=Vector(0, 0, 0), FrameID=-1)
node_element = NodeElement(NodePoint=incastro, NodeID=-1)
support = Support(Node=node_element, Dx=True, Dy=True, Dz=True, Mx=True, My=True, Mz=True)
node_element_2 = NodeElement(NodePoint=nodo_libero, NodeID=-1)
load_case = LoadCase(Name="Q", GravityNSM=False)
load_nodal = LoadNodal(Node=node_element_2, LoadCase=load_case, Fx=-10, Fy=0, Fz=0, Mx=0, My=0, Mz=0)
build_model = BuildModel(Node=flatten([support, load_nodal]), FrameElement=flatten(frame_element), RenumberModels=True, PreserveNodes=False)
run_run_model_cases_and_combinations = BooleanToggle(False)
overwrite_run_model_cases_and_combinatio = BooleanToggle(False)  # "Overwrite / Run Model Cases and Combinations"
run_model_cases_and_combinations = RunModelCasesAndCombinations(
    Model=build_model,
    ModelPath="C:\Temp\Rhino2StrausExamples\18_static.st7",
    Run=run_run_model_cases_and_combinations,
    Overwrite=overwrite_run_model_cases_and_combinatio,
    RunCases=True,
    RunCombinations=True,
    Stations=11,
    Sample=1)  # -> Model, ResultPath, Status, Unavailable
gate = StreamGate(Stream=run_model_cases_and_combinations.Model, Gate=run_run_model_cases_and_combinations)  # -> Target0, Target1
run_run_model_linear_buckling = BooleanToggle(False)
overwrite_run_model_linear_buckling = BooleanToggle(False)
run_model_linear_buckling = RunModelLinearBuckling(
    Model=gate.Target1,
    ModelPath="C:\Temp\Rhino2StrausExamples\18_buckling.st7",
    Run=run_run_model_linear_buckling,
    Overwrite=overwrite_run_model_linear_buckling,
    InitialLSA=run_model_cases_and_combinations.ResultPath,
    VariableResultCase=1,
    FixedResultCase=0,
    Modes=3,
    Shift=0)  # -> Model, ResultPath, Status, Unavailable
gate_2 = StreamGate(Stream=run_model_linear_buckling.Model, Gate=run_run_model_linear_buckling)  # -> Target0, Target1
model_modal_and_buckling_data = ModelModalAndBucklingData(Model=gate_2.Target1)  # -> FrequencyHz, BucklingFactor, ModalData, ModalColumns
model_deformed_geometry = ModelDeformedGeometry(Model=gate_2.Target1, Case=1, Scale=1)  # -> Nodes, Beams, PlatesAndSolids

# ---- group: Controlla e decomponi il Model
validate_straus_model = ValidateStrausModel(Model=build_model)  # -> Valid, Errors, Warnings
model_summary = ModelSummary(Model=build_model)  # -> Nodes, Beams, Plates, Links, LoadCases, Combinations, Groups, Solids
decompose_model = DecomposeModel(Model=build_model)  # -> NodeElements, FrameElements, AreaElements, LinkElements, Solids, Materials, BeamSections, BeamProperties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
preflight_valido = Panel(validate_straus_model.Valid)
errori = Panel(validate_straus_model.Errors)
numero_nodi = Panel(model_summary.Nodes)
travi = Panel(model_summary.Beams)
piastre = Panel(model_summary.Plates)

# ---- group: Preview / sezioni / carichi / attributi / Brep
# Preview e bake: Preview ON/OFF spegne la visualizzazione gestita.
# Display Settings controlla sezioni, carichi, vincoli, offset e assi.
# Brep pronti: tasto destro > Bake. Il bake e' manuale.
# Le geometrie FEM e il Model restano disponibili anche con preview OFF.
preview_on_off = BooleanToggle(True)
display_settings = Rhino2StrausDisplaySettings(
    Enabled=preview_on_off,
    Nodes=True,
    Beams=True,
    Plates=True,
    Solids=True,
    Links=True,
    Sections=True,
    Loads=True,
    Supports=True,
    Releases=True,
    Springs=True,
    Masses=True,
    Prescribed=True,
    Offsets=True,
    Axes=True,
    Labels=False,
    Properties=False,
    Values=False,
    Results=False,
    Shaded=True,
    SymbolScale=0.3,
    LoadScale=0.06,
    Transparency=0.3)
rhino2straus = Rhino2StrausDisplayManager(
    Model=build_model,
    Solid=True,
    Labels=False,
    Axes=False,
    Supports=True,
    AxisScale=1,
    Color=RGB(50, 150, 190),
    Enabled=preview_on_off,
    Settings=display_settings,
    LoadScale=1,
    ManagePreviews=True,
    DisplayEnabled=True,
    DisplayLayers=73727)  # -> Status, AvailableCases, Settings, Legend, Breps, BrepIssues
brep_pronti_per_bake = Brep(rhino2straus.Breps)
problemi_brep = Panel(rhino2straus.BrepIssues)

# ----
stato_solver = Panel(run_model_cases_and_combinations.Status)
fattori_critici = Panel(model_modal_and_buckling_data.BucklingFactor)
