# Grasshopper definition 19_analisi_non_lineare.ghx (Grasshopper 1.0.8)
# plug-ins: Rhino2Straus
# Esempio autonomo Rhino2Straus. Geometrie interne; metri e kN. Leggere le note sul canvas e examples/README.md.

asse_trave_m = Curve(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)
incastro = Point(Point(0, 0, 0))
nodo_libero = Point(Point(4, 0, 0))
# 19 analisi non lineare: Analisi statica con non linearita' geometrica della mensola; Q viene applicato in dieci incrementi.
# Nonlinear geometry=True, materiale elastico. Non e' una legge plastica del materiale.
# Model Result Cases espone gli incrementi disponibili; leggere valori e diagrammi per il caso desiderato.
# Unita': m, kN, kPa, tonne, C. Leggere gli input e i pannelli; valori dimostrativi modificabili.
database_steel = DatabaseSteel(Type=2)
frame_section_solid_rectangular = FrameSectionSolidRectangular(Height=0.3, Width=0.2)
frame_property = FrameProperty(Name="Beam", Section=frame_section_solid_rectangular, Material=database_steel)
frame_element = FrameElement(FrameLine=asse_trave_m, FrameProperty=frame_property, AngleDeg=0, Offset=Vector(0, 0, 0), FrameID=-1)
node_element = NodeElement(NodePoint=incastro, NodeID=-1)
support = Support(Node=node_element, Dx=True, Dy=True, Dz=True, Mx=True, My=True, Mz=True)
node_element_2 = NodeElement(NodePoint=nodo_libero, NodeID=-1)
load_case = LoadCase(Name="Q", GravityNSM=False)
load_nodal = LoadNodal(Node=node_element_2, LoadCase=load_case, Fx=0, Fy=0, Fz=-10, Mx=0, My=0, Mz=0)
build_model = BuildModel(Node=flatten([support, load_nodal]), FrameElement=flatten(frame_element), RenumberModels=True, PreserveNodes=False)
run_run_model_nonlinear_static = BooleanToggle(False)
overwrite_run_model_nonlinear_static = BooleanToggle(False)
run_model_nonlinear_static = RunModelNonlinearStatic(
    Model=build_model,
    ModelPath="C:\Temp\Rhino2StrausExamples\19_nonlinear.st7",
    Run=run_run_model_nonlinear_static,
    Overwrite=overwrite_run_model_nonlinear_static,
    CaseName="Q",
    Steps=10,
    FinalFactor=1,
    NonlinearGeometry=True)  # -> Model, ResultPath, Status, Unavailable
gate = StreamGate(Stream=run_model_nonlinear_static.Model, Gate=run_run_model_nonlinear_static)  # -> Target0, Target1
model_result_cases = ModelResultCases(Model=gate.Target1)  # -> Numbers, Names, Secondary, Complete, ProvenanceVerified, Unavailable, Results
model_beam_actions_n_v_t_m = ModelBeamActionsNVTM(Model=gate.Target1, Case=0)  # -> N, V1, V2, T, M1, M2, Positions

# ---- group: Controlla e decomponi il Model
validate_straus_model = ValidateStrausModel(Model=run_model_nonlinear_static.Model)  # -> Valid, Errors, Warnings
model_summary = ModelSummary(Model=run_model_nonlinear_static.Model)  # -> Nodes, Beams, Plates, Links, LoadCases, Combinations, Groups, Solids
decompose_model = DecomposeModel(Model=run_model_nonlinear_static.Model)  # -> NodeElements, FrameElements, AreaElements, LinkElements, Solids, Materials, BeamSections, BeamProperties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
preflight_valido = Panel(validate_straus_model.Valid)
errori = Panel(validate_straus_model.Errors)
numero_nodi = Panel(model_summary.Nodes)
travi = Panel(model_summary.Beams)
piastre = Panel(model_summary.Plates)

# ---- group: Preview / sezioni / carichi / attributi / Brep
# Preview e bake: Preview ON/OFF spegne la visualizzazione gestita.
# Display Settings controlla sezioni, carichi, vincoli, offset e assi.
# Brep pronti: tasto destro > Bake. Il bake e' manuale.
# Le geometrie FEM e il Model restano disponibili anche con preview OFF.
preview_on_off = BooleanToggle(True)
display_settings = Rhino2StrausDisplaySettings(
    Enabled=preview_on_off,
    Nodes=True,
    Beams=True,
    Plates=True,
    Solids=True,
    Links=True,
    Sections=True,
    Loads=True,
    Supports=True,
    Releases=True,
    Springs=True,
    Masses=True,
    Prescribed=True,
    Offsets=True,
    Axes=True,
    Labels=False,
    Properties=False,
    Values=False,
    Results=False,
    Shaded=True,
    SymbolScale=0.3,
    LoadScale=0.06,
    Transparency=0.3)
rhino2straus = Rhino2StrausDisplayManager(
    Model=run_model_nonlinear_static.Model,
    Solid=True,
    Labels=False,
    Axes=False,
    Supports=True,
    AxisScale=1,
    Color=RGB(50, 150, 190),
    Enabled=preview_on_off,
    Settings=display_settings,
    LoadScale=1,
    ManagePreviews=True,
    DisplayEnabled=True,
    DisplayLayers=73727)  # -> Status, AvailableCases, Settings, Legend, Breps, BrepIssues
brep_pronti_per_bake = Brep(rhino2straus.Breps)
problemi_brep = Panel(rhino2straus.BrepIssues)

# ----
incrementi_risolti = Panel(model_result_cases.Names)
momenti_m2 = Panel(model_beam_actions_n_v_t_m.M2)
