# Grasshopper definition 20_risultati_nodi_travi_link.ghx (Grasshopper 1.0.8)
# plug-ins: Rhino2Straus
# Esempio autonomo Rhino2Straus. Geometrie interne; metri e kN. Leggere le note sul canvas e examples/README.md.

asse_trave_m = Curve(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)
incastro = Point(Point(0, 0, 0))
nodo_libero = Point(Point(4, 0, 0))
# 20 risultati nodi travi link: Tutti i lettori Model per nodi, travi e link. Prima avvia la statica.
# Case=0 legge tutti i casi; IDs vuoto legge tutti gli elementi. Records conserva caso, ID, numero nativo, assi, colonne e campionamento.
# Values usa rami per caso/elemento/superficie. Controlla Columns e Unavailable: una quantita' non disponibile non equivale a zero.
# Unita': m, kN, kPa, tonne, C. Leggere gli input e i pannelli; valori dimostrativi modificabili.
database_steel = DatabaseSteel(Type=2)
frame_section_solid_rectangular = FrameSectionSolidRectangular(Height=0.3, Width=0.2)
frame_property = FrameProperty(Name="Beam", Section=frame_section_solid_rectangular, Material=database_steel)
frame_element = FrameElement(FrameLine=asse_trave_m, FrameProperty=frame_property, AngleDeg=0, Offset=Vector(0, 0, 0), FrameID=-1)
node_element = NodeElement(NodePoint=incastro, NodeID=-1)
support = Support(Node=node_element, Dx=True, Dy=True, Dz=True, Mx=True, My=True, Mz=True)
node_element_2 = NodeElement(NodePoint=nodo_libero, NodeID=-1)
load_case = LoadCase(Name="Q", GravityNSM=False)
load_nodal = LoadNodal(Node=node_element_2, LoadCase=load_case, Fx=0, Fy=0, Fz=-10, Mx=0, My=0, Mz=0)
link_element = LinkElement(StartPoint=Point(4, 0, 0), EndPoint=Point(4, 0, 1), ID=-1)
build_model = BuildModel(
    Node=flatten([support, load_nodal]),
    FrameElement=flatten(frame_element),
    LinkElement=flatten(link_element),
    RenumberModels=True,
    PreserveNodes=False)
run_run_model_cases_and_combinations = BooleanToggle(False)
overwrite_run_model_cases_and_combinatio = BooleanToggle(False)  # "Overwrite / Run Model Cases and Combinations"
run_model_cases_and_combinations = RunModelCasesAndCombinations(
    Model=build_model,
    ModelPath="C:\Temp\Rhino2StrausExamples\20_risultati_nodi_travi_link.st7",
    Run=run_run_model_cases_and_combinations,
    Overwrite=overwrite_run_model_cases_and_combinatio,
    RunCases=True,
    RunCombinations=True,
    Stations=11,
    Sample=1)  # -> Model, ResultPath, Status, Unavailable
gate = StreamGate(Stream=run_model_cases_and_combinations.Model, Gate=run_run_model_cases_and_combinations)  # -> Target0, Target1
model_node_displacement = ModelNodeDisplacement(Model=gate.Target1, Case=0, Surface=-1)  # -> Values, Positions, Columns, AxesAndSampling, Records
decompose_result_record = DecomposeResultRecord(Record=model_node_displacement.Records)  # -> Case, EntityType, EntityID, NativeNumber, Quantity, Surface, Axes, Sampling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
model_node_reaction = ModelNodeReaction(Model=gate.Target1, Case=0, Surface=-1)  # -> Values, Positions, Columns, AxesAndSampling, Records
model_link_node_displacement = ModelLinkNodeDisplacement(Model=gate.Target1, Case=0, Surface=-1)  # -> Values, Positions, Columns, AxesAndSampling, Records
model_link_node_reaction = ModelLinkNodeReaction(Model=gate.Target1, Case=0, Surface=-1)  # -> Values, Positions, Columns, AxesAndSampling, Records
model_beam_displacement = ModelBeamDisplacement(Model=gate.Target1, Case=0, Surface=-1)  # -> Values, Positions, Columns, AxesAndSampling, Records
model_beam_force = ModelBeamForce(Model=gate.Target1, Case=0, Surface=-1)  # -> Values, Positions, Columns, AxesAndSampling, Records
model_beam_node_reaction = ModelBeamNodeReaction(Model=gate.Target1, Case=0, Surface=-1)  # -> Values, Positions, Columns, AxesAndSampling, Records
model_beam_strain = ModelBeamStrain(Model=gate.Target1, Case=0, Surface=-1)  # -> Values, Positions, Columns, AxesAndSampling, Records
model_beam_stress = ModelBeamStress(Model=gate.Target1, Case=0, Surface=-1)  # -> Values, Positions, Columns, AxesAndSampling, Records
model_beam_total_strain = ModelBeamTotalStrain(Model=gate.Target1, Case=0, Surface=-1)  # -> Values, Positions, Columns, AxesAndSampling, Records
model_native_beam_sections = ModelNativeBeamSections(Model=gate.Target1)  # -> Sections, PropertyIDs
decompose_native_beam_section = DecomposeNativeBeamSection(Section=model_native_beam_sections.Sections)  # -> PropertyID, NativeProperty, Area, I11, I22, J, ShearArea1, ShearArea2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
model_verification_data = ModelVerificationData(Model=gate.Target1, RequireProvenance=True)  # -> Elements, Properties, Materials, Results, Units, Unavailable, NativeSections

# ---- group: Controlla e decomponi il Model
validate_straus_model = ValidateStrausModel(Model=run_model_cases_and_combinations.Model)  # -> Valid, Errors, Warnings
model_summary = ModelSummary(Model=run_model_cases_and_combinations.Model)  # -> Nodes, Beams, Plates, Links, LoadCases, Combinations, Groups, Solids
decompose_model = DecomposeModel(Model=run_model_cases_and_combinations.Model)  # -> NodeElements, FrameElements, AreaElements, LinkElements, Solids, Materials, BeamSections, BeamProperties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
preflight_valido = Panel(validate_straus_model.Valid)
errori = Panel(validate_straus_model.Errors)
numero_nodi = Panel(model_summary.Nodes)
travi = Panel(model_summary.Beams)
piastre = Panel(model_summary.Plates)

# ---- group: Preview / sezioni / carichi / attributi / Brep
# Preview e bake: Preview ON/OFF spegne la visualizzazione gestita.
# Display Settings controlla sezioni, carichi, vincoli, offset e assi.
# Brep pronti: tasto destro > Bake. Il bake e' manuale.
# Le geometrie FEM e il Model restano disponibili anche con preview OFF.
preview_on_off = BooleanToggle(True)
display_settings = Rhino2StrausDisplaySettings(
    Enabled=preview_on_off,
    Nodes=True,
    Beams=True,
    Plates=True,
    Solids=True,
    Links=True,
    Sections=True,
    Loads=True,
    Supports=True,
    Releases=True,
    Springs=True,
    Masses=True,
    Prescribed=True,
    Offsets=True,
    Axes=True,
    Labels=False,
    Properties=False,
    Values=False,
    Results=False,
    Shaded=True,
    SymbolScale=0.3,
    LoadScale=0.06,
    Transparency=0.3)
rhino2straus = Rhino2StrausDisplayManager(
    Model=run_model_cases_and_combinations.Model,
    Solid=True,
    Labels=False,
    Axes=False,
    Supports=True,
    AxisScale=1,
    Color=RGB(50, 150, 190),
    Enabled=preview_on_off,
    Settings=display_settings,
    LoadScale=1,
    ManagePreviews=True,
    DisplayEnabled=True,
    DisplayLayers=73727)  # -> Status, AvailableCases, Settings, Legend, Breps, BrepIssues
brep_pronti_per_bake = Brep(rhino2straus.Breps)
problemi_brep = Panel(rhino2straus.BrepIssues)

# ----
stato_solver = Panel(run_model_cases_and_combinations.Status)
colonne_model_node_displacement = Panel(model_node_displacement.Columns)
valori_model_node_displacement = Panel(model_node_displacement.Values)
id_nel_model = Panel(decompose_result_record.EntityID)
colonne_model_link_node_reaction = Panel(model_link_node_reaction.Columns)
valori_model_link_node_reaction = Panel(model_link_node_reaction.Values)
colonne_model_beam_node_reaction = Panel(model_beam_node_reaction.Columns)
valori_model_beam_node_reaction = Panel(model_beam_node_reaction.Values)
colonne_model_beam_total_strain = Panel(model_beam_total_strain.Columns)
valori_model_beam_total_strain = Panel(model_beam_total_strain.Values)
area_effettivamente_usata_dal_solver = Panel(decompose_native_beam_section.Area)
colonne_model_node_reaction = Panel(model_node_reaction.Columns)
valori_model_node_reaction = Panel(model_node_reaction.Values)
colonne_model_beam_displacement = Panel(model_beam_displacement.Columns)
valori_model_beam_displacement = Panel(model_beam_displacement.Values)
colonne_model_beam_strain = Panel(model_beam_strain.Columns)
valori_model_beam_strain = Panel(model_beam_strain.Values)
dati_mancanti_per_verifica = Panel(model_verification_data.Unavailable)
colonne_model_link_node_displacement = Panel(model_link_node_displacement.Columns)
valori_model_link_node_displacement = Panel(model_link_node_displacement.Values)
colonne_model_beam_force = Panel(model_beam_force.Columns)
valori_model_beam_force = Panel(model_beam_force.Values)
colonne_model_beam_stress = Panel(model_beam_stress.Columns)
valori_model_beam_stress = Panel(model_beam_stress.Values)
