# Grasshopper definition 21_risultati_piastre_solidi.ghx (Grasshopper 1.0.8)
# plug-ins: Rhino2Straus
# Esempio autonomo Rhino2Straus. Geometrie interne; metri e kN. Leggere le note sul canvas e examples/README.md.

piastra = Mesh(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)
hexa8 = Point([Point(4, 0, 0), Point(5, 0, 0), Point(5, 1, 0), Point(4, 1, 0), Point(4, 0, 1), Point(5, 0, 1), Point(5, 1, 1), Point(4, 1, 1)])
appoggi = Point([Point(0, 0, 0), Point(2, 0, 0), Point(2, 2, 0), Point(0, 2, 0), Point(4, 0, 0), Point(5, 0, 0), Point(5, 1, 0), Point(4, 1, 0)])
# 21 risultati piastre solidi: Model misto: una piastra Quad4 e un Hexa8 con appoggi e pressione.
# Lettura di forze, momenti, curvature, tensioni, deformazioni, reazioni e spostamenti nodali per elemento.
# Le famiglie di risultati seguono i campionamenti e gli assi dichiarati nei Records. Controlla il lato/superficie delle piastre.
# Unita': m, kN, kPa, tonne, C. Leggere gli input e i pannelli; valori dimostrativi modificabili.
database_concrete = DatabaseConcrete(Type=4)
area_thickness = AreaThickness(Thickness=0.2)
area_property = AreaProperty(Name="Plate", Section=area_thickness, Material=database_concrete, Type=0)
area_element = AreaElement(Area=piastra, AreaProperty=area_property, AngleDeg=0, Offset=0, AreaID=-1)
load_case = LoadCase(Name="P", GravityNSM=False)
plate_global_pressure = PlateGlobalPressure(Plate=area_element, LoadCase=load_case, Pressure=Vector(0, 0, -5), TopFace=True, Projected=False)
node_element = NodeElement(NodePoint=hexa8, NodeID=-1)
database_concrete_2 = DatabaseConcrete(Type=4)
solid_element = SolidElement(Nodes=node_element, Material=database_concrete_2, ID=-1)
solid_face_pressure = SolidFacePressure(Solid=solid_element, LoadCase=load_case, Face=1, Pressure=5)
node_element_2 = NodeElement(NodePoint=appoggi, NodeID=-1)
support = Support(Node=node_element_2, Dx=True, Dy=True, Dz=True, Mx=True, My=True, Mz=True)
build_model = BuildModel(
    Node=flatten(support),
    AreaElement=flatten(plate_global_pressure),
    Solids=flatten(solid_face_pressure),
    RenumberModels=True,
    PreserveNodes=False)
run_run_model_cases_and_combinations = BooleanToggle(False)
overwrite_run_model_cases_and_combinatio = BooleanToggle(False)  # "Overwrite / Run Model Cases and Combinations"
run_model_cases_and_combinations = RunModelCasesAndCombinations(
    Model=build_model,
    ModelPath="C:\Temp\Rhino2StrausExamples\21_risultati_piastre_solidi.st7",
    Run=run_run_model_cases_and_combinations,
    Overwrite=overwrite_run_model_cases_and_combinatio,
    RunCases=True,
    RunCombinations=True,
    Stations=11,
    Sample=1)  # -> Model, ResultPath, Status, Unavailable
gate = StreamGate(Stream=run_model_cases_and_combinations.Model, Gate=run_run_model_cases_and_combinations)  # -> Target0, Target1
model_plate_curvature = ModelPlateCurvature(Model=gate.Target1, Case=0, Surface=-1)  # -> Values, Positions, Columns, AxesAndSampling, Records
decompose_result_record = DecomposeResultRecord(Record=model_plate_curvature.Records)  # -> Case, EntityType, EntityID, NativeNumber, Quantity, Surface, Axes, Sampling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
model_plate_force = ModelPlateForce(Model=gate.Target1, Case=0, Surface=-1)  # -> Values, Positions, Columns, AxesAndSampling, Records
model_plate_moment = ModelPlateMoment(Model=gate.Target1, Case=0, Surface=-1)  # -> Values, Positions, Columns, AxesAndSampling, Records
model_plate_node_displacement = ModelPlateNodeDisplacement(Model=gate.Target1, Case=0, Surface=-1)  # -> Values, Positions, Columns, AxesAndSampling, Records
model_plate_node_reaction = ModelPlateNodeReaction(Model=gate.Target1, Case=0, Surface=-1)  # -> Values, Positions, Columns, AxesAndSampling, Records
model_plate_strain = ModelPlateStrain(Model=gate.Target1, Case=0, Surface=-1)  # -> Values, Positions, Columns, AxesAndSampling, Records
model_plate_stress = ModelPlateStress(Model=gate.Target1, Case=0, Surface=-1)  # -> Values, Positions, Columns, AxesAndSampling, Records
model_plate_total_strain = ModelPlateTotalStrain(Model=gate.Target1, Case=0, Surface=-1)  # -> Values, Positions, Columns, AxesAndSampling, Records
model_solid_node_displacement = ModelSolidNodeDisplacement(Model=gate.Target1, Case=0, Surface=-1)  # -> Values, Positions, Columns, AxesAndSampling, Records
model_solid_node_reaction = ModelSolidNodeReaction(Model=gate.Target1, Case=0, Surface=-1)  # -> Values, Positions, Columns, AxesAndSampling, Records
model_solid_strain = ModelSolidStrain(Model=gate.Target1, Case=0, Surface=-1)  # -> Values, Positions, Columns, AxesAndSampling, Records
model_solid_stress = ModelSolidStress(Model=gate.Target1, Case=0, Surface=-1)  # -> Values, Positions, Columns, AxesAndSampling, Records
model_solid_total_strain = ModelSolidTotalStrain(Model=gate.Target1, Case=0, Surface=-1)  # -> Values, Positions, Columns, AxesAndSampling, Records

# ---- group: Controlla e decomponi il Model
validate_straus_model = ValidateStrausModel(Model=run_model_cases_and_combinations.Model)  # -> Valid, Errors, Warnings
model_summary = ModelSummary(Model=run_model_cases_and_combinations.Model)  # -> Nodes, Beams, Plates, Links, LoadCases, Combinations, Groups, Solids
decompose_model = DecomposeModel(Model=run_model_cases_and_combinations.Model)  # -> NodeElements, FrameElements, AreaElements, LinkElements, Solids, Materials, BeamSections, BeamProperties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
preflight_valido = Panel(validate_straus_model.Valid)
errori = Panel(validate_straus_model.Errors)
numero_nodi = Panel(model_summary.Nodes)
travi = Panel(model_summary.Beams)
piastre = Panel(model_summary.Plates)

# ---- group: Preview / sezioni / carichi / attributi / Brep
# Preview e bake: Preview ON/OFF spegne la visualizzazione gestita.
# Display Settings controlla sezioni, carichi, vincoli, offset e assi.
# Brep pronti: tasto destro > Bake. Il bake e' manuale.
# Le geometrie FEM e il Model restano disponibili anche con preview OFF.
preview_on_off = BooleanToggle(True)
display_settings = Rhino2StrausDisplaySettings(
    Enabled=preview_on_off,
    Nodes=True,
    Beams=True,
    Plates=True,
    Solids=True,
    Links=True,
    Sections=True,
    Loads=True,
    Supports=True,
    Releases=True,
    Springs=True,
    Masses=True,
    Prescribed=True,
    Offsets=True,
    Axes=True,
    Labels=False,
    Properties=False,
    Values=False,
    Results=False,
    Shaded=True,
    SymbolScale=0.3,
    LoadScale=0.06,
    Transparency=0.3)
rhino2straus = Rhino2StrausDisplayManager(
    Model=run_model_cases_and_combinations.Model,
    Solid=True,
    Labels=False,
    Axes=False,
    Supports=True,
    AxisScale=1,
    Color=RGB(50, 150, 190),
    Enabled=preview_on_off,
    Settings=display_settings,
    LoadScale=1,
    ManagePreviews=True,
    DisplayEnabled=True,
    DisplayLayers=73727)  # -> Status, AvailableCases, Settings, Legend, Breps, BrepIssues
brep_pronti_per_bake = Brep(rhino2straus.Breps)
problemi_brep = Panel(rhino2straus.BrepIssues)

# ----
stato_solver = Panel(run_model_cases_and_combinations.Status)
colonne_model_plate_curvature = Panel(model_plate_curvature.Columns)
valori_model_plate_curvature = Panel(model_plate_curvature.Values)
id_nel_model = Panel(decompose_result_record.EntityID)
colonne_model_plate_node_displacement = Panel(model_plate_node_displacement.Columns)
valori_model_plate_node_displacement = Panel(model_plate_node_displacement.Values)
colonne_model_plate_stress = Panel(model_plate_stress.Columns)
valori_model_plate_stress = Panel(model_plate_stress.Values)
colonne_model_solid_node_reaction = Panel(model_solid_node_reaction.Columns)
valori_model_solid_node_reaction = Panel(model_solid_node_reaction.Values)
colonne_model_solid_total_strain = Panel(model_solid_total_strain.Columns)
valori_model_solid_total_strain = Panel(model_solid_total_strain.Values)
colonne_model_plate_force = Panel(model_plate_force.Columns)
valori_model_plate_force = Panel(model_plate_force.Values)
colonne_model_plate_node_reaction = Panel(model_plate_node_reaction.Columns)
valori_model_plate_node_reaction = Panel(model_plate_node_reaction.Values)
colonne_model_plate_total_strain = Panel(model_plate_total_strain.Columns)
valori_model_plate_total_strain = Panel(model_plate_total_strain.Values)
colonne_model_solid_strain = Panel(model_solid_strain.Columns)
valori_model_solid_strain = Panel(model_solid_strain.Values)
colonne_model_plate_moment = Panel(model_plate_moment.Columns)
valori_model_plate_moment = Panel(model_plate_moment.Values)
colonne_model_plate_strain = Panel(model_plate_strain.Columns)
valori_model_plate_strain = Panel(model_plate_strain.Values)
colonne_model_solid_node_displacement = Panel(model_solid_node_displacement.Columns)
valori_model_solid_node_displacement = Panel(model_solid_node_displacement.Values)
colonne_model_solid_stress = Panel(model_solid_stress.Columns)
valori_model_solid_stress = Panel(model_solid_stress.Values)
