# Grasshopper definition 22_file_esistenti_solver_risultati.ghx (Grasshopper 1.0.8)
# plug-ins: Rhino2Straus
# Esempio autonomo Rhino2Straus. Geometrie interne; metri e kN. Leggere le note sul canvas e examples/README.md.

# 22 file esistenti solver risultati: Lettori diretti di file Straus: .st7 e risultati gia' calcolati (.LSA / .NFA / .LBA / .NLA).
# Scegli file corrispondenti e numeri nativi degli elementi, non le label. Leggi=True apre i lettori; non avvia un solver.
# La zona inferiore mostra i solver su file esistente, con pulsanti separati. Non sovrascrivere un file di produzione per provare l'esempio.
# La geometria deformata usa punti e spostamenti con la stessa sequenza di numeri nodo.
# Unita': m, kN, kPa, tonne, C. Leggere gli input e i pannelli; valori dimostrativi modificabili.
leggi_risultati_esistenti_api = BooleanToggle(False)
run_run_linear_static = BooleanToggle(False)
overwrite_results_run_linear_static = BooleanToggle(False)
run_run_natural_frequency = BooleanToggle(False)
overwrite_results_run_natural_frequency = BooleanToggle(False)
run_run_linear_buckling = BooleanToggle(False)
overwrite_results_run_linear_buckling = BooleanToggle(False)
run_run_nonlinear_static = BooleanToggle(False)
overwrite_results_run_nonlinear_static = BooleanToggle(False)
modello_esistente = Panel("C:\Temp\model.st7")
gate = StreamGate(Stream=modello_esistente, Gate=leggi_risultati_esistenti_api)  # -> Target0, Target1
read_straus_geometry = ReadStrausGeometry(ModelPath=gate.Target1)  # -> Nodes, NodeNumbers, NodeIDs, Beams, BeamIDs, Plates, PlateIDs, Units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
run_linear_static = RunLinearStatic(ModelPath=modello_esistente, Run=run_run_linear_static, OverwriteResults=overwrite_results_run_linear_static)  # -> ResultPath, Status
run_natural_frequency = RunNaturalFrequency(
    ModelPath=modello_esistente,
    Run=run_run_natural_frequency,
    OverwriteResults=overwrite_results_run_natural_frequency,
    Modes=10,
    ShiftHz=0)  # -> ResultPath, Status
run_nonlinear_static = RunNonlinearStatic(
    ModelPath=modello_esistente,
    Run=run_run_nonlinear_static,
    OverwriteResults=overwrite_results_run_nonlinear_static,
    LoadCase=1,
    Steps=10,
    FinalFactor=1,
    GeometricNonlinear=True,
    MaterialNonlinear=False)  # -> ResultPath, Status
# Campionamento e identificazione: I file statici devono contenere gli elementi richiesti. Sostituire 1 negli input Beam/Plate/Solid number.
# Inviluppo aggrega i rami forniti: collegare piu' casi per confrontare carichi diversi.
# Se il file non contiene piastre o solidi, usare soltanto i lettori della famiglia presente.
risultato_statico = Panel("C:\Temp\model.LSA")
gate_2 = StreamGate(Stream=risultato_statico, Gate=leggi_risultati_esistenti_api)  # -> Target0, Target1
straus_result_cases = StrausResultCases(ModelPath=gate.Target1, ResultPath=gate_2.Target1)  # -> Numbers, Names
node_displacements = NodeDisplacements(ModelPath=gate.Target1, ResultPath=gate_2.Target1, Case=1, NodeNumbers=read_straus_geometry.NodeNumbers)  # -> Translation, Rotation, Magnitude
node_reactions = NodeReactions(ModelPath=gate.Target1, ResultPath=gate_2.Target1, Case=1, NodeNumbers=1)  # -> Force, Moment, Magnitude
beam_forces = BeamForces(ModelPath=gate.Target1, ResultPath=gate_2.Target1, Case=1, BeamNumber=1, Stations=11)  # -> Position, N, V1, V2, T, M1, M2
result_envelope = ResultEnvelope(Cases=beam_forces.M2)  # -> Minimum, Maximum, MinBranch, MaxBranch
beam_stress = BeamStress(ModelPath=gate.Target1, ResultPath=gate_2.Target1, Case=1, BeamNumber=1, Stations=11)  # -> Position, Values
beam_displacements = BeamDisplacements(ModelPath=gate.Target1, ResultPath=gate_2.Target1, Case=1, BeamNumber=1, Stations=11)  # -> Position, Values
plate_forces = PlateForces(ModelPath=gate.Target1, ResultPath=gate_2.Target1, Case=1, PlateNumber=1, Surface=0, Sample=0)  # -> Values, Samples, Columns
plate_moments = PlateMoments(ModelPath=gate.Target1, ResultPath=gate_2.Target1, Case=1, PlateNumber=1, Surface=0, Sample=0)  # -> Values, Samples, Columns
plate_stress = PlateStress(ModelPath=gate.Target1, ResultPath=gate_2.Target1, Case=1, PlateNumber=1, Surface=0, Sample=0)  # -> Values, Samples, Columns
solid_strain = SolidStrain(ModelPath=gate.Target1, ResultPath=gate_2.Target1, Case=1, SolidNumber=1, Sample=0, Combined=False)
solid_stress = SolidStress(ModelPath=gate.Target1, ResultPath=gate_2.Target1, Case=1, SolidNumber=1, Sample=0, Combined=False)
deformed_nodes = DeformedNodes(Points=read_straus_geometry.Nodes, Displacements=node_displacements.Translation, Scale=1)
run_linear_buckling = RunLinearBuckling(
    ModelPath=modello_esistente,
    Run=run_run_linear_buckling,
    OverwriteResults=overwrite_results_run_linear_buckling,
    Modes=10,
    InitialResults=risultato_statico,
    VariableCase=1,
    FixedCase=0,
    Shift=0)  # -> ResultPath, Status
risultato_modale = Panel("C:\Temp\model.NFA")
gate_3 = StreamGate(Stream=risultato_modale, Gate=leggi_risultati_esistenti_api)  # -> Target0, Target1
modal_frequencies = ModalFrequencies(ModelPath=gate.Target1, ResultPath=gate_3.Target1)  # -> FrequencyHz, ModalMass, Values
risultato_buckling = Panel("C:\Temp\model.LBA")
gate_4 = StreamGate(Stream=risultato_buckling, Gate=leggi_risultati_esistenti_api)  # -> Target0, Target1
buckling_factors = BucklingFactors(ModelPath=gate.Target1, ResultPath=gate_4.Target1)
stato_run_linear_static = Panel(run_linear_static.Status)
valori_straus_result_cases = Panel(straus_result_cases.Numbers)
valori_beam_forces = Panel(beam_forces.Position)
inviluppo_dei_rami_m2 = Panel(result_envelope.Maximum)
valori_plate_forces = Panel(plate_forces.Values)
valori_solid_strain = Panel(solid_strain)
frequenze = Panel(modal_frequencies.FrequencyHz)
fattori = Panel(buckling_factors)
stato_run_natural_frequency = Panel(run_natural_frequency.Status)
valori_node_displacements = Panel(node_displacements.Translation)
valori_beam_stress = Panel(beam_stress.Position)
valori_plate_moments = Panel(plate_moments.Values)
valori_solid_stress = Panel(solid_stress)
stato_run_linear_buckling = Panel(run_linear_buckling.Status)
valori_node_reactions = Panel(node_reactions.Force)
valori_beam_displacements = Panel(beam_displacements.Position)
valori_plate_stress = Panel(plate_stress.Values)
stato_run_nonlinear_static = Panel(run_nonlinear_static.Status)
