# Grasshopper definition FEM_01_Straus_Mensola.ghx (Grasshopper 1.0.8)
# plug-ins: Rhino2Straus
# Modifica L, b, h e Fz. Coordinate in metri, forze in kN. Segui i gruppi da sinistra a destra.
# Il Model contiene una mensola incastrata e il carico LC1; la preview funziona senza aprire Straus7.

# ---- group: 01 PARAMETRI
l_m = Slider(3, range=1..10)
h_m = Slider(0.3, range=0.1..0.8)
b_m = Slider(0.2, range=0.1..0.6)
fz_kn = Slider(-10, range=-100..0)

# ---- group: 02 GEOMETRIA E PROPRIETA
# 01 / STRAUS7 - Mensola parametrica: Modifica L, b, h e Fz. Coordinate in metri, forze in kN. Segui i gruppi da sinistra a destra.
# Il Model contiene una mensola incastrata e il carico LC1; la preview funziona senza aprire Straus7.
A = ConstructPoint(XCoordinate=0, YCoordinate=0, ZCoordinate=0)
B = ConstructPoint(XCoordinate=l_m, YCoordinate=0, ZCoordinate=0)
asse = Line(StartPoint=A, EndPoint=B)
material = Material(
    Name="Steel",
    Type=0,
    ModulusElasticity=210000000,
    PoissonRatio=0.3,
    ThermalCoefficent=1.17e-05,
    Density=7.849,
    DampingRatio=0.02)
frame_section_solid_rectangular = FrameSectionSolidRectangular(Name="R200x300", Height=h_m, Width=b_m)
frame_property = FrameProperty(Name="S1", Section=frame_section_solid_rectangular, Material=material)
frame_element = FrameElement(FrameLine=asse, FrameProperty=frame_property, AngleDeg=0, Offset=Vector(0, 0, 0), FrameID=1)

# ---- group: 03 VINCOLI E CARICO
incastro_6_dof = BooleanToggle(True)
node_element = NodeElement(NodePoint=A, NodeID=1)
node_element_2 = NodeElement(NodePoint=B, NodeID=2)
support = Support(
    Node=node_element,
    Dx=incastro_6_dof,
    Dy=incastro_6_dof,
    Dz=incastro_6_dof,
    Mx=incastro_6_dof,
    My=incastro_6_dof,
    Mz=incastro_6_dof)
load_case = LoadCase(Name="LC1", GravityNSM=False)
load_nodal = LoadNodal(Node=node_element_2, LoadCase=load_case, Fx=0, Fy=0, Fz=fz_kn, Mx=0, My=0, Mz=0)

# ---- group: 04 MODELLO
model_units = ModelUnits(Length=2, Force=1, Temperature=0, Heat=0, Tolerance=0.001)
build_model = BuildModel(Unit=model_units, Node=[support, load_nodal], FrameElement=frame_element, RenumberModels=True)

# ---- group: 05 CONTROLLI, PREVIEW E GEOMETRIA
validate_straus_model = ValidateStrausModel(Model=build_model)  # -> Valid, Errors, Warnings
model_summary = ModelSummary(Model=build_model)  # -> Nodes, Beams, Plates, Links, LoadCases, Combinations, Groups, Solids
display_settings = Rhino2StrausDisplaySettings(
    Enabled=True,
    Nodes=True,
    Beams=True,
    Plates=True,
    Solids=True,
    Links=True,
    Sections=True,
    Loads=True,
    Supports=True,
    Releases=True,
    Springs=True,
    Masses=True,
    Prescribed=True,
    Offsets=True,
    Axes=False,
    Labels=False,
    Properties=False,
    Values=True,
    Results=False,
    Shaded=True,
    SymbolScale=1,
    LoadScale=1,
    Transparency=0.3)
rhino2straus = Rhino2StrausDisplayManager(
    Model=build_model,
    Solid=True,
    Labels=False,
    Axes=False,
    Supports=True,
    AxisScale=1,
    Color=RGB(50, 150, 190),
    Enabled=True,
    Settings=display_settings,
    LoadScale=1,
    ManagePreviews=True,
    DisplayEnabled=True,
    DisplayLayers=73727)  # -> Status, AvailableCases, Settings, Legend, Breps, BrepIssues
model_physical_geometry = ModelPhysicalGeometry(Model=build_model)  # -> BeamSolids, PlateSolids, Centerlines, Solids, Breps, BrepIssues
decompose_model = DecomposeModel(Model=build_model)  # -> NodeElements, FrameElements, AreaElements, LinkElements, Solids, Materials, BeamSections, BeamProperties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
deconstruct_beam = DeconstructBeam(Beam=decompose_model.FrameElements)  # -> ID, Line, Property, Length, Angle, Offset, Groups
validazione = Panel(validate_straus_model.Valid)
riepilogo_modello = Panel(model_summary.Nodes)
