# Grasshopper definition 01_Frame_polilinea.ghx (Grasshopper 1.0.8)
# plug-ins: Rhino2Straus
# Una polilinea genera tre elementi di un portale 4 x 3 m. Materiale e sezione si propagano agli elementi. Cambia b e h e controlla nodi, elementi e solidi.

# ---- group: 01 | INPUT E ISTRUZIONI
# COME USARE: Una polilinea genera tre elementi di un portale 4 x 3 m. Materiale e sezione si propagano agli elementi. Cambia b e h e controlla nodi, elementi e solidi.
polilinea_portale = Curve(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)
h_m = Slider(0.3, range=0.1..0.8)
b_m = Slider(0.2, range=0.05..0.6)

# ---- group: 02 | PROPRIETA / GEOMETRIA
# Frame, materiali e sezioni: Rhino2Straus | Frame, materiali e sezioni
# Una polilinea genera tre elementi di un portale 4 x 3 m. Materiale e sezione si propagano agli elementi. Cambia b e h e controlla nodi, elementi e solidi.
# Unita: kN / m / C. Geometrie incorporate. Le combinazioni sono didattiche.
material = Material(
    Name="S355_DEMO",
    Type=0,
    ModulusElasticity=210000000,
    PoissonRatio=0.3,
    ThermalCoefficent=1.17e-05,
    Density=7.849,
    DampingRatio=0.02)
frame_section_solid_rectangular = FrameSectionSolidRectangular(Name="R200x300", Height=h_m, Width=b_m)
frame_property = FrameProperty(Name="R200x300", Section=frame_section_solid_rectangular, Material=material)
node_element = NodeElement(NodePoint=Point(0, 0, 0), NodeID=100)
node_element_2 = NodeElement(NodePoint=Point(4, 0, 0), NodeID=101)

# ---- group: 03 | ATTRIBUTI / CARICHI
polyline_to_beams = PolylineToBeams(Polyline=polilinea_portale, Property=frame_property, FirstID=1)
support = Support(Node=node_element, Dx=True, Dy=True, Dz=True, Mx=True, My=True, Mz=True)
support_2 = Support(Node=node_element_2, Dx=True, Dy=True, Dz=True, Mx=True, My=True, Mz=True)

# ---- group: 04 | MODEL / OPERAZIONI
build_model = BuildModel(
    Node=flatten([support, node_element_2, support_2]),
    FrameElement=flatten(polyline_to_beams),
    RenumberModels=True,
    PreserveNodes=False)

# ---- group: 05 | VERIFICA / LETTURA
validate_straus_model = ValidateStrausModel(Model=build_model)  # -> Valid, Errors, Warnings
model_summary = ModelSummary(Model=build_model)  # -> Nodes, Beams, Plates, Links, LoadCases, Combinations, Groups, Solids
rhino2straus = Rhino2StrausDisplayManager(
    Model=build_model,
    Solid=True,
    Labels=False,
    Axes=False,
    Supports=True,
    AxisScale=1,
    Color=RGB(50, 150, 190),
    Enabled=True,
    LoadScale=1,
    ManagePreviews=True,
    DisplayEnabled=True,
    DisplayLayers=73727)  # -> Status, AvailableCases, Settings, Legend, Breps, BrepIssues
decompose_model = DecomposeModel(Model=build_model)  # -> NodeElements, FrameElements, AreaElements, LinkElements, Solids, Materials, BeamSections, BeamProperties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
model_physical_geometry = ModelPhysicalGeometry(Model=build_model)  # -> BeamSolids, PlateSolids, Centerlines, Solids, Breps, BrepIssues
valido_dati_e_riferimenti = Panel(validate_straus_model.Valid)
riepilogo = Panel(model_summary.Nodes)
