# Grasshopper definition 02_Mesh_quad.ghx (Grasshopper 1.0.8)
# plug-ins: Rhino2Straus
# Piastra 4 x 3 m: 9 nodi, 4 facce Quad4, spessore 0.20 m. Pressione -5 kN/m2 in Z globale e bordo incastrato. La discretizzazione serve a illustrare il flusso.

# ---- group: 01 | INPUT E ISTRUZIONI
# COME USARE: Piastra 4 x 3 m: 9 nodi, 4 facce Quad4, spessore 0.20 m. Pressione -5 kN/m2 in Z globale e bordo incastrato. La discretizzazione serve a illustrare il flusso.
mesh_incorporata = Mesh(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)
spessore_t_m = Slider(0.2, range=0.05..0.5)

# ---- group: 02 | PROPRIETA / GEOMETRIA
# Mesh quadrangolare e pressione: Rhino2Straus | Mesh quadrangolare e pressione
# Piastra 4 x 3 m: 9 nodi, 4 facce Quad4, spessore 0.20 m. Pressione -5 kN/m2 in Z globale e bordo incastrato. La discretizzazione serve a illustrare il flusso.
# Unita: kN / m / C. Geometrie incorporate. Le combinazioni sono didattiche.
material = Material(
    Name="C30_DEMO",
    Type=0,
    ModulusElasticity=30000000,
    PoissonRatio=0.2,
    ThermalCoefficent=1.17e-05,
    Density=2.55,
    DampingRatio=0.02)
area_thickness = AreaThickness(Name="Shell20", Thickness=spessore_t_m)
area_property = AreaProperty(Name="Plate", Section=area_thickness, Material=material, Type=0)
node_element = NodeElement(
    NodePoint=[Point(0, 0, 0), Point(2, 0, 0), Point(4, 0, 0), Point(0, 1.5, 0), Point(4, 1.5, 0), Point(0, 3, 0), Point(2, 3, 0), Point(4, 3, 0)],
    NodeID=[100, 101, 102, 103, 104, 105, 106, 107])
load_case = LoadCase(Name="Q", GravityNSM=False)

# ---- group: 03 | ATTRIBUTI / CARICHI
mesh_to_plates = MeshToPlates(Mesh=mesh_incorporata, Property=area_property, FirstID=-1)
support = Support(Node=node_element, Dx=True, Dy=True, Dz=True, Mx=True, My=True, Mz=True)
plate_global_pressure = PlateGlobalPressure(Plate=mesh_to_plates, LoadCase=load_case, Pressure=Vector(0, 0, -5), TopFace=True, Projected=False)

# ---- group: 04 | MODEL / OPERAZIONI
build_model = BuildModel(Node=flatten(support), AreaElement=flatten(plate_global_pressure), RenumberModels=True, PreserveNodes=False)

# ---- group: 05 | VERIFICA / LETTURA
validate_straus_model = ValidateStrausModel(Model=build_model)  # -> Valid, Errors, Warnings
model_summary = ModelSummary(Model=build_model)  # -> Nodes, Beams, Plates, Links, LoadCases, Combinations, Groups, Solids
rhino2straus = Rhino2StrausDisplayManager(
    Model=build_model,
    Solid=True,
    Labels=False,
    Axes=False,
    Supports=True,
    AxisScale=1,
    Color=RGB(50, 150, 190),
    Enabled=True,
    LoadScale=1,
    ManagePreviews=True,
    DisplayEnabled=True,
    DisplayLayers=73727)  # -> Status, AvailableCases, Settings, Legend, Breps, BrepIssues
decompose_model = DecomposeModel(Model=build_model)  # -> NodeElements, FrameElements, AreaElements, LinkElements, Solids, Materials, BeamSections, BeamProperties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
model_physical_geometry = ModelPhysicalGeometry(Model=build_model)  # -> BeamSolids, PlateSolids, Centerlines, Solids, Breps, BrepIssues
valido_dati_e_riferimenti = Panel(validate_straus_model.Valid)
riepilogo = Panel(model_summary.Nodes)
