# Grasshopper definition 04_Solidi.ghx (Grasshopper 1.0.8)
# plug-ins: Rhino2Straus
# Un cubo di lato 1 m, otto vertici ordinati, materiale elastico e base incastrata. Il Brep fisico deve essere chiuso. La connettivita conta: non riordinare casualmente i vertici.

# ---- group: 02 | PROPRIETA / GEOMETRIA
# Solidi Hexa8: Rhino2Straus | Solidi Hexa8
# Un cubo di lato 1 m, otto vertici ordinati, materiale elastico e base incastrata. Il Brep fisico deve essere chiuso. La connettivita conta: non riordinare casualmente i vertici.
# Unita: kN / m / C. Geometrie incorporate. Le combinazioni sono didattiche.
# COME USARE: Un cubo di lato 1 m, otto vertici ordinati, materiale elastico e base incastrata. Il Brep fisico deve essere chiuso. La connettivita conta: non riordinare casualmente i vertici.
material = Material(
    Name="C30_DEMO",
    Type=0,
    ModulusElasticity=30000000,
    PoissonRatio=0.2,
    ThermalCoefficent=1.17e-05,
    Density=2.55,
    DampingRatio=0.02)
node_element = NodeElement(
    NodePoint=[Point(0, 0, 0), Point(1, 0, 0), Point(1, 1, 0), Point(0, 1, 0), Point(0, 0, 1), Point(1, 0, 1), Point(1, 1, 1), Point(0, 1, 1)],
    NodeID=[1, 2, 3, 4, 5, 6, 7, 8])
node_element_2 = NodeElement(NodePoint=[Point(0, 0, 0), Point(1, 0, 0), Point(1, 1, 0), Point(0, 1, 0)], NodeID=[1, 2, 3, 4])

# ---- group: 03 | ATTRIBUTI / CARICHI
support = Support(Node=node_element_2, Dx=True, Dy=True, Dz=True, Mx=True, My=True, Mz=True)
solid_element = SolidElement(Nodes=node_element, Material=material, ID=1)

# ---- group: 04 | MODEL / OPERAZIONI
build_model = BuildModel(Node=flatten(support), Solids=flatten(solid_element), RenumberModels=True, PreserveNodes=False)

# ---- group: 05 | VERIFICA / LETTURA
validate_straus_model = ValidateStrausModel(Model=build_model)  # -> Valid, Errors, Warnings
model_summary = ModelSummary(Model=build_model)  # -> Nodes, Beams, Plates, Links, LoadCases, Combinations, Groups, Solids
rhino2straus = Rhino2StrausDisplayManager(
    Model=build_model,
    Solid=True,
    Labels=False,
    Axes=False,
    Supports=True,
    AxisScale=1,
    Color=RGB(50, 150, 190),
    Enabled=True,
    LoadScale=1,
    ManagePreviews=True,
    DisplayEnabled=True,
    DisplayLayers=73727)  # -> Status, AvailableCases, Settings, Legend, Breps, BrepIssues
decompose_model = DecomposeModel(Model=build_model)  # -> NodeElements, FrameElements, AreaElements, LinkElements, Solids, Materials, BeamSections, BeamProperties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
model_physical_geometry = ModelPhysicalGeometry(Model=build_model)  # -> BeamSolids, PlateSolids, Centerlines, Solids, Breps, BrepIssues
valido_dati_e_riferimenti = Panel(validate_straus_model.Valid)
riepilogo = Panel(model_summary.Nodes)
