# Grasshopper definition 05_Link_elastico.ghx (Grasshopper 1.0.8)
# plug-ins: Rhino2Straus
# Due nodi distinti collegati da un link elastico. Il primo e vincolato, il secondo e libero. Le prime tre rigidezze sono kN/m, le ultime tre kN m/rad.

# ---- group: 02 | PROPRIETA / GEOMETRIA
# Link e rigidezze: Rhino2Straus | Link e rigidezze
# Due nodi distinti collegati da un link elastico. Il primo e vincolato, il secondo e libero. Le prime tre rigidezze sono kN/m, le ultime tre kN m/rad.
# Unita: kN / m / C. Geometrie incorporate. Le combinazioni sono didattiche.
node_element = NodeElement(NodePoint=Point(0, 0, 0), NodeID=1)
node_element_2 = NodeElement(NodePoint=Point(0, 0, 1), NodeID=2)
elastic_link_property = ElasticLinkProperty(Kx=100000, Ky=100000, Kz=100000, Rx=1000, Ry=1000, Rz=1000)

# ---- group: 03 | ATTRIBUTI / CARICHI
support = Support(Node=node_element, Dx=True, Dy=True, Dz=True, Mx=True, My=True, Mz=True)
link_element = LinkElement(StartPoint=Point(0, 0, 0), EndPoint=Point(0, 0, 1), LinkProperty=elastic_link_property, ID=-1)

# ---- group: 04 | MODEL / OPERAZIONI
build_model = BuildModel(Node=flatten([support, node_element_2]), LinkElement=flatten(link_element), RenumberModels=True, PreserveNodes=False)

# ---- group: 05 | VERIFICA / LETTURA
validate_straus_model = ValidateStrausModel(Model=build_model)  # -> Valid, Errors, Warnings
model_summary = ModelSummary(Model=build_model)  # -> Nodes, Beams, Plates, Links, LoadCases, Combinations, Groups, Solids
rhino2straus = Rhino2StrausDisplayManager(
    Model=build_model,
    Solid=True,
    Labels=False,
    Axes=False,
    Supports=True,
    AxisScale=1,
    Color=RGB(50, 150, 190),
    Enabled=True,
    LoadScale=1,
    ManagePreviews=True,
    DisplayEnabled=True,
    DisplayLayers=73727)  # -> Status, AvailableCases, Settings, Legend, Breps, BrepIssues
decompose_model = DecomposeModel(Model=build_model)  # -> NodeElements, FrameElements, AreaElements, LinkElements, Solids, Materials, BeamSections, BeamProperties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
valido_dati_e_riferimenti = Panel(validate_straus_model.Valid)
riepilogo = Panel(model_summary.Nodes)

# ---- group: 01 | INPUT E ISTRUZIONI
# COME USARE: Due nodi distinti collegati da un link elastico. Il primo e vincolato, il secondo e libero. Le prime tre rigidezze sono kN/m, le ultime tre kN m/rad.
# LETTURA: Il link e rappresentato dall'asse. Non equivale a una trave con volume fisico. Per un collegamento rigido usare il tipo dedicato o l'opzione Rigid in MIDAS.
k_tx_ty_tz_rx_ry_rz = Panel("""100000
100000
100000
1000
1000
1000""")
