# Grasshopper definition 06_Molle_masse.ghx (Grasshopper 1.0.8)
# plug-ins: Rhino2Straus
# Mensola con incastro alla base, molla Kz e massa concentrata in punta. Distinguere sempre masse e forze.

# ---- group: 01 | INPUT E ISTRUZIONI
# COME USARE: Mensola con incastro alla base, molla Kz e massa concentrata in punta. Distinguere sempre masse e forze.
asse_trave = Curve(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)
h_m = Slider(0.3, range=0.1..0.8)
b_m = Slider(0.2, range=0.05..0.6)

# ---- group: 02 | PROPRIETA / GEOMETRIA
# Vincoli, molle e masse: Rhino2Straus | Vincoli, molle e masse
# Mensola con incastro alla base, molla Kz e massa concentrata in punta. Distinguere sempre masse e forze.
# Unita: kN / m / C. Geometrie incorporate. Le combinazioni sono didattiche.
material = Material(
    Name="S355_DEMO",
    Type=0,
    ModulusElasticity=210000000,
    PoissonRatio=0.3,
    ThermalCoefficent=1.17e-05,
    Density=7.849,
    DampingRatio=0.02)
frame_section_solid_rectangular = FrameSectionSolidRectangular(Name="R200x300", Height=h_m, Width=b_m)
frame_property = FrameProperty(Name="R200x300", Section=frame_section_solid_rectangular, Material=material)
node_element = NodeElement(NodePoint=Point(0, 0, 0), NodeID=100)
node_element_2 = NodeElement(NodePoint=Point(3, 0, 0), NodeID=101)
load_case = LoadCase(Name="Q", GravityNSM=False)

# ---- group: 03 | ATTRIBUTI / CARICHI
frame_element = FrameElement(FrameLine=asse_trave, FrameProperty=frame_property, AngleDeg=0, Offset=Vector(0, 0, 0), FrameID=1)
support = Support(Node=node_element, Dx=True, Dy=True, Dz=True, Mx=True, My=True, Mz=True)
load_nodal = LoadNodal(Node=node_element_2, LoadCase=load_case, Fx=0, Fy=0, Fz=-10, Mx=0, My=0, Mz=0)
node_springs = NodeSprings(Node=node_element_2, Translation=Vector(0, 0, 1000), Rotation=Vector(0, 0, 0))
node_mass = NodeMass(Node=node_springs, Translation=Vector(0.1, 0.1, 0.1), Rotation=Vector(0, 0, 0))

# ---- group: 04 | MODEL / OPERAZIONI
build_model = BuildModel(
    Node=flatten([support, load_nodal, node_mass]),
    FrameElement=flatten(frame_element),
    RenumberModels=True,
    PreserveNodes=False)

# ---- group: 05 | VERIFICA / LETTURA
validate_straus_model = ValidateStrausModel(Model=build_model)  # -> Valid, Errors, Warnings
model_summary = ModelSummary(Model=build_model)  # -> Nodes, Beams, Plates, Links, LoadCases, Combinations, Groups, Solids
rhino2straus = Rhino2StrausDisplayManager(
    Model=build_model,
    Solid=True,
    Labels=False,
    Axes=False,
    Supports=True,
    AxisScale=1,
    Color=RGB(50, 150, 190),
    Enabled=True,
    LoadScale=1,
    ManagePreviews=True,
    DisplayEnabled=True,
    DisplayLayers=73727)  # -> Status, AvailableCases, Settings, Legend, Breps, BrepIssues
decompose_model = DecomposeModel(Model=build_model)  # -> NodeElements, FrameElements, AreaElements, LinkElements, Solids, Materials, BeamSections, BeamProperties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
model_physical_geometry = ModelPhysicalGeometry(Model=build_model)  # -> BeamSolids, PlateSolids, Centerlines, Solids, Breps, BrepIssues
valido_dati_e_riferimenti = Panel(validate_straus_model.Valid)
riepilogo = Panel(model_summary.Nodes)
