# Grasshopper definition 08_Carichi_combinazioni.ghx (Grasshopper 1.0.8)
# plug-ins: Rhino2Straus
# Peso proprio G, carico Q e ULS_DEMO = 1.35 G + 1.50 Q. Coefficienti didattici; non sommare copie intermedie dello stesso carico.

# ---- group: 01 | INPUT E ISTRUZIONI
# COME USARE: Peso proprio G, carico Q e ULS_DEMO = 1.35 G + 1.50 Q. Coefficienti didattici; non sommare copie intermedie dello stesso carico.
asse_trave = Curve(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)
h_m = Slider(0.3, range=0.1..0.8)
b_m = Slider(0.2, range=0.05..0.6)

# ---- group: 02 | PROPRIETA / GEOMETRIA
# Casi e combinazioni: Rhino2Straus | Casi e combinazioni
# Peso proprio G, carico Q e ULS_DEMO = 1.35 G + 1.50 Q. Coefficienti didattici; non sommare copie intermedie dello stesso carico.
# Unita: kN / m / C. Geometrie incorporate. Le combinazioni sono didattiche.
material = Material(
    Name="S355_DEMO",
    Type=0,
    ModulusElasticity=210000000,
    PoissonRatio=0.3,
    ThermalCoefficent=1.17e-05,
    Density=7.849,
    DampingRatio=0.02)
frame_section_solid_rectangular = FrameSectionSolidRectangular(Name="R200x300", Height=h_m, Width=b_m)
frame_property = FrameProperty(Name="R200x300", Section=frame_section_solid_rectangular, Material=material)
node_element = NodeElement(NodePoint=Point(0, 0, 0), NodeID=100)
node_element_2 = NodeElement(NodePoint=Point(3, 0, 0), NodeID=101)
load_case = LoadCase(Name="Q", GravityNSM=False)
load_case_2 = LoadCase(Name="G", GravityNSM=False)
load_factor = LoadFactor(LoadCase=load_case_2, Factor=1.35)
load_factor_2 = LoadFactor(LoadCase=load_case, Factor=1.5)

# ---- group: 03 | ATTRIBUTI / CARICHI
frame_element = FrameElement(FrameLine=asse_trave, FrameProperty=frame_property, AngleDeg=0, Offset=Vector(0, 0, 0), FrameID=1)
support = Support(Node=node_element, Dx=True, Dy=True, Dz=True, Mx=True, My=True, Mz=True)
load_nodal = LoadNodal(Node=node_element_2, LoadCase=load_case, Fx=0, Fy=0, Fz=-10, Mx=0, My=0, Mz=0)
self_weight = SelfWeight(LoadCase=load_case_2, Axis=2, Factor=-1, StructuralMass=True, NonstructuralMass=True)
load_combination = LoadCombination(Name="ULS_DEMO", LoadFactor=[load_factor, load_factor_2], Type=0)

# ---- group: 04 | MODEL / OPERAZIONI
build_model = BuildModel(
    Node=flatten([support, load_nodal]),
    FrameElement=flatten(frame_element),
    LoadCombination=flatten(load_combination),
    SelfWeight=self_weight,
    RenumberModels=True,
    PreserveNodes=False)

# ---- group: 05 | VERIFICA / LETTURA
validate_straus_model = ValidateStrausModel(Model=build_model)  # -> Valid, Errors, Warnings
model_summary = ModelSummary(Model=build_model)  # -> Nodes, Beams, Plates, Links, LoadCases, Combinations, Groups, Solids
rhino2straus = Rhino2StrausDisplayManager(
    Model=build_model,
    Solid=True,
    Labels=False,
    Axes=False,
    Supports=True,
    AxisScale=1,
    Color=RGB(50, 150, 190),
    Enabled=True,
    LoadScale=1,
    ManagePreviews=True,
    DisplayEnabled=True,
    DisplayLayers=73727)  # -> Status, AvailableCases, Settings, Legend, Breps, BrepIssues
decompose_model = DecomposeModel(Model=build_model)  # -> NodeElements, FrameElements, AreaElements, LinkElements, Solids, Materials, BeamSections, BeamProperties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
model_physical_geometry = ModelPhysicalGeometry(Model=build_model)  # -> BeamSolids, PlateSolids, Centerlines, Solids, Breps, BrepIssues
valido_dati_e_riferimenti = Panel(validate_straus_model.Valid)
riepilogo = Panel(model_summary.Nodes)
