# Grasshopper definition 09_Unione_filtri.ghx (Grasshopper 1.0.8)
# plug-ins: Rhino2Straus
# Due mensole indipendenti, con ID coordinati, confluiscono in un Model. Decomposizione e filtro recuperano un sottoinsieme.

# ---- group: 01 | INPUT E ISTRUZIONI
# COME USARE: Due mensole indipendenti, con ID coordinati, confluiscono in un Model. Decomposizione e filtro recuperano un sottoinsieme.
# ID E DIPENDENZE: I due modelli condividono materiale e sezione; gli elementi hanno ID distinti. Straus puo rinumerare, SAP/MIDAS richiedono riferimenti coordinati. Il merge invalida risultati precedenti.
asse_trave = Curve(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)
asse_trave_2 = Curve(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)
h_m = Slider(0.3, range=0.1..0.8)
b_m = Slider(0.2, range=0.05..0.6)

# ---- group: 02 | PROPRIETA / GEOMETRIA
# Unione, decomposizione e filtri: Rhino2Straus | Unione, decomposizione e filtri
# Due mensole indipendenti, con ID coordinati, confluiscono in un Model. Decomposizione e filtro recuperano un sottoinsieme.
# Unita: kN / m / C. Geometrie incorporate. Le combinazioni sono didattiche.
material = Material(
    Name="S355_DEMO",
    Type=0,
    ModulusElasticity=210000000,
    PoissonRatio=0.3,
    ThermalCoefficent=1.17e-05,
    Density=7.849,
    DampingRatio=0.02)
frame_section_solid_rectangular = FrameSectionSolidRectangular(Name="R200x300", Height=h_m, Width=b_m)
frame_property = FrameProperty(Name="R200x300", Section=frame_section_solid_rectangular, Material=material)
node_element = NodeElement(NodePoint=Point(0, 0, 0), NodeID=100)
node_element_2 = NodeElement(NodePoint=Point(3, 0, 0), NodeID=101)
node_element_3 = NodeElement(NodePoint=Point(4, 0, 0), NodeID=200)
node_element_4 = NodeElement(NodePoint=Point(7, 0, 0), NodeID=201)

# ---- group: 03 | ATTRIBUTI / CARICHI
frame_element = FrameElement(FrameLine=asse_trave, FrameProperty=frame_property, AngleDeg=0, Offset=Vector(0, 0, 0), FrameID=1)
support = Support(Node=node_element, Dx=True, Dy=True, Dz=True, Mx=True, My=True, Mz=True)
frame_element_2 = FrameElement(FrameLine=asse_trave_2, FrameProperty=frame_property, AngleDeg=0, Offset=Vector(0, 0, 0), FrameID=2)
support_2 = Support(Node=node_element_3, Dx=True, Dy=True, Dz=True, Mx=True, My=True, Mz=True)

# ---- group: 04 | MODEL / OPERAZIONI
build_model = BuildModel(Node=flatten([support, node_element_2]), FrameElement=flatten(frame_element), RenumberModels=True, PreserveNodes=False)
build_model_2 = BuildModel(
    Node=flatten([support_2, node_element_4]),
    FrameElement=flatten(frame_element_2),
    RenumberModels=True,
    PreserveNodes=False)
merge_straus_models = MergeStrausModels(Models=[build_model, build_model_2], Renumber=False)

# ---- group: 05 | VERIFICA / LETTURA
validate_straus_model = ValidateStrausModel(Model=merge_straus_models)  # -> Valid, Errors, Warnings
model_summary = ModelSummary(Model=merge_straus_models)  # -> Nodes, Beams, Plates, Links, LoadCases, Combinations, Groups, Solids
rhino2straus = Rhino2StrausDisplayManager(
    Model=merge_straus_models,
    Solid=True,
    Labels=False,
    Axes=False,
    Supports=True,
    AxisScale=1,
    Color=RGB(50, 150, 190),
    Enabled=True,
    LoadScale=1,
    ManagePreviews=True,
    DisplayEnabled=True,
    DisplayLayers=73727)  # -> Status, AvailableCases, Settings, Legend, Breps, BrepIssues
decompose_model = DecomposeModel(Model=merge_straus_models)  # -> NodeElements, FrameElements, AreaElements, LinkElements, Solids, Materials, BeamSections, BeamProperties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
model_physical_geometry = ModelPhysicalGeometry(Model=merge_straus_models)  # -> BeamSolids, PlateSolids, Centerlines, Solids, Breps, BrepIssues
valido_dati_e_riferimenti = Panel(validate_straus_model.Valid)
riepilogo = Panel(model_summary.Nodes)

# ---- group: 06 | RISULTATI
frame_filter = FrameFilter(FrameElements=decompose_model.FrameElements, Tolerance=0.001)  # -> FilteredFrames, OtherFrames
elementi_filtrati = Panel(frame_filter.FilteredFrames)
