# Grasshopper definition 11_Import_model.ghx (Grasshopper 1.0.8)
# plug-ins: Rhino2Straus
# Leggi il modello nativo e ottieni il Model associato. Controlla Issues per conoscere dati importati e limiti.

# ---- group: 01 | INPUT E ISTRUZIONI
# Modello esistente verso Grasshopper: Rhino2Straus | Modello esistente verso Grasshopper
# Leggi il modello nativo e ottieni il Model associato. Controlla Issues per conoscere dati importati e limiti.
# Unita: quelle restituite dal lettore; vedere Summary.
# COME USARE: Leggi il modello nativo e ottieni il Model associato. Controlla Issues per conoscere dati importati e limiti.
# UNITA DEL MODELLO: Il lettore converte in m/kN/kPa/tonnellate/C. Report segnala omissioni; Allow partial parte false.
read_model = BooleanToggle(False)
path_percorso_locale_modificabile = Panel("C:\Users\g.pacini\Documents\Rhino2FEM_Examples\Rhino2Straus\10_Export.st7")

# ---- group: 03 | ATTRIBUTI / CARICHI
read_st7_model = ReadStrausModel(ModelPath=path_percorso_locale_modificabile, Read=read_model, FreedomCase=1, AllowPartial=False, Tolerance=0.001)  # -> Model, Complete, Report, IdentityMap, Status

# ---- group: 04 | MODEL / OPERAZIONI
gate = StreamGate(Stream=read_st7_model.Model, Gate=read_model)  # -> Target0, Target1
corrispondenza_id = Panel(read_st7_model.IdentityMap)
import_limiti = Panel(read_st7_model.Report)

# ---- group: 05 | VERIFICA / LETTURA
validate_straus_model = ValidateStrausModel(Model=gate.Target1)  # -> Valid, Errors, Warnings
model_summary = ModelSummary(Model=gate.Target1)  # -> Nodes, Beams, Plates, Links, LoadCases, Combinations, Groups, Solids
rhino2straus = Rhino2StrausDisplayManager(
    Model=gate.Target1,
    Solid=True,
    Labels=False,
    Axes=False,
    Supports=True,
    AxisScale=1,
    Color=RGB(50, 150, 190),
    Enabled=True,
    LoadScale=1,
    ManagePreviews=True,
    DisplayEnabled=True,
    DisplayLayers=73727)  # -> Status, AvailableCases, Settings, Legend, Breps, BrepIssues
decompose_model = DecomposeModel(Model=gate.Target1)  # -> NodeElements, FrameElements, AreaElements, LinkElements, Solids, Materials, BeamSections, BeamProperties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
model_physical_geometry = ModelPhysicalGeometry(Model=gate.Target1)  # -> BeamSolids, PlateSolids, Centerlines, Solids, Breps, BrepIssues
valido_dati_e_riferimenti = Panel(validate_straus_model.Valid)
riepilogo = Panel(model_summary.Nodes)
