# Grasshopper definition 12_Analisi_frame.ghx (Grasshopper 1.0.8)
# plug-ins: Rhino2Straus
# Model -> analisi -> Model con risultati -> casi, azioni, deformata e diagramma. I lettori attendono risultati reali del solver.

# ---- group: 01 | INPUT E ISTRUZIONI
# COME USARE: Model -> analisi -> Model con risultati -> casi, azioni, deformata e diagramma. I lettori attendono risultati reali del solver.
# LETTORI IN ATTESA: Stream Gate chiude il ramo finche RUN/READ=false. Dopo il calcolo scegli un caso reale. MIDAS usa etichette come Q(ST): controlla quelle restituite. Gli inviluppi non sono una deformata simultanea.
asse_trave = Curve(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)
# Analisi e risultati delle travi: Rhino2Straus | Analisi e risultati delle travi
# Model -> analisi -> Model con risultati -> casi, azioni, deformata e diagramma. I lettori attendono risultati reali del solver.
# Unita: kN / m / C. Geometrie incorporate. Le combinazioni sono didattiche.
run_analisi = BooleanToggle(False)
overwrite_sostituisci_file = BooleanToggle(False)
path_percorso_locale_modificabile = Panel("C:\Users\g.pacini\Documents\Rhino2FEM_Examples\Rhino2Straus\12_Analisi_frame.st7")
h_m = Slider(0.3, range=0.1..0.8)
b_m = Slider(0.2, range=0.05..0.6)

# ---- group: 02 | PROPRIETA / GEOMETRIA
material = Material(
    Name="S355_DEMO",
    Type=0,
    ModulusElasticity=210000000,
    PoissonRatio=0.3,
    ThermalCoefficent=1.17e-05,
    Density=7.849,
    DampingRatio=0.02)
frame_section_solid_rectangular = FrameSectionSolidRectangular(Name="R200x300", Height=h_m, Width=b_m)
frame_property = FrameProperty(Name="R200x300", Section=frame_section_solid_rectangular, Material=material)
node_element = NodeElement(NodePoint=Point(0, 0, 0), NodeID=100)
node_element_2 = NodeElement(NodePoint=Point(3, 0, 0), NodeID=101)
load_case = LoadCase(Name="Q", GravityNSM=False)

# ---- group: 03 | ATTRIBUTI / CARICHI
frame_element = FrameElement(FrameLine=asse_trave, FrameProperty=frame_property, AngleDeg=0, Offset=Vector(0, 0, 0), FrameID=1)
support = Support(Node=node_element, Dx=True, Dy=True, Dz=True, Mx=True, My=True, Mz=True)
load_nodal = LoadNodal(Node=node_element_2, LoadCase=load_case, Fx=0, Fy=0, Fz=-10, Mx=0, My=0, Mz=0)

# ---- group: 04 | MODEL / OPERAZIONI
build_model = BuildModel(Node=flatten([support, load_nodal]), FrameElement=flatten(frame_element), RenumberModels=True, PreserveNodes=False)
run_model_cases_and_combinations = RunModelCasesAndCombinations(
    Model=build_model,
    ModelPath=path_percorso_locale_modificabile,
    Run=run_analisi,
    Overwrite=overwrite_sostituisci_file,
    RunCases=True,
    RunCombinations=True,
    Stations=11,
    Sample=1)  # -> Model, ResultPath, Status, Unavailable
esito_operazione = Panel(run_model_cases_and_combinations.Status)

# ---- group: 05 | VERIFICA / LETTURA
validate_straus_model = ValidateStrausModel(Model=build_model)  # -> Valid, Errors, Warnings
model_summary = ModelSummary(Model=build_model)  # -> Nodes, Beams, Plates, Links, LoadCases, Combinations, Groups, Solids
rhino2straus = Rhino2StrausDisplayManager(
    Model=build_model,
    Solid=True,
    Labels=False,
    Axes=False,
    Supports=True,
    AxisScale=1,
    Color=RGB(50, 150, 190),
    Enabled=True,
    LoadScale=1,
    ManagePreviews=True,
    DisplayEnabled=True,
    DisplayLayers=73727)  # -> Status, AvailableCases, Settings, Legend, Breps, BrepIssues
decompose_model = DecomposeModel(Model=build_model)  # -> NodeElements, FrameElements, AreaElements, LinkElements, Solids, Materials, BeamSections, BeamProperties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
model_physical_geometry = ModelPhysicalGeometry(Model=build_model)  # -> BeamSolids, PlateSolids, Centerlines, Solids, Breps, BrepIssues
gate = StreamGate(Stream=run_model_cases_and_combinations.Model, Gate=run_analisi)  # -> Target0, Target1
valido_dati_e_riferimenti = Panel(validate_straus_model.Valid)
riepilogo = Panel(model_summary.Nodes)

# ---- group: 06 | RISULTATI
model_result_cases = ModelResultCases(Model=gate.Target1)  # -> Numbers, Names, Secondary, Complete, ProvenanceVerified, Unavailable, Results
decompose_model_2 = DecomposeModel(Model=gate.Target1)  # -> NodeElements, FrameElements, AreaElements, LinkElements, Solids, Materials, BeamSections, BeamProperties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
model_beam_actions_n_v_t_m = ModelBeamActionsNVTM(Model=gate.Target1, Case=0)  # -> N, V1, V2, T, M1, M2, Positions
casi_stati = Panel(model_result_cases.Numbers)
azioni_di_trave = Panel(model_beam_actions_n_v_t_m.N)

# ---- group: 07 | APPROFONDIMENTI
model_deformed_geometry = ModelDeformedGeometry(Model=gate.Target1, Case=1, Scale=100)  # -> Nodes, Beams, PlatesAndSolids
model_node_reaction = ModelNodeReaction(Model=gate.Target1, Case=0, Surface=-1)  # -> Values, Positions, Columns, AxesAndSampling, Records
model_beam_force_diagram = ModelBeamForceDiagram(Model=gate.Target1, Case=1, Action="M2", Scale=0.01, DisplayAxis=2)  # -> Diagrams, Values
reazioni = Panel(model_node_reaction.Values)
