# Grasshopper definition 13_Analisi_mesh.ghx (Grasshopper 1.0.8)
# plug-ins: Rhino2Straus
# Piastra Quad4 con pressione: Model -> solver -> azioni di piastra, spostamenti e reazioni. Nessun risultato e simulato.

# ---- group: 01 | INPUT E ISTRUZIONI
# COME USARE: Piastra Quad4 con pressione: Model -> solver -> azioni di piastra, spostamenti e reazioni. Nessun risultato e simulato.
# LETTORI IN ATTESA: Stream Gate chiude il ramo finche RUN/READ=false. Dopo il calcolo scegli un caso reale. MIDAS usa etichette come Q(ST): controlla quelle restituite. Gli inviluppi non sono una deformata simultanea.
mesh_incorporata = Mesh(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)
# Analisi e risultati delle piastre: Rhino2Straus | Analisi e risultati delle piastre
# Piastra Quad4 con pressione: Model -> solver -> azioni di piastra, spostamenti e reazioni. Nessun risultato e simulato.
# Unita: kN / m / C. Geometrie incorporate. Le combinazioni sono didattiche.
run_analisi = BooleanToggle(False)
overwrite_sostituisci_file = BooleanToggle(False)
path_percorso_locale_modificabile = Panel("C:\Users\g.pacini\Documents\Rhino2FEM_Examples\Rhino2Straus\13_Analisi_mesh.st7")
spessore_t_m = Slider(0.2, range=0.05..0.5)

# ---- group: 02 | PROPRIETA / GEOMETRIA
material = Material(
    Name="C30_DEMO",
    Type=0,
    ModulusElasticity=30000000,
    PoissonRatio=0.2,
    ThermalCoefficent=1.17e-05,
    Density=2.55,
    DampingRatio=0.02)
area_thickness = AreaThickness(Name="Shell20", Thickness=spessore_t_m)
area_property = AreaProperty(Name="Plate", Section=area_thickness, Material=material, Type=0)
node_element = NodeElement(
    NodePoint=[Point(0, 0, 0), Point(2, 0, 0), Point(4, 0, 0), Point(0, 1.5, 0), Point(4, 1.5, 0), Point(0, 3, 0), Point(2, 3, 0), Point(4, 3, 0)],
    NodeID=[100, 101, 102, 103, 104, 105, 106, 107])
load_case = LoadCase(Name="Q", GravityNSM=False)

# ---- group: 03 | ATTRIBUTI / CARICHI
mesh_to_plates = MeshToPlates(Mesh=mesh_incorporata, Property=area_property, FirstID=-1)
support = Support(Node=node_element, Dx=True, Dy=True, Dz=True, Mx=True, My=True, Mz=True)
plate_global_pressure = PlateGlobalPressure(Plate=mesh_to_plates, LoadCase=load_case, Pressure=Vector(0, 0, -5), TopFace=True, Projected=False)

# ---- group: 04 | MODEL / OPERAZIONI
build_model = BuildModel(Node=flatten(support), AreaElement=flatten(plate_global_pressure), RenumberModels=True, PreserveNodes=False)
run_model_cases_and_combinations = RunModelCasesAndCombinations(
    Model=build_model,
    ModelPath=path_percorso_locale_modificabile,
    Run=run_analisi,
    Overwrite=overwrite_sostituisci_file,
    RunCases=True,
    RunCombinations=True,
    Stations=11,
    Sample=1)  # -> Model, ResultPath, Status, Unavailable
esito_operazione = Panel(run_model_cases_and_combinations.Status)

# ---- group: 05 | VERIFICA / LETTURA
validate_straus_model = ValidateStrausModel(Model=build_model)  # -> Valid, Errors, Warnings
model_summary = ModelSummary(Model=build_model)  # -> Nodes, Beams, Plates, Links, LoadCases, Combinations, Groups, Solids
rhino2straus = Rhino2StrausDisplayManager(
    Model=build_model,
    Solid=True,
    Labels=False,
    Axes=False,
    Supports=True,
    AxisScale=1,
    Color=RGB(50, 150, 190),
    Enabled=True,
    LoadScale=1,
    ManagePreviews=True,
    DisplayEnabled=True,
    DisplayLayers=73727)  # -> Status, AvailableCases, Settings, Legend, Breps, BrepIssues
decompose_model = DecomposeModel(Model=build_model)  # -> NodeElements, FrameElements, AreaElements, LinkElements, Solids, Materials, BeamSections, BeamProperties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
model_physical_geometry = ModelPhysicalGeometry(Model=build_model)  # -> BeamSolids, PlateSolids, Centerlines, Solids, Breps, BrepIssues
gate = StreamGate(Stream=run_model_cases_and_combinations.Model, Gate=run_analisi)  # -> Target0, Target1
valido_dati_e_riferimenti = Panel(validate_straus_model.Valid)
riepilogo = Panel(model_summary.Nodes)

# ---- group: 06 | RISULTATI
model_result_cases = ModelResultCases(Model=gate.Target1)  # -> Numbers, Names, Secondary, Complete, ProvenanceVerified, Unavailable, Results
decompose_model_2 = DecomposeModel(Model=gate.Target1)  # -> NodeElements, FrameElements, AreaElements, LinkElements, Solids, Materials, BeamSections, BeamProperties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
model_plate_force = ModelPlateForce(Model=gate.Target1, Case=0, Surface=-1)  # -> Values, Positions, Columns, AxesAndSampling, Records
casi_stati = Panel(model_result_cases.Numbers)
azioni_di_piastra = Panel(model_plate_force.Values)

# ---- group: 07 | APPROFONDIMENTI
model_deformed_geometry = ModelDeformedGeometry(Model=gate.Target1, Case=1, Scale=100)  # -> Nodes, Beams, PlatesAndSolids
model_node_reaction = ModelNodeReaction(Model=gate.Target1, Case=0, Surface=-1)  # -> Values, Positions, Columns, AxesAndSampling, Records
model_plate_moment = ModelPlateMoment(Model=gate.Target1, Case=0, Surface=-1)  # -> Values, Positions, Columns, AxesAndSampling, Records
reazioni = Panel(model_node_reaction.Values)
momenti = Panel(model_plate_moment.Values)
