# Grasshopper definition 15_Preview_bake.ghx (Grasshopper 1.0.8)
# plug-ins: Rhino2Straus
# Confronta assi e solidi fisici. La preview e temporanea; il bake crea oggetti nel documento Rhino. BAKE parte spento.

# ---- group: 01 | INPUT E ISTRUZIONI
# COME USARE: Confronta assi e solidi fisici. La preview e temporanea; il bake crea oggetti nel documento Rhino. BAKE parte spento.
# BAKE STRAUS: Model Physical Geometry restituisce Brep chiusi e supporta il bake dal menu contestuale. Bake Straus Geometry serve invece per un file .st7.
asse_trave = Curve(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)
# Preview, impostazioni e bake: Rhino2Straus | Preview, impostazioni e bake
# Confronta assi e solidi fisici. La preview e temporanea; il bake crea oggetti nel documento Rhino. BAKE parte spento.
# Unita: kN / m / C. Geometrie incorporate. Le combinazioni sono didattiche.
etichette = BooleanToggle(True)
h_m = Slider(0.3, range=0.1..0.8)
b_m = Slider(0.2, range=0.05..0.6)

# ---- group: 02 | PROPRIETA / GEOMETRIA
material = Material(
    Name="S355_DEMO",
    Type=0,
    ModulusElasticity=210000000,
    PoissonRatio=0.3,
    ThermalCoefficent=1.17e-05,
    Density=7.849,
    DampingRatio=0.02)
frame_section_solid_rectangular = FrameSectionSolidRectangular(Name="R200x300", Height=h_m, Width=b_m)
frame_property = FrameProperty(Name="R200x300", Section=frame_section_solid_rectangular, Material=material)
node_element = NodeElement(NodePoint=Point(0, 0, 0), NodeID=100)
node_element_2 = NodeElement(NodePoint=Point(3, 0, 0), NodeID=101)
load_case = LoadCase(Name="Q", GravityNSM=False)

# ---- group: 03 | ATTRIBUTI / CARICHI
frame_element = FrameElement(FrameLine=asse_trave, FrameProperty=frame_property, AngleDeg=0, Offset=Vector(0, 0, 0), FrameID=1)
support = Support(Node=node_element, Dx=True, Dy=True, Dz=True, Mx=True, My=True, Mz=True)
load_nodal = LoadNodal(Node=node_element_2, LoadCase=load_case, Fx=0, Fy=0, Fz=-10, Mx=0, My=0, Mz=0)

# ---- group: 04 | MODEL / OPERAZIONI
build_model = BuildModel(Node=flatten([support, load_nodal]), FrameElement=flatten(frame_element), RenumberModels=True, PreserveNodes=False)

# ---- group: 05 | VERIFICA / LETTURA
validate_straus_model = ValidateStrausModel(Model=build_model)  # -> Valid, Errors, Warnings
model_summary = ModelSummary(Model=build_model)  # -> Nodes, Beams, Plates, Links, LoadCases, Combinations, Groups, Solids
rhino2straus = Rhino2StrausDisplayManager(
    Model=build_model,
    Solid=True,
    Labels=False,
    Axes=False,
    Supports=True,
    AxisScale=1,
    Color=RGB(50, 150, 190),
    Enabled=True,
    LoadScale=1,
    ManagePreviews=True,
    DisplayEnabled=True,
    DisplayLayers=73727)  # -> Status, AvailableCases, Settings, Legend, Breps, BrepIssues
decompose_model = DecomposeModel(Model=build_model)  # -> NodeElements, FrameElements, AreaElements, LinkElements, Solids, Materials, BeamSections, BeamProperties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
model_physical_geometry = ModelPhysicalGeometry(Model=build_model)  # -> BeamSolids, PlateSolids, Centerlines, Solids, Breps, BrepIssues
valido_dati_e_riferimenti = Panel(validate_straus_model.Valid)
riepilogo = Panel(model_summary.Nodes)

# ---- group: 06 | RISULTATI
display_settings = Rhino2StrausDisplaySettings(
    Enabled=True,
    Nodes=True,
    Beams=True,
    Plates=True,
    Solids=True,
    Links=True,
    Sections=True,
    Loads=True,
    Supports=True,
    Releases=True,
    Springs=True,
    Masses=True,
    Prescribed=True,
    Offsets=True,
    Axes=False,
    Labels=etichette,
    Properties=False,
    Values=True,
    Results=False,
    Shaded=True,
    SymbolScale=1,
    LoadScale=1,
    Transparency=0.3)
rhino2straus_2 = Rhino2StrausDisplayManager(
    Model=build_model,
    Solid=True,
    Labels=False,
    Axes=False,
    Supports=True,
    AxisScale=1,
    Color=RGB(50, 150, 190),
    Enabled=True,
    Settings=display_settings,
    LoadScale=1,
    ManagePreviews=True,
    DisplayEnabled=True,
    DisplayLayers=73727)  # -> Status, AvailableCases, Settings, Legend, Breps, BrepIssues
model_physical_geometry_2 = ModelPhysicalGeometry(Model=build_model)  # -> BeamSolids, PlateSolids, Centerlines, Solids, Breps, BrepIssues
