# Grasshopper definition 16_Analisi_avanzate.ghx (Grasshopper 1.0.8)
# plug-ins: Rhino2Straus
# Collegamenti per analisi modale, non lineare e buckling dove disponibili. Controllare massa, casi e stato iniziale; i solver restano spenti.

# ---- group: 01 | INPUT E ISTRUZIONI
# COME USARE: Collegamenti per analisi modale, non lineare e buckling dove disponibili. Controllare massa, casi e stato iniziale; i solver restano spenti.
asse_trave = Curve(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)
# Analisi avanzate: Rhino2Straus | Analisi avanzate
# Collegamenti per analisi modale, non lineare e buckling dove disponibili. Controllare massa, casi e stato iniziale; i solver restano spenti.
# Unita: kN / m / C. Geometrie incorporate. Le combinazioni sono didattiche.
run_runmodelmodalcomponent = BooleanToggle(False)
run_runmodelnonlinearcomponent = BooleanToggle(False)
run_runmodelbucklingcomponent = BooleanToggle(False)
path_percorso_locale_modificabile = Panel("C:\Users\g.pacini\Documents\Rhino2FEM_Examples\Rhino2Straus\16_Analisi_avanzate_RunModelModalComponent.st7")
path_percorso_locale_modificabile_2 = Panel("C:\Users\g.pacini\Documents\Rhino2FEM_Examples\Rhino2Straus\16_Analisi_avanzate_RunModelNonlinearComponent.st7")
path_percorso_locale_modificabile_3 = Panel("C:\Users\g.pacini\Documents\Rhino2FEM_Examples\Rhino2Straus\16_Analisi_avanzate_RunModelBucklingComponent.st7")
lsa_iniziale = Panel("C:\Users\g.pacini\Documents\Rhino2FEM_Examples\Rhino2Straus\12_Analisi_frame.LSA")
h_m = Slider(0.3, range=0.1..0.8)
b_m = Slider(0.2, range=0.05..0.6)

# ---- group: 02 | PROPRIETA / GEOMETRIA
material = Material(
    Name="S355_DEMO",
    Type=0,
    ModulusElasticity=210000000,
    PoissonRatio=0.3,
    ThermalCoefficent=1.17e-05,
    Density=7.849,
    DampingRatio=0.02)
frame_section_solid_rectangular = FrameSectionSolidRectangular(Name="R200x300", Height=h_m, Width=b_m)
frame_property = FrameProperty(Name="R200x300", Section=frame_section_solid_rectangular, Material=material)
node_element = NodeElement(NodePoint=Point(0, 0, 0), NodeID=100)
node_element_2 = NodeElement(NodePoint=Point(3, 0, 0), NodeID=101)
load_case = LoadCase(Name="Q", GravityNSM=False)

# ---- group: 03 | ATTRIBUTI / CARICHI
frame_element = FrameElement(FrameLine=asse_trave, FrameProperty=frame_property, AngleDeg=0, Offset=Vector(0, 0, 0), FrameID=1)
support = Support(Node=node_element, Dx=True, Dy=True, Dz=True, Mx=True, My=True, Mz=True)
load_nodal = LoadNodal(Node=node_element_2, LoadCase=load_case, Fx=0, Fy=0, Fz=-10, Mx=0, My=0, Mz=0)

# ---- group: 04 | MODEL / OPERAZIONI
build_model = BuildModel(Node=flatten([support, load_nodal]), FrameElement=flatten(frame_element), RenumberModels=True, PreserveNodes=False)

# ---- group: 05 | VERIFICA / LETTURA
validate_straus_model = ValidateStrausModel(Model=build_model)  # -> Valid, Errors, Warnings
model_summary = ModelSummary(Model=build_model)  # -> Nodes, Beams, Plates, Links, LoadCases, Combinations, Groups, Solids
rhino2straus = Rhino2StrausDisplayManager(
    Model=build_model,
    Solid=True,
    Labels=False,
    Axes=False,
    Supports=True,
    AxisScale=1,
    Color=RGB(50, 150, 190),
    Enabled=True,
    LoadScale=1,
    ManagePreviews=True,
    DisplayEnabled=True,
    DisplayLayers=73727)  # -> Status, AvailableCases, Settings, Legend, Breps, BrepIssues
decompose_model = DecomposeModel(Model=build_model)  # -> NodeElements, FrameElements, AreaElements, LinkElements, Solids, Materials, BeamSections, BeamProperties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
model_physical_geometry = ModelPhysicalGeometry(Model=build_model)  # -> BeamSolids, PlateSolids, Centerlines, Solids, Breps, BrepIssues
valido_dati_e_riferimenti = Panel(validate_straus_model.Valid)
riepilogo = Panel(model_summary.Nodes)

# ---- group: 06 | RISULTATI
run_model_natural_frequencies = RunModelNaturalFrequencies(
    Model=build_model,
    ModelPath=path_percorso_locale_modificabile,
    Run=run_runmodelmodalcomponent,
    Overwrite=False,
    Modes=10,
    ShiftHz=0)  # -> Model, ResultPath, Status, Unavailable
run_model_nonlinear_static = RunModelNonlinearStatic(
    Model=build_model,
    ModelPath=path_percorso_locale_modificabile_2,
    Run=run_runmodelnonlinearcomponent,
    Overwrite=False,
    CaseName="Q",
    Steps=10,
    FinalFactor=1,
    NonlinearGeometry=True)  # -> Model, ResultPath, Status, Unavailable
run_model_linear_buckling = RunModelLinearBuckling(
    Model=build_model,
    ModelPath=path_percorso_locale_modificabile_3,
    Run=run_runmodelbucklingcomponent,
    Overwrite=False,
    InitialLSA=lsa_iniziale,
    VariableResultCase=1,
    FixedResultCase=0,
    Modes=10,
    Shift=0)  # -> Model, ResultPath, Status, Unavailable
